# Grasshopper definition 016_exercises_Section_002_continued.gh (Grasshopper 1.0.7)
# plug-ins: Kangaroo2 Components, MeshEdit Components, Bifocals

# ----
# 030_intersect_mathematical
# - consider and visualize how points, lines and curves
# are created by intersections
# - controling plane region
# - isovist can product very interesting effects
number_slider = Slider(12, range=0..100)
number_slider_2 = Slider(6, range=0..10)
number_slider_3 = Slider(13, range=0..100)  # disabled
brep_line = BrepLine(LimitToFirst=False)  # -> Curves, Points; disabled
curve_plane = CurvePlane()  # -> Points, ParamsC, ParamsP
origin = Origin([Point(-45.78873606, -28.06335384, 0), Point(16.72870203, 65.64266703, 0), Point(-58.87617381, 62.3246864, 0), Point(101.0585885, -89.13142274, 0)])
xz_plane = XZPlane(Origin=Point(0, 0, 0))  # disabled
xz_plane_2 = XZPlane(Origin=Point(0, 0, 0))
number_slider_4 = Slider(2, range=0..2)  # disabled
radial = Radial(Plane=PlaneXY(0, 0, 0), Size=number_slider, ExtentR=number_slider_2, ExtentP=number_slider_2)  # -> Cells, simplify(Points)
mesh_plane = MeshPlane()
number_slider_5 = Slider(5, range=0..10)  # disabled
line_line = LineLine()  # -> ParamA, ParamB, PointA, PointB; disabled
plane_origin = PlaneOrigin(Base=xz_plane_2, Origin=origin)
sphere = Sphere(Base=PlaneXY(0, 0, 0), Radius=number_slider_3)  # disabled
mesh_ray = MeshRay()  # -> Point, Hit
number_slider_6 = Slider(2, range=0..10)  # disabled
explode_tree = ExplodeTree(Data=graft(plane_origin))  # -> Branch0, Branch1, Branch2, Branch3
flip_matrix = FlipMatrix(Data=radial.Points)
pi = Pi(Factor=Slider(0.33, range=0..1))
pi_2 = Pi(Factor=Slider(0.53, range=0..1))
pi_3 = Pi(Factor=Slider(0.92, range=0..1))
plane_plane = PlanePlane()
pi_4 = Pi(Factor=Slider(0.22, range=0..1))
surface_line = SurfaceLine(LimitToFirst=False)  # -> Curves, Points, UVPoints, Normal; disabled
range = Range(Domain=number_slider_4, Steps=number_slider_5)  # disabled
cull_index = CullIndex(List=flip_matrix, Indices="0", Wrap=True)
isovist_ray = IsoVistRay(Radius=100)  # -> Point, Distance, Index
rotate_3d = Rotate3D(Geometry=explode_tree.Branch0, Angle=pi_4, Center=explode_tree.Branch0, Axis=Vector(0, 0, 1))  # -> Geometry, Transform
rotate_3d_2 = Rotate3D(Geometry=explode_tree.Branch1, Angle=pi_3, Center=explode_tree.Branch0, Axis=Vector(0, 0, 1))  # -> Geometry, Transform
rotate_3d_3 = Rotate3D(Geometry=explode_tree.Branch2, Angle=pi_2, Center=explode_tree.Branch2, Axis=Vector(0, 0, 1))  # -> Geometry, Transform
rotate_3d_4 = Rotate3D(Geometry=explode_tree.Branch3, Angle=pi, Center=explode_tree.Branch3, Axis=Vector(0, 0, 1))  # -> Geometry, Transform
construct_domain = ConstructDomain(DomainStart=Slider(1.3, range=0.1..3), DomainEnd=Slider(6.78, range=0.1..10))
plane_plane_plane = PlanePlanePlane()  # -> Point, LineAB, LineAC, LineBC
list_length = ListLength(List=cull_index)
pi_5 = Pi(Factor=range)  # disabled
contour = Contour(Shape=sphere, Point=Point(0, 0, 0), Direction=Vector(0, 0, 1), Distance=number_slider_6)  # disabled
xz_plane_3 = XZPlane(Origin=Point(0, 0, 0))  # disabled
yz_plane = YZPlane(Origin=Point(0, 0, 0))  # disabled
xy_plane = XYPlane(Origin=Point(0, 0, 0))  # disabled
range_2 = Range(Domain=construct_domain, Steps=expr("x-1", list_length))
plane = Plane(PlaneXY(0, 0, 0))
series = Series(Start="3", Step=1, Count=list_length)
plane_region = PlaneRegion(Plane=plane, Bounds=flatten([rotate_3d_3.Geometry, rotate_3d.Geometry, rotate_3d_2.Geometry, rotate_3d_4.Geometry]))
rotate_3d_5 = Rotate3D(Geometry=xz_plane, Angle=pi_5, Center=xz_plane, Axis=graft([yz_plane, xz_plane_3, xy_plane]))  # -> Geometry, Transform; disabled
curve = Curve(plane_region)
construct_point = ConstructPoint(XCoordinate=Slider(11, range=0..100), YCoordinate=Slider(29, range=0..100), ZCoordinate=0)
brep_plane = BrepPlane(Brep=sphere, Plane=rotate_3d_5.Geometry)  # -> Curves, Points; disabled
origin_2 = Origin(construct_point)
xy_plane_2 = XYPlane(Origin=origin_2)
multipipe = MultiPipe(Curves=contour, NodeSize=0.5, EndOffset=1, StrutSize=1, Segment=0, KinkAngle=0.6, CubeFit=0, Caps=0)  # disabled
polygon = Polygon(Plane=flatten(cull_index), Radius=flatten(range_2), Segments=flatten(series), FilletRadius=0)  # -> flatten(Polygon), Length
plane_2 = Plane(xy_plane_2)
isovist = IsoVist(Plane=plane_2, Count=Slider(248, range=0..1000), Radius=Slider(242, range=0..1000), Obstacles=polygon.Polygon)  # -> Points, Distance, Index
line = Line(StartPoint=origin_2, EndPoint=isovist.Points)

# ----
# - create a custom plate
number_slider_7 = Slider(2, range=0..3)  # disabled
number_slider_8 = Slider(100, range=0..100)  # disabled
range_3 = Range(Domain=number_slider_7, Steps=number_slider_8)  # disabled
circle = Circle(Plane=PlaneXY(0, 0, 0), Radius=number_slider_7)  # disabled
graph_mapper = GraphMapper(
    range_3,
    x0=0,
    x1=1,
    y0=0,
    y1=1,
    container_name="Bezier",
    cpx=[0, 0.2423520237, 0.2895503342, 1],
    cpy=[0, 0.5722799897, 0.7558665276, 1])  # disabled
graph_mapper_2 = GraphMapper(range_3, x0=0, x1=1, y0=0, y1=1, container_name="Sine", Equation_px=[0, 0.32217893], Equation_py=[0, 0.8814396262])  # disabled
addition = Addition(A=number_slider_7, B=range_3)  # disabled
construct_point_2 = ConstructPoint(XCoordinate=addition, YCoordinate=graph_mapper_2, ZCoordinate=graph_mapper)  # disabled
panel = Panel("2.00")  # disabled
unit_z = UnitZ(Factor=1)  # disabled
range_4 = Range(Domain=panel, Steps=10)  # disabled
interpolate = Interpolate(Vertices=construct_point_2, Degree=3, Periodic=False, KnotStyle=1)  # -> Curve, Length, Domain; disabled
line_sdl = LineSDL(Start=unit_z, Direction=unit_z, Length=1)  # disabled
pi_6 = Pi(Factor=range_4)  # disabled
number_slider_9 = Slider(6, range=0..100)  # disabled
length = Length(Curve=interpolate.Curve)  # disabled
rotate_axis = RotateAxis(Geometry=interpolate.Curve, Angle=pi_6, Axis=line_sdl)  # -> Geometry, Transform; disabled
number_slider_10 = Slider(0.24, range=0..1)  # disabled
construct_point_3 = ConstructPoint(XCoordinate=0, YCoordinate=0, ZCoordinate=number_slider_9)  # disabled
panel_2 = Panel("-1")  # disabled
cull_index_2 = CullIndex(List=rotate_axis.Geometry, Indices=panel_2, Wrap=True)  # disabled
evaluate_curve = EvaluateCurve(Curve=reparameterize(cull_index_2), Parameter=number_slider_10)  # -> Point, Tangent, Angle; disabled
curve_closest_point = CurveClosestPoint(Point=construct_point_3, Curve=cull_index_2)  # -> Point, Parameter, Distance; disabled
revolution = Revolution(Curve=interpolate.Curve, Axis=line_sdl, Domain=Domain(0, 6.283185307))  # disabled
boundary_surfaces = BoundarySurfaces(Edges=circle)  # disabled
rail_revolution = RailRevolution(Curve=interpolate.Curve, Rail=circle, Axis=line_sdl, Scale=False)  # disabled
loft = Loft(
    Curves=flatten(cull_index_2),
    Options={Adjust=False, Closed=True, LoftEnds=0, LoftSimp=0, LoftType=0, Rebuild=10, Refit=0.01})  # disabled
distance = Distance(PointA=curve_closest_point.Point, PointB=evaluate_curve.Point)  # disabled
sphere_2 = Sphere(Base=curve_closest_point.Point, Radius=distance)  # -> flatten(Sphere); disabled
split_brep_multiple = SplitBrepMultiple(Brep=loft, Cutters=sphere_2)  # disabled
list_item = ListItem(List=split_brep_multiple, Index=0, Wrap=True)  # disabled
geometry = Geometry(list_item)  # disabled
merge = Merge(Data1=boundary_surfaces, Data2=geometry)  # disabled

# ----
# 007_Curve
# Utility
# Spline
# Analysis
# Primitive
# Division
evaluate_length = EvaluateLength(Normalized=True)  # -> Point, Tangent, Parameter; disabled
evaluate_curve_2 = EvaluateCurve()  # -> Point, Tangent, Angle; disabled
horizontal_frame = HorizontalFrame()  # disabled
perp_frame = PerpFrame()  # disabled
curve_closest_point_2 = CurveClosestPoint()  # -> Point, Parameter, Distance; disabled
curve_domain = CurveDomain()  # -> Curve, Domain; disabled
# MGSM
# Grasshopper for Rhino3D
# http://grasshopperdocs.com/
# https://www.food4rhino.com/en
curve_middle = CurveMiddle()  # disabled
# EXERCISES_CURVES
length_2 = Length()  # disabled
point_on_curve = PointOnCurve(parameter=0.5)  # disabled
end_points = EndPoints()  # -> Start, End; disabled
derivatives = Derivatives()  # -> Point, FirstDerivative; disabled
point_in_curves = PointInCurves()  # -> Relationship, Index, Point; disabled
point_in_curve = PointInCurve()  # -> Relationship, Point; disabled
polygon_center = PolygonCenter()  # -> CenterV, CenterE, CenterA; disabled
planar = Planar()  # -> Planar, Plane, Deviation; disabled
control_points = ControlPoints()  # -> Points, Weights, Knots; disabled
extremes = Extremes(Plane=PlaneXY(0, 0, 0))  # -> Highest, Lowest; disabled
divide_distance = DivideDistance()  # -> Points, Tangents, Parameters; disabled
divide_length = DivideLength()  # -> Points, Tangents, Parameters; disabled
divide_curve = DivideCurve(Count=10, Kinks=False)  # -> Points, Tangents, Parameters; disabled
curve_frames = CurveFrames(Count=10)  # -> Frames, Parameters; disabled
horizontal_frames = HorizontalFrames(Count=10)  # -> Frames, Parameters; disabled
perp_frames = PerpFrames(Count=10, Align=True)  # -> Frames, Parameters; disabled
polygon_2 = Polygon(Plane=PlaneXY(0, 0, 0), Radius=3, Segments=6, FilletRadius=0)  # -> Polygon, Length; disabled
rectangle = Rectangle(Plane=PlaneXY(0, 0, 0), XSize=Domain(-1, 1), YSize=Domain(-2, 2), Radius=0)  # -> Rectangle, Length; disabled
ellipse = Ellipse(Plane=PlaneXY(0, 0, 0), Radius1=1, Radius2=1)  # -> Ellipse, Focus1, Focus2; disabled
line_2 = Line()  # disabled
arc_3pt = Arc3Pt()  # -> Arc, Plane, Radius; disabled
arc = Arc(Plane=PlaneXY(0, 0, 0), Radius=1, Angle=Domain(0, 3.141592654))  # -> Arc, Length; disabled
line_sdl_2 = LineSDL(Direction=Vector(0, 0, 1), Length=1)  # disabled
circle_cnr = CircleCNR(Normal=Vector(0, 0, 1), Radius=1)  # disabled
circle_2 = Circle(Plane=PlaneXY(0, 0, 0), Radius=1)  # disabled
tangent_lines_ex = TangentLinesEx()  # -> Tangent1, Tangent2; disabled
# 001_Introduction
# Ribbon Vanilla Grasshopper
# 
# Params
# Maths
# Sets - data trees
# Vectors
# Curves
# Surfaces
# IntersectionTransformations
# Display
tangent_lines = TangentLines()  # -> Tangent1, Tangent2; disabled
iso_curve = IsoCurve()  # -> UIsocurve, VIsocurve; disabled
interpolate_2 = Interpolate(Degree=3, Periodic=False, KnotStyle=1)  # -> Curve, Length, Domain; disabled
nurbs_curve = NurbsCurve(Degree=3, Periodic=False)  # -> Curve, Length, Domain; disabled
polyline = PolyLine(Closed=False)  # disabled
tween_curve = TweenCurve(Factor=0.5, BlendType=0)  # disabled
# 002_ribbon_vanilla_grasshopper
# Grasshopper Canvas for Rhino3D:
# 
# Ribbon:
# 
# File
# - new/open
# - save document/saveas
# - export image
# - document properties
# - user objects/ clusters
# - special folders (components/user objects)
# - preferences
curve_on_surface = CurveOnSurface(Closed=False)  # -> Curve, Length, Domain; disabled
catenary = Catenary(Gravity=Vector(0, 0, -1))  # disabled
blend_curve = BlendCurve(BulgeA=1, BulgeB=1, Continuity=2)  # disabled
explode = Explode(Recursive=True)  # -> Segments, Vertices; disabled
join_curves = JoinCurves(Preserve=False)  # disabled
project = Project(Direction=Vector(0, 0, 1))  # disabled
offset_curve = OffsetCurve(Distance=1, Corners=1)  # disabled
flip_curve = FlipCurve()  # -> Curve, Flag; disabled
rebuild_curve = RebuildCurve(Count=10, Tangents=False)  # disabled
pull_curve = PullCurve()  # disabled
fillet = Fillet()  # disabled
# Display
# 
# - icons, wires, names
# - (consider Bifocals plugin)
# - selected only preview
# - plane size
# - mesh edges
# - gumball
# - canvas widgets
# (Markov, profiler, message balloons)
# Edit
# 
# - cut/copy/paste/delete
# - arrange groups
# - group/ungroup
# - cluster
# - find
# - create component popup
# Solution
# 
# - disable solver
# - scroll button/spacebar
# (cluster/group/preview/enable/solver/
# bake/zoom/find/preferences)
# Help
# 
# - tutorials
# - online forums
# - node references
# View
# 
# - obscure components
# - zoom options on canvas
extend_curve = ExtendCurve(Type=0)  # disabled
seam = Seam()  # disabled

# ----
# - the curve analysis nodes are very interesting
# - consider using the derivatives of a curve
# to explore new variations of geometries
polygon_3 = Polygon(Plane=PlaneXY(0, 0, 0), Radius=3, Segments=6, FilletRadius=0)  # -> Polygon, Length; disabled
populate_2d = Populate2D(Region={Plane=PlaneXY(0, 0, 0), Size=Domain2(u=0..20, v=0..10)}, Count=100, Seed=1)  # disabled
point_in_curves_2 = PointInCurves(Point=populate_2d, Curves=polygon_3.Polygon)  # -> Relationship, Index, Point; disabled
polygon_center_2 = PolygonCenter(Polyline=polygon_3.Polygon)  # -> CenterV, CenterE, CenterA; disabled
planar_2 = Planar(Curve=polygon_3.Polygon)  # -> Planar, Plane, Deviation; disabled
number_slider_11 = Slider(3, range=0..10)  # disabled
cull_pattern = CullPattern(List=populate_2d, CullPattern=point_in_curves_2.Relationship)  # disabled
panel_3 = Panel("6")  # disabled
range_5 = Range(Domain=panel_3, Steps=number_slider_11)  # disabled
unit_z_2 = UnitZ(Factor=range_5)  # disabled
move = Move(Geometry=cull_pattern, Motion=unit_z_2)  # -> Geometry, Transform; disabled
number_slider_12 = Slider(4, range=0..10)  # disabled
sort_points = SortPoints(Points=move.Geometry)  # -> Points, Indices; disabled
unit_x = UnitX(Factor=number_slider_12)  # disabled
nurbs_curve_2 = NurbsCurve(Vertices=move.Geometry, Degree=3, Periodic=False)  # -> Curve, Length, Domain; disabled
number_slider_13 = Slider(1, range=0..1)  # disabled
move_2 = Move(Geometry=nurbs_curve_2.Curve, Motion=unit_x)  # -> Geometry, Transform; disabled
extremes_2 = Extremes(Curve=nurbs_curve_2.Curve, Plane=planar_2.Plane)  # -> Highest, Lowest; disabled
derivatives_2 = Derivatives(Curve=reparameterize(move_2.Geometry), Parameter=number_slider_13)  # -> Point, FirstDerivative, SecondDerivative; disabled
control_points_2 = ControlPoints(Curve=move_2.Geometry)  # -> Points, Weights, Knots; disabled
geometry_2 = Geometry(derivatives_2.FirstDerivative)  # disabled
geometry_3 = Geometry(derivatives_2.SecondDerivative)  # disabled
line_3 = Line(StartPoint=extremes_2.Lowest, EndPoint=geometry_2)  # disabled
line_4 = Line(StartPoint=extremes_2.Highest, EndPoint=geometry_3)  # disabled
line_5 = Line(StartPoint=extremes_2.Highest, EndPoint=geometry_3)  # disabled
line_6 = Line(StartPoint=extremes_2.Highest, EndPoint=geometry_2)  # disabled
revolution_2 = Revolution(Curve=move_2.Geometry, Axis=line_4, Domain=Domain(0, 6.283185307))  # disabled
revolution_3 = Revolution(Curve=move_2.Geometry, Axis=line_5, Domain=Domain(0, 6.283185307))  # disabled
revolution_4 = Revolution(Curve=move_2.Geometry, Axis=line_6, Domain=Domain(0, 6.283185307))  # disabled
revolution_5 = Revolution(Curve=move_2.Geometry, Axis=line_3, Domain=Domain(0, 6.283185307))  # disabled

# ----
# 010_Intersect
# Physical
# Region
# Mathematical
# Shape
contour_2 = Contour(Point=Point(0, 0, 0), Direction=Vector(0, 0, 1))  # disabled
# EXERCISES_INTERSECT
isovist_2 = IsoVist(Count=10, Radius=100)  # -> Points, Distance, Index; disabled
curve_plane_2 = CurvePlane()  # -> Points, ParamsC, ParamsP; disabled
line_line_2 = LineLine()  # -> ParamA, ParamB, PointA, PointB; disabled
mesh_ray_2 = MeshRay()  # -> Point, Hit; disabled
plane_region_2 = PlaneRegion(Plane=PlaneXY(0, 0, 0))  # disabled
brep_plane_2 = BrepPlane(Plane=PlaneXY(0, 0, 0))  # -> Curves, Points; disabled
mesh_plane_2 = MeshPlane()  # disabled
plane_plane_2 = PlanePlane()  # disabled
brep_line_2 = BrepLine(LimitToFirst=False)  # -> Curves, Points; disabled
surface_line_2 = SurfaceLine(LimitToFirst=False)  # -> Curves, Points, UVPoints, Normal; disabled
isovist_ray_2 = IsoVistRay(Radius=100)  # -> Point, Distance, Index; disabled
plane_plane_plane_2 = PlanePlanePlane()  # -> Point, LineAB, LineAC, LineBC; disabled
mesh_mesh = MeshMesh()  # disabled
surface_split = SurfaceSplit()  # disabled
curve_curve = CurveCurve()  # -> Points, ParamsA, ParamsB; disabled
brep_brep = BrepBrep()  # -> Curves, Points; disabled
brep_curve = BrepCurve()  # -> Curves, Points; disabled
mesh_curve = MeshCurve()  # -> Points, Faces; disabled
multiple_curves = MultipleCurves()  # -> Points, IndexA, IndexB, ParamA, ParamB; disabled
surface_curve = SurfaceCurve()  # -> Curves, Points, UVPoints, Normals, Parameters, Tangents; disabled
curve_self = CurveSelf()  # -> Points, Params; disabled
trim_with_region = TrimWithRegion()  # -> Inside, Outside; disabled
trim_with_brep = TrimWithBrep()  # -> Inside, Outside; disabled
split_with_brep = SplitWithBrep()  # -> Curve, Points; disabled
trim_with_regions = TrimWithRegions()  # -> Inside, Outside; disabled
split_with_breps = SplitWithBreps()  # -> Curve, Points; disabled
trim_with_breps = TrimWithBreps()  # -> Inside, Outside; disabled
boundary_volume = BoundaryVolume()  # disabled
mesh_difference = MeshDifference()  # disabled
mesh_intersection = MeshIntersection()  # disabled
region_difference = RegionDifference()  # disabled
region_intersection = RegionIntersection()  # disabled
mesh_split = MeshSplit()  # disabled
solid_difference = SolidDifference()  # disabled
solid_intersection = SolidIntersection()  # disabled
# 031_intersect_
mesh_union = MeshUnion()  # disabled
trim_solid = TrimSolid()  # disabled
region_union = RegionUnion()  # disabled
split_brep = SplitBrep()  # disabled
solid_union = SolidUnion()  # disabled
split_brep_multiple_2 = SplitBrepMultiple()  # disabled

# ----
# - I have seen this used once in generative design series:
# great video series (5 videos)
# Intermediate to advanced levels
occlusion = Occlusion()  # -> Hits, Occlusion

# ----
# 018_curve_division
# - create curve(s) in grasshopper
# - use some of your pervious learned skills
# to manipulate and create new geometries
number_slider_14 = Slider(2, range=0..10)  # disabled
number_slider_15 = Slider(62, range=0..100)  # disabled
range_6 = Range(Domain=number_slider_14, Steps=number_slider_15)  # disabled
graph_mapper_3 = GraphMapper(
    range_6,
    x0=0,
    x1=1,
    y0=0,
    y1=1,
    Ox=0.524131,
    Oy=0.4776169062,
    Px=0.838164866,
    Py=0.4178696871,
    container_name="Parabola")  # disabled
graph_mapper_4 = GraphMapper(
    range_6,
    x0=0,
    x1=1,
    y0=0,
    y1=1,
    container_name="Bezier",
    cpx=[0, 0.09178803116, 0.9158281088, 1],
    cpy=[0, 0.6787392497, 0, 0.5437967181])  # disabled
addition_2 = Addition(A=number_slider_14, B=graph_mapper_3)  # disabled
number_slider_16 = Slider(4, range=0..10)  # disabled
construct_point_4 = ConstructPoint(XCoordinate=addition_2, YCoordinate=graph_mapper_4, ZCoordinate=range_6)  # disabled
number_slider_17 = Slider(3, range=0..10)  # disabled
interpolate_3 = Interpolate(Vertices=construct_point_4, Degree=3, Periodic=False, KnotStyle=1)  # -> Curve, Length, Domain; disabled
domain = Domain(interpolate_3.Domain)  # disabled
divide_domain = DivideDomain(Domain=domain, Count=number_slider_17)  # -> flatten(Segments); disabled
division = Division(A=interpolate_3.Length, B=number_slider_16)  # disabled
construct_point_5 = ConstructPoint(XCoordinate=0, YCoordinate=0, ZCoordinate=0)  # disabled
end_points_2 = EndPoints(Curve=interpolate_3.Curve)  # -> Start, End; disabled
panel_4 = Panel(divide_domain)  # disabled
distance_2 = Distance(PointA=construct_point_5, PointB=end_points_2.Start)  # disabled
divide_distance_2 = DivideDistance(Curve=interpolate_3.Curve, Distance=division)  # -> Points, Tangents, Parameters; disabled
divide_length_2 = DivideLength(Curve=interpolate_3.Curve, Length=division)  # -> Points, Tangents, Parameters; disabled
shatter = Shatter(Curve=interpolate_3.Curve, Parameters=divide_domain)  # disabled
divide_curve_2 = DivideCurve(Curve=interpolate_3.Curve, Count=10, Kinks=False)  # -> Points, Tangents, Parameters; disabled
circle_3 = Circle(Plane=PlaneXY(0, 0, 0), Radius=distance_2)  # disabled
list_item_2 = ListItem(List=shatter, Index=0, Wrap=True)  # -> Item, Item1; disabled
unit_z_3 = UnitZ(Factor=1)  # disabled
curve_2 = Curve(list_item_2.Item)  # disabled
curve_3 = Curve(list_item_2.Item1)  # disabled
line_sdl_3 = LineSDL(Start=unit_z_3, Direction=unit_z_3, Length=1)  # disabled
revolution_6 = Revolution(Curve=curve_2, Axis=line_sdl_3, Domain=Domain(0, 6.283185307))  # disabled
revolution_7 = Revolution(Curve=curve_3, Axis=line_sdl_3, Domain=Domain(0, 6.283185307))  # disabled
surface = Surface(circle_3)  # disabled
merge_2 = Merge(Data1=revolution_7, Data2=revolution_6, Data3=surface)  # disabled

# ----
# - curve frames are great for orienting geometry and robotic tool path control
number_slider_18 = Slider(6, range=0..10)  # disabled
number_slider_19 = Slider(3, range=0..10)  # disabled
range_7 = Range(Domain=number_slider_18, Steps=number_slider_19)  # disabled
expression = Expression(Variable_x=range_7, Expression="cos(x^2)")  # disabled
expression_2 = Expression(Variable_x=range_7, Expression="sin(x^2)")  # disabled
construct_point_6 = ConstructPoint(XCoordinate=expression_2, YCoordinate=expression, ZCoordinate=range_7)  # disabled
number_slider_20 = Slider(3, range=0..10)  # disabled
interpolate_4 = Interpolate(Vertices=construct_point_6, Degree=3, Periodic=False, KnotStyle=1)  # -> Curve, Length, Domain; disabled
boolean_toggle = BooleanToggle(True)  # disabled
point_on_curve_2 = PointOnCurve(interpolate_4.Curve, parameter=0.746)  # disabled
perp_frames_2 = PerpFrames(Curve=interpolate_4.Curve, Count=number_slider_20, Align=boolean_toggle)  # -> Frames, Parameters; disabled
curve_frames_2 = CurveFrames(Curve=interpolate_4.Curve, Count=number_slider_20)  # -> Frames, Parameters; disabled
horizontal_frames_2 = HorizontalFrames(Curve=interpolate_4.Curve, Count=number_slider_20)  # -> Frames, Parameters; disabled
boolean_toggle_2 = BooleanToggle(True)  # disabled
number_slider_21 = Slider(0.57, range=0..1)  # disabled
number_slider_22 = Slider(0.97, range=0..1)  # disabled
number_slider_23 = Slider(0.68, range=0..1)  # disabled
orient = Orient(Geometry=interpolate_4.Curve, Source=point_on_curve_2, Target=horizontal_frames_2.Frames)  # -> Geometry, Transform; disabled
orient_2 = Orient(Geometry=interpolate_4.Curve, Source=point_on_curve_2, Target=curve_frames_2.Frames)  # -> Geometry, Transform; disabled
orient_3 = Orient(Geometry=interpolate_4.Curve, Source=point_on_curve_2, Target=perp_frames_2.Frames)  # -> Geometry, Transform; disabled
multipipe_2 = MultiPipe(
    Curves=orient_2.Geometry,
    NodeSize=0.5,
    EndOffset=1,
    StrutSize=number_slider_23,
    Segment=0,
    KinkAngle=0.6,
    CubeFit=0,
    Caps=boolean_toggle_2)  # disabled
multipipe_3 = MultiPipe(
    Curves=orient_3.Geometry,
    NodeSize=0.5,
    EndOffset=1,
    StrutSize=number_slider_21,
    Segment=0,
    KinkAngle=0.6,
    CubeFit=0,
    Caps=boolean_toggle_2)  # disabled
multipipe_4 = MultiPipe(
    Curves=orient.Geometry,
    NodeSize=0.5,
    EndOffset=1,
    StrutSize=number_slider_22,
    Segment=0,
    KinkAngle=0.6,
    CubeFit=0,
    Caps=boolean_toggle_2)  # disabled

mesh_mesh_2 = MeshMesh()
surface_split_2 = SurfaceSplit()
curve_curve_2 = CurveCurve()  # -> Points, ParamsA, ParamsB
brep_brep_2 = BrepBrep()  # -> Curves, Points
brep_curve_2 = BrepCurve()  # -> Curves, Points
mesh_curve_2 = MeshCurve()  # -> Points, Faces
multiple_curves_2 = MultipleCurves()  # -> Points, IndexA, IndexB, ParamA, ParamB
surface_curve_2 = SurfaceCurve()  # -> Curves, Points, UVPoints, Normals, Parameters, Tangents
curve_self_2 = CurveSelf()  # -> Points, Params

# ----
# 019_curve_primitive
# - create curve(s) in grasshopper
# - use some of your pervious learned skills
# to manipulate and create new geometries
# - consider creating other new geometries with
# the other primitives in curves
number_slider_24 = Slider(12, range=0..100)  # disabled
unit_x_2 = UnitX(Factor=1)  # disabled
unit_y = UnitY(Factor=1)  # disabled
unit_z_4 = UnitZ(Factor=1)  # disabled
construct_point_7 = ConstructPoint(XCoordinate=0, YCoordinate=0, ZCoordinate=0)  # disabled
line_sdl_4 = LineSDL(Start=construct_point_7, Direction=[unit_y, unit_x_2, unit_z_4], Length=number_slider_24)  # disabled
construct_point_8 = ConstructPoint(XCoordinate=unit_x_2, YCoordinate=unit_y, ZCoordinate=unit_z_4)  # disabled
number_slider_25 = Slider(2, range=0..2)  # disabled
line_pt = LinePt(Line=line_sdl_4, Point=construct_point_8)  # disabled
line_7 = Line(StartPoint=construct_point_7, EndPoint=construct_point_8)  # disabled
pi_7 = Pi(Factor=number_slider_25)  # disabled
number_slider_26 = Slider(10, range=0..10)  # disabled
circle_4 = Circle(Plane=line_pt, Radius=number_slider_24)  # disabled
deconstruct_plane = DeconstructPlane(Plane=line_pt)  # -> Origin, XAxis, YAxis, ZAxis; disabled
amplitude = Amplitude(Vector=deconstruct_plane.XAxis, Amplitude=number_slider_26)  # disabled
number_slider_27 = Slider(100, range=0..100)  # disabled
list_item_3 = ListItem(List=line_pt, Index=0, Wrap=True)  # -> Item, Item1, Item2; disabled
list_item_4 = ListItem(List=line_pt, Index=0, Wrap=True)  # -> Item, Item1, Item2; disabled
list_item_5 = ListItem(List=line_pt, Index=0, Wrap=True)  # -> Item, Item1, Item2; disabled
list_item_6 = ListItem(List=circle_4, Index=0, Wrap=True)  # -> Item, Item1, Item2; disabled
rotate_plane = RotatePlane(Plane=list_item_3.Item, Angle=pi_7)  # disabled
curve_middle_2 = CurveMiddle(Curve=circle_4)  # disabled
rotate_plane_2 = RotatePlane(Plane=list_item_4.Item2, Angle=pi_7)  # disabled
rotate_plane_3 = RotatePlane(Plane=list_item_5.Item1, Angle=pi_7)  # disabled
negative = Negative(Value=amplitude)  # disabled
deconstruct_plane_2 = DeconstructPlane(Plane=rotate_plane_3)  # -> Origin, XAxis, YAxis, ZAxis; disabled
deconstruct_plane_3 = DeconstructPlane(Plane=rotate_plane_2)  # -> Origin, XAxis, YAxis, ZAxis; disabled
deconstruct_plane_4 = DeconstructPlane(Plane=rotate_plane)  # -> Origin, XAxis, YAxis, ZAxis; disabled
move_3 = Move(Geometry=curve_middle_2, Motion=negative)  # -> Geometry, Transform; disabled
amplitude_2 = Amplitude(Vector=deconstruct_plane_4.XAxis, Amplitude=number_slider_27)  # disabled
amplitude_3 = Amplitude(Vector=deconstruct_plane_2.XAxis, Amplitude=number_slider_27)  # disabled
tangent_lines_2 = TangentLines(Point=move_3.Geometry, Circle=circle_4)  # -> Tangent1, Tangent2; disabled
amplitude_4 = Amplitude(Vector=deconstruct_plane_3.XAxis, Amplitude=number_slider_27)  # disabled
vector_display = VectorDisplay(
    Anchor=deconstruct_plane_4.Origin,
    Vector=[deconstruct_plane_4.YAxis, deconstruct_plane_4.XAxis, deconstruct_plane_4.ZAxis])  # disabled
move_4 = Move(Geometry=list_item_6.Item, Motion=amplitude_2)  # -> Geometry, Transform; disabled
move_5 = Move(Geometry=list_item_6.Item1, Motion=amplitude_3)  # -> Geometry, Transform; disabled
move_6 = Move(Geometry=list_item_6.Item2, Motion=amplitude_4)  # -> Geometry, Transform; disabled
tangent_lines_ex_2 = TangentLinesEx(CircleA=list_item_6.Item, CircleB=move_4.Geometry)  # -> Tangent1, Tangent2; disabled
tangent_lines_ex_3 = TangentLinesEx(CircleA=list_item_6.Item1, CircleB=move_5.Geometry)  # -> Tangent1, Tangent2; disabled
tangent_lines_ex_4 = TangentLinesEx(CircleA=list_item_6.Item2, CircleB=move_6.Geometry)  # -> Tangent1, Tangent2; disabled
number_slider_28 = Slider(2.6, range=0..10)  # disabled
merge_3 = Merge(
    Data1=circle_4,
    Data2=tangent_lines_ex_2.Tangent1,
    Data3=tangent_lines_ex_2.Tangent2,
    Data4=move_4.Geometry,
    Data5=tangent_lines_ex_3.Tangent1,
    Data6=tangent_lines_ex_3.Tangent2,
    Data7=move_5.Geometry,
    Data8=tangent_lines_ex_2.Tangent2,
    Data9=tangent_lines_ex_4.Tangent1,
    Data10=tangent_lines_ex_4.Tangent2,
    Data11=move_6.Geometry)  # disabled
multipipe_5 = MultiPipe(Curves=merge_3, NodeSize=number_slider_28, EndOffset=1, StrutSize=1, Segment=0, KinkAngle=0.6, CubeFit=0, Caps=0)  # disabled

quad_sphere = QuadSphere(Base=PlaneXY(0, 0, 0), Radius=Slider(12, range=0..100))
md_slider = MDSlider(
    SliderMode=0,
    slider_value=Point(0.7588099038, 0.725054485, 0.5),
    x_domain=Domain(0, 1),
    y_domain=Domain(0, 1),
    z_domain=Domain(0, 1))
md_slider_2 = MDSlider(
    SliderMode=0,
    slider_value=Point(0.319955221, 0.7363072837, 0.5),
    x_domain=Domain(0, 1),
    y_domain=Domain(0, 1),
    z_domain=Domain(0, 1))
deconstruct_brep = DeconstructBrep(Brep=quad_sphere)  # -> Faces, Edges, Vertices
md_slider_3 = MDSlider(
    SliderMode=0,
    slider_value=Point(0.7925757431, 0.7981969322, 0.5),
    x_domain=Domain(0, 1),
    y_domain=Domain(0, 1),
    z_domain=Domain(0, 1))
curve_on_surface_2 = CurveOnSurface(Surface=deconstruct_brep.Faces, UVCoordinates=[md_slider_2, md_slider, md_slider_3], Closed=Toggle(True))  # -> Curve, Length, Domain
surface_split_3 = SurfaceSplit(Surface=deconstruct_brep.Faces, Curves=curve_on_surface_2.Curve)
dispatch = Dispatch(List=flatten(surface_split_3), DispatchPattern=[True, False])  # -> ListA, ListB
geometry_4 = Geometry(dispatch.ListB)
geometry_5 = Geometry(dispatch.ListA)

# ----
# 020_curve_spline
# - create spline(s) in grasshopper
# - use some of your pervious learned skills
# to manipulate and create new geometries
number_slider_29 = Slider(3, range=0..10)
quad_sphere_2 = QuadSphere(Base=PlaneXY(0, 0, 0), Radius=1)
deconstruct_brep_2 = DeconstructBrep(Brep=quad_sphere_2)  # -> Faces, Edges, Vertices
panel_5 = Panel("""4
5
6""")
number_slider_30 = Slider(4, range=0..10)
range_8 = Range(Domain=Domain(0, 1), Steps=number_slider_29)
cull_index_3 = CullIndex(List=deconstruct_brep_2.Faces, Indices=panel_5, Wrap=True)
construct_point_9 = ConstructPoint(XCoordinate=range_8, YCoordinate=range_8, ZCoordinate=0)  # -> graft(Point)
populate_geometry = PopulateGeometry(Geometry=cull_index_3, Count=number_slider_30, Seed=number_slider_30)
interpolate_5 = Interpolate(Vertices=populate_geometry, Degree=3, Periodic=False, KnotStyle=1)  # -> Curve, Length, Domain
iso_curve_2 = IsoCurve(Surface=reparameterize(cull_index_3), UVPoint=construct_point_9)  # -> UIsocurve, VIsocurve
polyline_2 = PolyLine(Vertices=populate_geometry, Closed=False)
nurbs_curve_3 = NurbsCurve(Vertices=populate_geometry, Degree=3, Periodic=False)  # -> Curve, Length, Domain
explode_tree_2 = ExplodeTree(Data=interpolate_5.Curve)  # -> _0000, _0001, _0002
curve_4 = Curve(iso_curve_2.VIsocurve)
curve_5 = Curve(iso_curve_2.UIsocurve)
end_points_3 = EndPoints(Curve=curve_4)  # -> Start, End
tween_curve_2 = TweenCurve(CurveA=explode_tree_2._0001, CurveB=explode_tree_2._0002, Factor=0.5, BlendType=0)
tween_curve_3 = TweenCurve(CurveA=explode_tree_2._0000, CurveB=explode_tree_2._0002, Factor=0.5, BlendType=0)
tween_curve_4 = TweenCurve(CurveA=explode_tree_2._0000, CurveB=explode_tree_2._0001, Factor=0.5, BlendType=0)
vector_xyz = VectorXYZ(XComponent=0, YComponent=0, ZComponent=[Slider(-1, range=-1..1), Slider(1, range=-1..1)])  # -> Vector, Length
blend_curve_2 = BlendCurve(CurveA=tween_curve_4, CurveB=tween_curve_3, BulgeA=1, BulgeB=1, Continuity=2)
blend_curve_3 = BlendCurve(CurveA=tween_curve_3, CurveB=tween_curve_2, BulgeA=1, BulgeB=1, Continuity=2)
blend_curve_4 = BlendCurve(CurveA=tween_curve_4, CurveB=tween_curve_2, BulgeA=1, BulgeB=1, Continuity=2)
catenary_2 = Catenary(PointA=end_points_3.Start, PointB=end_points_3.End, Length=Slider(3, range=0..10), Gravity=vector_xyz.Vector)
multipipe_6 = MultiPipe(
    Curves=catenary_2,
    NodeSize=Slider(0.09, range=0..1),
    EndOffset=1,
    StrutSize=1,
    Segment=0,
    KinkAngle=0.6,
    CubeFit=0,
    Caps=0)

# ----
# 011_Transformations
# Array
# Morph
# Euclidean
# Utility
# Affine
scale = Scale(Center=Point(0, 0, 0), Factor=0.5)  # -> Geometry, Transform; disabled
scale_nu = ScaleNU(Plane=PlaneXY(0, 0, 0), ScaleX=1, ScaleY=1, ScaleZ=1)  # -> Geometry, Transform; disabled
project_2 = Project(Plane=PlaneXY(0, 0, 0))  # -> Geometry, Transform; disabled
project_along = ProjectAlong(Plane=PlaneXY(0, 0, 0), Direction=Vector(0, 0, -1))  # -> Geometry, Transform; disabled
orient_direction = OrientDirection(PointA=Point(0, 0, 0), DirectionA=Vector(0, 0, 1), PointB=Point(0, 0, 0), DirectionB=Vector(0, 0, 1))  # -> Geometry, Transform; disabled
camera_obscura = CameraObscura(Point=Point(0, 0, 0), Factor=1)  # -> Geometry, Transform; disabled
box_mapping = BoxMapping()  # -> Geometry, Transform; disabled
rectangle_mapping = RectangleMapping()  # -> Geometry, Transform; disabled
triangle_mapping = TriangleMapping()  # -> Geometry, Transform; disabled
box_array = BoxArray(Cell={Plane=PlaneXY(0, 0, 0), X=Domain(0, 10), Y=Domain(0, 5), Z=Domain(0, 2)}, XCount=4, YCount=3, ZCount=2)  # -> Geometry, Transform; disabled
curve_array = CurveArray(Count=10)  # -> Geometry, Transform; disabled
linear_array = LinearArray(Direction=Vector(10, 0, 0), Count=10)  # -> Geometry, Transform; disabled
polar_array = PolarArray(Plane=PlaneXY(0, 0, 0), Count=10, Angle=6.283185307)  # -> Geometry, Transform; disabled
rectangular_array = RectangularArray(Cell={Plane=PlaneXY(0, 0, 0), Size=Domain2(u=0..10, v=0..5)}, XCount=6, YCount=3)  # -> Geometry, Transform; disabled
kaleidoscope = Kaleidoscope(Plane=PlaneXY(0, 0, 0), Segments=10)  # -> Geometry, Transform; disabled
mirror = Mirror(Plane=PlaneYZ(0, 0, 0))  # -> Geometry, Transform; disabled
move_7 = Move(Motion=Vector(0, 0, 10))  # -> Geometry, Transform; disabled
orient_4 = Orient(Source=PlaneXY(0, 0, 0), Target=PlaneXY(0, 0, 0))  # -> Geometry, Transform; disabled
move_to_plane = MoveToPlane(Plane=PlaneXY(0, 0, 0), Above=True, Below=True)  # -> Geometry, Transform; disabled
rotate = Rotate(Angle=1.570796327, Plane=PlaneXY(0, 0, 0))  # -> Geometry, Transform; disabled
rotate_3d_6 = Rotate3D(Angle=1.570796327, Center=Point(0, 0, 0), Axis=Vector(0, 0, 1))  # -> Geometry, Transform; disabled
rotate_axis_2 = RotateAxis(Angle=1.570796327, Axis=Line((0, 0, 0), (10, 0, 0)))  # -> Geometry, Transform; disabled
rotate_direction = RotateDirection(Center=Point(0, 0, 0), From=Vector(1, 0, 0), To=Vector(0, 1, 0))  # -> Geometry, Transform; disabled
flow = Flow(ReverseBase=False, ReverseTarget=False, Stretch=True, Rigid=False)  # disabled
splop = Splop(Plane=PlaneXY(0, 0, 0), Angle=0, Rigid=False)  # disabled
bend_deform = BendDeform()  # disabled
twisted_box = TwistedBox()  # disabled
surface_morph = SurfaceMorph()  # disabled
sporph = Sporph(Rigid=False)  # disabled
box_morph = BoxMorph()  # disabled
maelstrom = Maelstrom(Plane=PlaneXY(0, 0, 0), First=0.1, Second=10, Angle=1.570796327, Rigid=False)  # disabled
stretch = Stretch(Axis=Line((0, 0, 0), (10, 10, 0)), Length=20, Rigid=False)  # disabled
twist = Twist(Angle=1.570796327, Infinite=False, Rigid=False)  # disabled
transform_matrix = TransformMatrix(Digits=3)  # disabled
inverse_transform = InverseTransform()  # disabled
transform = Transform()  # disabled
merge_group = MergeGroup()  # disabled
group = Group()  # disabled
split_group = SplitGroup(Wrap=False)  # -> GroupA, GroupB; disabled
ungroup = Ungroup()  # disabled
compound = Compound()  # disabled
split = Split()  # disabled

# ----
# 021_curve_utility
# - curve utility manipulates curves in many ways
number_slider_31 = Slider(17, range=0..100)
polygon_4 = Polygon(Plane=PlaneXY(0, 0, 0), Radius=number_slider_31, Segments=6, FilletRadius=0)  # -> Polygon, Length
explode_2 = Explode(Curve=polygon_4.Polygon, Recursive=True)  # -> Segments, Vertices
quad_sphere_3 = QuadSphere(Base=PlaneXY(0, 0, 0), Radius=number_slider_31)
quad_sphere_4 = QuadSphere(Base=PlaneXY(0, 0, 0), Radius=number_slider_31)
unit_z_5 = UnitZ(Factor=1)
point = Point(explode_2.Vertices)
curve_6 = Curve(explode_2.Segments)
deconstruct_brep_3 = DeconstructBrep(Brep=quad_sphere_3)  # -> Faces, Edges, Vertices
fillet_2 = Fillet(Curve=polygon_4.Polygon, Radius=Slider(0.1, range=0.1..10))
param_viewer = ParamViewer(curve_6)
project_3 = Project(Curve=graft(fillet_2), Brep=quad_sphere_4, Direction=unit_z_5)
split_tree = SplitTree(Data=curve_6, Masks=flatten("{0;0}[(0,2,...)]"))  # -> Positive, Negative
number_slider_32 = Slider(9.23, range=0..10)
rebuild_curve_2 = RebuildCurve(Curve=project_3, Count=10, Tangents=False)
flip_curve_2 = FlipCurve(Curve=split_tree.Positive)  # -> Curve, Flag
seam_2 = Seam(Curve=reparameterize(rebuild_curve_2), Seam=Slider(1, range=0..1))  # -> flatten(Curve)
clean_tree = CleanTree(RemoveNulls=True, RemoveInvalid=True, RemoveEmpty=False, Tree=flip_curve_2.Curve)
point_on_curve_3 = PointOnCurve([flip_curve_2.Curve, split_tree.Negative], parameter=0.173)
unit_z_6 = UnitZ(Factor=number_slider_32)
loft_2 = Loft(Curves=seam_2, Options={Adjust=True, Closed=False, LoftEnds=0, LoftSimp=0, LoftType=0, Rebuild=10, Refit=0.01})
offset_curve_2 = OffsetCurve(Curve=clean_tree, Distance=number_slider_32, Corners=1)  # -> flatten(Curve)
pull_curve_2 = PullCurve(Curve=deconstruct_brep_3.Edges, Surface=loft_2)
move_8 = Move(Geometry=offset_curve_2, Motion=unit_z_6)  # -> Geometry, Transform
clean_tree_2 = CleanTree(RemoveNulls=True, RemoveInvalid=True, RemoveEmpty=False, Tree=pull_curve_2)
number_slider_33 = Slider(5, range=0..5)
join_curves_2 = JoinCurves(Curves=[split_tree.Negative, flip_curve_2.Curve], Preserve=False)
curve_middle_3 = CurveMiddle(Curve=clean_tree_2)
sphere_3 = Sphere(Base=curve_middle_3, Radius=Slider(6.24, range=0..10))
split_brep_multiple_3 = SplitBrepMultiple(Brep=loft_2, Cutters=sphere_3)
pipe = Pipe(Curve=join_curves_2, Radius=expr("x/3", number_slider_33), Caps=0)
sphere_4 = Sphere(Base=point_on_curve_3, Radius=number_slider_33)
loft_3 = Loft(
    Curves=[offset_curve_2, move_8.Geometry],
    Options={Adjust=True, Closed=True, LoftEnds=0, LoftSimp=0, LoftType=0, Rebuild=10, Refit=0.01})
list_item_7 = ListItem(List=split_brep_multiple_3, Index=0, Wrap=True)

# ----
# 008_Surface
# Freeform
# Primitive
# Analysis
# SubD
# Utilities
surface_closest_point = SurfaceClosestPoint()  # -> Point, UVPoint, Distance; disabled
area = Area()  # -> Area, Centroid; disabled
volume = Volume()  # -> Volume, Centroid; disabled
evaluate_surface = EvaluateSurface()  # -> Point, Normal, UDirection, VDirection, Frame; disabled
deconstruct_brep_4 = DeconstructBrep()  # -> Faces, Edges, Vertices; disabled
brep_closest_point = BrepClosestPoint()  # -> Point, Normal, Distance; disabled
point_in_brep = PointInBrep(Strict=False)  # disabled
brep_edges = BrepEdges()  # -> Naked, Interior, NonManifold; disabled
point_in_breps = PointInBreps(Strict=False)  # -> Inside, Index; disabled
surface_from_points = SurfaceFromPoints(Interpolate=False)  # disabled
extrude = Extrude()  # disabled
sweep2 = Sweep2(SameHeight=False)  # disabled
_4point_surface = _4PointSurface()  # disabled
pipe_variable = PipeVariable(Caps=0)  # disabled
revolution_8 = Revolution(Domain=Domain(0, 6.283185307))  # disabled
boundary_surfaces_2 = BoundarySurfaces()  # disabled
rail_revolution_2 = RailRevolution(Scale=False)  # disabled
sweep1 = Sweep1(Miter=1)  # disabled
loft_4 = Loft(Options={Adjust=False, Closed=False, LoftEnds=0, LoftSimp=0, LoftType=0, Rebuild=10, Refit=0.01})  # disabled
pipe_2 = Pipe(Radius=1, Caps=0)  # disabled
extrude_linear = ExtrudeLinear(OrientationP=PlaneXY(0, 0, 0))  # disabled
extrude_along = ExtrudeAlong()  # disabled
extrude_point = ExtrudePoint()  # disabled
patch = Patch(Spans=20, Flexibility=1, Trim=True)  # disabled
bounding_box = BoundingBox(Plane=PlaneXY(0, 0, 0))  # -> Box, Box_2; disabled
cylinder = Cylinder(Base=PlaneXY(0, 0, 0), Radius=0.5, Length=1)  # disabled
plane_surface = PlaneSurface(Plane=PlaneXY(0, 0, 0), XSize=Domain(-10, 10), YSize=Domain(-10, 10))  # disabled
quad_sphere_5 = QuadSphere(Base=PlaneXY(0, 0, 0), Radius=1)  # disabled
sphere_5 = Sphere(Base=PlaneXY(0, 0, 0), Radius=1)  # disabled
cone = Cone(Base=PlaneXY(0, 0, 0), Radius=0.5, Length=1)  # -> Cone, Tip; disabled
center_box = CenterBox(Base=PlaneXY(0, 0, 0), X=1, Y=1, Z=1)  # disabled
bounding_box_2 = BoundingBox(Plane=PlaneXY(0, 0, 0), UnionBox=True)  # -> Box, Box_2; disabled
plane_through_shape = PlaneThroughShape(Inflate=1, SectionLogic=False)  # disabled
multipipe_7 = MultiPipe(NodeSize=0.5, EndOffset=1, StrutSize=1, Segment=0, KinkAngle=0.6, CubeFit=0, Caps=0)  # disabled
subd_fuse = SubDFuse(BooleanOption=0, Smoothing=10)  # disabled
subd_from_mesh = SubDFromMesh(Creases=1, Corners=1, Interpolate=False)  # disabled
mesh_from_subd = MeshFromSubD(Density=2)  # disabled
subd_control_polygon = SubDControlPolygon()  # disabled
subd_edges = SubDEdges(NewFormatting=False)  # -> Line, Edge, Tag, Id; disabled
divide_surface = DivideSurface(UCount=10, VCount=10)  # -> Points, Normals, Parameters; disabled
offset_surface = OffsetSurface(Distance=0, Retrim=True)  # disabled
isotrim = Isotrim()  # disabled
flip = Flip()  # -> Surface, Result; disabled
fillet_edge = FilletEdge(Blend=0, Metric=0)  # disabled
brep_join = BrepJoin()  # -> Breps, Closed; disabled
cap_holes = CapHoles()  # disabled
surface_frames = SurfaceFrames(UCount=10, VCount=10)  # -> Frames, Parameters; disabled

# ----
# EXERCISES_SURFACE
# 022_surface_analysis
# - MVP debrep node
number_slider_34 = Slider(14, range=0..100)
quad_sphere_6 = QuadSphere(Base=PlaneXY(0, 0, 0), Radius=number_slider_34)
deconstruct_brep_5 = DeconstructBrep(Brep=quad_sphere_6)  # -> Faces, Edges, Vertices
surface_2 = Surface(reparameterize(deconstruct_brep_5.Faces))
point_2 = Point(deconstruct_brep_5.Vertices)
curve_7 = Curve(deconstruct_brep_5.Edges)
area_2 = Area(Geometry=surface_2)  # -> Area, Centroid
volume_2 = Volume(Geometry=quad_sphere_6)  # -> Volume, Centroid
list_length_2 = ListLength(List=surface_2)
point_3 = Point(area_2.Centroid)
point_4 = Point(volume_2.Centroid)
expression_3 = Expression(Variable_x=list_length_2, Expression="x-1")
construct_domain_2 = ConstructDomain(DomainStart=Slider(0.2, range=0..1), DomainEnd=Slider(0.8, range=0..1))
range_9 = Range(Domain=construct_domain_2, Steps=expression_3)
construct_point_10 = ConstructPoint(XCoordinate=graft(range_9), YCoordinate=Slider(0.469, range=0..1), ZCoordinate=0)
evaluate_surface_2 = EvaluateSurface(Surface=reparameterize(flatten(surface_2)), Point=construct_point_10)  # -> Point, Normal, UDirection, VDirection, Frame

sphere_6 = Sphere(Base=PlaneXY(0, 0, 0), Radius=Slider(10, range=0..100))
deconstruct_brep_6 = DeconstructBrep(Brep=quad_sphere_6)  # -> Faces, Edges, Vertices
populate_geometry_2 = PopulateGeometry(Geometry=quad_sphere_6, Count=Slider(4, range=0..10), Seed=Slider(89, range=0..100))
bounding_box_3 = BoundingBox(Content=sphere_6, Plane=PlaneXY(0, 0, 0), UnionBox=True)  # -> Box, Box_2
split_tree_2 = SplitTree(Data=deconstruct_brep_6.Faces, Masks=flatten("{0;*}[(1,3,...)]"))  # -> Positive, Negative
populate_3d = Populate3D(Region=bounding_box_3.Box, Count=Slider(100, range=0..100), Seed=Slider(187, range=0..1000))
surface_3 = Surface(split_tree_2.Positive)
surface_4 = Surface(split_tree_2.Negative)
brep_closest_point_2 = BrepClosestPoint(Point=populate_geometry_2, Brep=quad_sphere_6)  # -> Point, Normal, Distance
clean_tree_3 = CleanTree(RemoveNulls=True, RemoveInvalid=True, RemoveEmpty=False, Tree=surface_4)
clean_tree_4 = CleanTree(RemoveNulls=True, RemoveInvalid=True, RemoveEmpty=False, Tree=surface_3)
point_in_breps_2 = PointInBreps(Brep=sphere_6, Point=populate_3d, Strict=False)  # -> Inside, Index
surface_closest_point_2 = SurfaceClosestPoint(Point=populate_geometry_2, Surface=clean_tree_4)  # -> Point, UVPoint, Distance
cull_pattern_2 = CullPattern(List=populate_3d, CullPattern=point_in_breps_2.Inside)
surface_closest_point_3 = SurfaceClosestPoint(Point=populate_geometry_2, Surface=clean_tree_3)  # -> Point, UVPoint, Distance
cull_pattern_3 = CullPattern(List=populate_3d, CullPattern=point_in_breps_2.Index)
shortest_list = ShortestList(ListListA=cull_pattern_2, ListListB=cull_pattern_3, TrimMode=2)  # -> ListListA, ListListB
cull_duplicates = CullDuplicates(Points=brep_closest_point_2.Point, Tolerance=0.1, CullMode=3)  # -> Points, Indices, Valence
cull_duplicates_2 = CullDuplicates(Points=surface_closest_point_3.Point, Tolerance=0.1, CullMode=3)  # -> Points, Indices, Valence
cull_duplicates_3 = CullDuplicates(Points=surface_closest_point_2.Point, Tolerance=0.1, CullMode=3)  # -> Points, Indices, Valence
sort_points_2 = SortPoints(Points=shortest_list.ListListA)  # -> Points, Indices
sort_points_3 = SortPoints(Points=shortest_list.ListListB)  # -> Points, Indices
sort_points_4 = SortPoints(Points=cull_duplicates.Points)  # -> Points, Indices
sort_points_5 = SortPoints(Points=cull_duplicates_3.Points)  # -> Points, Indices
sort_points_6 = SortPoints(Points=cull_duplicates_2.Points)  # -> Points, Indices
line_8 = Line(StartPoint=sort_points_2.Points, EndPoint=sort_points_3.Points)
interpolate_6 = Interpolate(Vertices=sort_points_6.Points, Degree=3, Periodic=False, KnotStyle=1)  # -> Curve, Length, Domain
interpolate_7 = Interpolate(Vertices=sort_points_4.Points, Degree=3, Periodic=False, KnotStyle=1)  # -> Curve, Length, Domain
interpolate_8 = Interpolate(Vertices=sort_points_5.Points, Degree=3, Periodic=False, KnotStyle=1)  # -> Curve, Length, Domain
number_slider_35 = Slider(3, range=0..10)
loft_5 = Loft(
    Curves=[interpolate_8.Curve, interpolate_6.Curve],
    Options={Adjust=False, Closed=False, LoftEnds=0, LoftSimp=0, LoftType=0, Rebuild=10, Refit=0.01})
divide_domain² = DivideDomain²(Domain=loft_5, UCount=number_slider_35, VCount=number_slider_35)
md_slider_4 = MDSlider(
    SliderMode=0,
    slider_value=Point(0.5138266959, 0.5967466773, 0.5),
    x_domain=Domain(0, 1),
    y_domain=Domain(0, 1),
    z_domain=Domain(0, 1))
isotrim_2 = Isotrim(Surface=loft_5, Domain=divide_domain²)
evaluate_surface_3 = EvaluateSurface(Surface=reparameterize(isotrim_2), Point=md_slider_4)  # -> Point, Normal, UDirection, VDirection, Frame
plane_3 = Plane(evaluate_surface_3.Frame)

# ----
# - consider naked edges on breps and surfaces
brep_edges_2 = BrepEdges(Brep=surface_2)  # -> Naked, Interior, NonManifold
brep_edges_3 = BrepEdges(Brep=quad_sphere_6)  # -> Naked, Interior, NonManifold
curve_8 = Curve(brep_edges_2.Naked)
curve_9 = Curve(brep_edges_3.Naked)
curve_10 = Curve(brep_edges_3.Interior)

# ----
# 012_Display
# Preview
# Vector
# Dimensions
make2d = Make2D(TangentEdges=False, TangentSeams=False, AutoComputeMake2D=False)  # -> VisibleCurves, VisibleIndex, VisibleType, HiddenCurves, HiddenIndex, HiddenType; disabled
make2d_parallel_view = Make2DParallelView()  # disabled
make2d_perspective_view = Make2DPerspectiveView()  # disabled
make2d_rhino_view = Make2DRhinoView(Clip=True)  # disabled
text_tag_3d = TextTag3D(Size=1, Justification=7)  # disabled
gradient_hatch = GradientHatch(Colour1=RGB(255, 20, 147), Colour2=RGB(139, 0, 139))  # disabled
pattern_hatch = PatternHatch(Pattern=0, Scale=1, Angle=0)  # disabled
aligned_dimension = AlignedDimension(Plane=PlaneXY(0, 0, 0), Offset=1, Text="{0:0.00}", Size=1)  # disabled
angular_dimension = AngularDimension(Reflex=False, Text="{0:0.0}°", Size=1)  # disabled
arc_dimension = ArcDimension(Offset=2, Text="{0:0.0}°", Size=1)  # disabled
line_dimension = LineDimension(Text="{0:0.00}", Size=1)  # disabled
angular_dimensions_mesh = AngularDimensionsMesh(Text="{0:0.0}°", Size=1, LengthFactor=0.5)  # disabled
text_tag = TextTag()  # disabled
linear_dimension = LinearDimension(Text="{0:0.00}", Size=1)  # disabled
circular_dimension = CircularDimension(Text="{0:0.0}°", Size=1)  # disabled
create_material = CreateMaterial(Diffuse=RGB(255, 105, 180), Specular=RGB(255, 255, 255), Emission=RGB(0, 0, 0), Transparency=0, Shine=0)  # disabled
custom_preview = CustomPreview(Material={diffuse=RGB(221, 160, 221), emission=RGB(66, 48, 66), shine=0.5, specular=RGB(255, 255, 255), transparency=0})  # disabled
vector_display_2 = VectorDisplay()  # disabled
point_list = PointList()  # disabled
point_order = PointOrder()  # disabled
vector_display_ex = VectorDisplayEx(Colour=RGB(0, 0, 0), Width=2)  # disabled

multipipe_8 = MultiPipe(
    Curves=line_8,
    NodeSize=Slider(2.15, range=0..10),
    EndOffset=1,
    StrutSize=1,
    Segment=0,
    KinkAngle=0.6,
    CubeFit=0,
    Caps=Slider(1, range=0..2))

# ----
# 023_surface_freeform
# - Daniel Christev's wonderful surfaces
# guarentees a sq set of points
# on surface, no half holes
# - so much more interesting than the regular
# surface generating nodes
number_slider_36 = Slider(40, range=0..100)
number_slider_37 = Slider(100, range=0..100)
_4point_surface_2 = _4PointSurface()
range_10 = Range(Domain=number_slider_36, Steps=number_slider_37)
boundary_surfaces_3 = BoundarySurfaces()
sine = Sine(Value=range_10)
multiplication = Multiplication(A=sine, B=Slider(4, range=0..5))
loft_6 = Loft(Options={Adjust=False, Closed=False, LoftEnds=0, LoftSimp=0, LoftType=0, Rebuild=10, Refit=0.01})
construct_point_11 = ConstructPoint(XCoordinate=graft(range_10), YCoordinate=range_10, ZCoordinate=multiplication)
surface_from_points_2 = SurfaceFromPoints(Points=flatten(construct_point_11), UCount=expr("x+1", number_slider_37), Interpolate=False)
surface_5 = Surface(surface_from_points_2)
area_3 = Area(Geometry=surface_5)  # -> Area, Centroid
dimensions = Dimensions(Surface=surface_5)  # -> UDimension, VDimension
number_slider_38 = Slider(29, range=0..100)
extrude_2 = Extrude()
division_2 = Division(A=dimensions.UDimension, B=dimensions.VDimension)
scale_2 = Scale(Geometry=surface_5, Center=area_3.Centroid, Factor=Slider(3.478, range=0..5))  # -> Geometry, Transform
md_slider_5 = MDSlider(
    SliderMode=0,
    slider_value=Point(0.5964374077, 0.3989495998, 0.5),
    x_domain=Domain(0, 1),
    y_domain=Domain(0, 1),
    z_domain=Domain(0, 1))
multiplication_2 = Multiplication(A=division_2, B=number_slider_38)
pipe_3 = Pipe(Radius=1, Caps=0)
integer = Integer(multiplication_2)
divide_surface_2 = DivideSurface(Surface=surface_5, UCount=integer, VCount=number_slider_38)  # -> flatten(Points), Normals, Parameters
md_slider_6 = MDSlider(
    SliderMode=0,
    slider_value=Point(0.758053798, 0.3364762142, 0.5),
    x_domain=Domain(0, 1),
    y_domain=Domain(0, 1),
    z_domain=Domain(0, 1))
pipe_variable_2 = PipeVariable(Caps=0)
md_slider_7 = MDSlider(
    SliderMode=0,
    slider_value=Point(0.1441892298, 0.9533711875, 0.5),
    x_domain=Domain(0, 1),
    y_domain=Domain(0, 1),
    z_domain=Domain(0, 1))
evaluate_surface_4 = EvaluateSurface(Surface=reparameterize(scale_2.Geometry), Point=[md_slider_7, md_slider_5, md_slider_6])  # -> Point, Normal, UDirection, VDirection, Frame
distance_3 = Distance(PointA=graft(evaluate_surface_4.Point), PointB=divide_surface_2.Points)
expression_4 = Expression(w=flatten(Slider(0.243, range=0..2)), t=distance_3, Expression="sin(2*w^2*t)")
sweep1_2 = Sweep1(Miter=1)
flip_matrix_2 = FlipMatrix(Data=expression_4)
sweep2_2 = Sweep2(SameHeight=False)
ma = MassMultiplication(Input=flip_matrix_2)  # -> flatten(Result), PartialResults
multiplication_3 = Multiplication(A=Slider(7.333, range=0..10), B=ma.Result)
rail_revolution_3 = RailRevolution(Scale=False)
unit_z_7 = UnitZ(Factor=multiplication_3)
move_9 = Move(Geometry=divide_surface_2.Points, Motion=unit_z_7)  # -> Geometry, Transform
revolution_9 = Revolution(Domain=Domain(0, 6.283185307))
expression_5 = Expression(u=integer, Expression="u+1")
extrude_along_2 = ExtrudeAlong()
extrude_linear_2 = ExtrudeLinear(OrientationP=PlaneXY(0, 0, 0))
extrude_point_2 = ExtrudePoint()
surface_from_points_3 = SurfaceFromPoints(Points=move_9.Geometry, UCount=expression_5, Interpolate=False)
patch_2 = Patch(Spans=20, Flexibility=1, Trim=True)

# ----
# 024_surface_primitive
# - Daniel Christev's wonderful surfaces
center_box_2 = CenterBox(Base=PlaneXY(0, 0, 0), X=1, Y=1, Z=1)
cone_2 = Cone(Base=PlaneXY(0, 0, 0), Radius=0.5, Length=1)  # -> Cone, Tip
plane_surface_2 = PlaneSurface(Plane=PlaneXY(0, 0, 0), XSize=Slider(38, range=0..100), YSize=Slider(24, range=0..100))
cylinder_2 = Cylinder(Base=PlaneXY(0, 0, 0), Radius=0.5, Length=1)
bounding_box_4 = BoundingBox(Content=surface_from_points_3, Plane=PlaneXY(0, 0, 0))  # -> Box, Box_2
plane_through_shape_2 = PlaneThroughShape(Plane=plane_surface_2, Shape=surface_from_points_3, Inflate=1, SectionLogic=False)
bounding_box_5 = BoundingBox(Content=surface_from_points_3, Plane=PlaneXY(0, 0, 0), UnionBox=True)  # -> Box, Box_2
quad_sphere_7 = QuadSphere(Base=PlaneXY(0, 0, 0), Radius=1)
sphere_7 = Sphere(Base=PlaneXY(0, 0, 0), Radius=1)

# ----
# 025_surface_subD
# - new to Rhino7, very interesting substitution
# for pipe and variable pipe nodes
number_slider_39 = Slider(10, range=0..10)
extent_x = ExtentX(5)
square = Square(Plane=PlaneXY(0, 0, 0), Size=number_slider_39, ExtentX=extent_x, ExtentY=extent_x)  # -> simplify(Cells), Points
curve_11 = Curve(square.Cells)
split_tree_3 = SplitTree(Data=curve_11, Masks=flatten("{(1to3)}[(1to3)]"))  # -> Positive, Negative
clean_tree_5 = CleanTree(RemoveNulls=True, RemoveInvalid=True, RemoveEmpty=False, Tree=split_tree_3.Positive)
curve_12 = Curve(clean_tree_5)
split_tree_4 = SplitTree(Data=curve_12, Masks=flatten("{(2)}[(1)]"))  # -> Positive, Negative
range_11 = Range(Domain=Slider(24, range=0..100), Steps="2")
clean_tree_6 = CleanTree(RemoveNulls=True, RemoveInvalid=True, RemoveEmpty=False, Tree=split_tree_4.Positive)
unit_z_8 = UnitZ(Factor=range_11)  # -> graft(UnitVector)
curve_13 = Curve(clean_tree_6)
entwine = Entwine(Branch00=split_tree_3.Negative, Branch01=split_tree_4.Negative, Branch02=curve_13, FlattenInputs=True)
move_10 = Move(Geometry=entwine, Motion=unit_z_8)  # -> simplify(Geometry), Transform
brep_edges_4 = BrepEdges(Brep=move_10.Geometry)  # -> Naked, Interior, NonManifold
boundary_surfaces_4 = BoundarySurfaces(Edges=move_10.Geometry)
curve_14 = Curve(brep_edges_4.Naked)
curve_15 = Curve(curve_14)
multipipe_9 = MultiPipe(
    Curves=curve_15,
    NodeSize=Slider(2.08, range=0..10),
    EndOffset=Slider(1, range=0..1),
    StrutSize=Slider(1.52, range=0..10),
    Segment=0,
    KinkAngle=0.6,
    CubeFit=Slider(1, range=0..1),
    Caps=Slider(1, range=0..2))
mesh_from_subd_2 = MeshFromSubD(SubD=multipipe_9, Density=2)
subd_control_polygon_2 = SubDControlPolygon(SubD=multipipe_9)
subd_edges_2 = SubDEdges(SubD=multipipe_9, NewFormatting=False)  # -> Line, Edge, Tag, Id
area_4 = Area(Geometry=multipipe_9)  # -> Area, Centroid
subd_from_mesh_2 = SubDFromMesh(Mesh=mesh_from_subd_2, Creases=Slider(1, range=0..10), Corners=1, Interpolate=Toggle(False))
curve_16 = Curve(subd_edges_2.Edge)
curve_17 = Curve(subd_edges_2.Line)
text_tag_3d_2 = TextTag3D(Location=curve_17, Text=subd_edges_2.Id, Size=1, Justification=7)
scale_3 = Scale(Geometry=multipipe_9, Center=area_4.Centroid, Factor=0.5)  # -> Geometry, Transform
subd_fuse_2 = SubDFuse(SubDA=multipipe_9, SubDB=scale_3.Geometry, BooleanOption=Slider(3, range=0..3), Smoothing=10)

# ----
# 009_Mesh
# Tiangulation
# Primitive
# Analysis
# Utilities
mesh_area = MeshArea()  # -> Area, Centroid; disabled
mesh_edges = MeshEdges()  # -> NakedEdges, InteriorEdges, NonManifoldEdges; disabled
mesh_convertquads = MeshConvertQuads(ShortDiagonal=True)  # -> Mesh, Split; disabled
mesh_triangulate = MeshTriangulate(ShortDiagonal=True)  # disabled
mesh_eval = MeshEval()  # -> Point, Normal, Colour; disabled
mesh_closest_point = MeshClosestPoint()  # -> Point, Index, Parameter; disabled
face_normals = FaceNormals()  # -> Centers, Normals; disabled
mesh_nakededge = MeshNakedEdge()  # -> V, A, B; disabled
mesh_volume = MeshVolume()  # -> Volume, Centroid; disabled
face_boundaries = FaceBoundaries()  # disabled
mesh_explode = MeshExplode(Interpolate=False)  # disabled
deconstruct_mesh = DeconstructMesh()  # -> Vertices, Faces, Colours, Normals; disabled
deconstruct_face = DeconstructFace()  # -> CornerA, CornerB, CornerC, CornerD; disabled
mesh_inclusion = MeshInclusion(Strict=False)  # disabled
mesh_quad = MeshQuad(CornerA=0, CornerB=1, CornerC=2, CornerD=3)  # disabled
mesh_plane_3 = MeshPlane(Boundary={Plane=PlaneXY(0, 0, 0), Size=Domain2(u=-10..10, v=-10..10)}, WidthCount=10, HeightCount=10)  # -> Mesh, Area; disabled
mesh_sphere = MeshSphere(Base=PlaneXY(0, 0, 0), Radius=10, UCount=10, VCount=20)  # disabled
mesh_box = MeshBox(Base={Plane=PlaneXY(0, 0, 0), X=Domain(-10, 10), Y=Domain(-10, 10), Z=Domain(-10, 10)}, XCount=10, YCount=10, ZCount=10)  # disabled
construct_mesh = ConstructMesh(Vertices=[Point(0, 0, 0), Point(10, 0, 0), Point(10, 10, 0), Point(0, 10, 0)], Faces={A=0, B=1, C=2, D=3})  # disabled
mesh_sphere_ex = MeshSphereEx(Base=PlaneXY(0, 0, 0), Radius=10, Count=5)  # disabled
mesh_triangle = MeshTriangle(CornerA=0, CornerB=1, CornerC=2)  # disabled
mesh_colours = MeshColours(Colours=[RGB(127, 255, 0), RGB(0, 100, 0), RGB(34, 139, 34), RGB(124, 252, 0), RGB(154, 205, 50), RGB(173, 255, 47), RGB(50, 205, 50), RGB(152, 251, 152)])  # disabled
mesh_spray = MeshSpray(SprayMode=11)  # disabled
metaball = MetaBall(Plane=PlaneXY(0, 0, 0))  # disabled
voronoi = Voronoi(BruteForceOverride=False)  # disabled
delaunay_edges = DelaunayEdges(Plane=PlaneXY(0, 0, 0))  # -> Connectivity, Edges; disabled
delaunay_mesh = DelaunayMesh(Plane=PlaneXY(0, 0, 0))  # disabled
octree = OcTree(Square=False, Group=5)  # -> Boxes, Points; disabled
metaball_t = MetaBallT(Plane=PlaneXY(0, 0, 0), Threshold=0.5)  # disabled
voronoi_3d = Voronoi3D()  # -> Cells, Boundary; disabled
metaball_t_custom = MetaBallTCustom(Plane=PlaneXY(0, 0, 0), Threshold=0.5)  # disabled
convex_hull = ConvexHull(Plane=PlaneXY(0, 0, 0))  # -> Hull, HullZ, Indices; disabled
delete_faces = DeleteFaces()  # disabled
mesh_surface = MeshSurface(UCount=5, VCount=5, Overhang=True, Equalize=False)  # disabled
cull_faces = CullFaces()  # disabled
mesh_brep = MeshBrep(Settings={GridMaxCount=0, GridMinCount=16, JaggedSeams=False, MaxEdgeLength=0, MinEdgeLength=0.0001, MinTolerance=0, Refine=True, RefineAngle=0, RelativeTolerance=0.65, SimplePlanes=True, Tolerance=0})  # disabled
unweld_mesh = UnweldMesh(Angle=1.570796327)  # disabled
mesh_shadow = MeshShadow(Light=Vector(0, 0, -1), Plane=PlaneXY(0, 0, 0))  # disabled
mesh_join = MeshJoin()  # disabled
delete_vertices = DeleteVertices(Shrink=True)  # disabled
cull_vertices = CullVertices(Shrink=True)  # disabled
weld_mesh = WeldMesh(Angle=3.141592654)  # disabled
mesh_weldvertices = MeshWeldVertices(Tolerance=0.01)  # -> RuntimeMessage, Mesh; disabled
flip_mesh = FlipMesh(VertexNormals=True, FaceNormals=True, FaceOrientation=True)  # disabled
mesh_frompoints = MeshFromPoints()  # disabled
occlusion_2 = Occlusion()  # -> Hits, Occlusion; disabled
simple_mesh = SimpleMesh()  # disabled
mesh_unifynormals = MeshUnifyNormals()  # disabled
quadrangulate = Quadrangulate(Angle=0.03490658504, Ratio=0.875)  # -> Mesh, Count; disabled
triangulate = Triangulate()  # -> Mesh, Count; disabled
mesh_flip = MeshFlip()  # disabled

# ----
# EXERCISES_MESH
# 026_mesh_analysis
# - download mesh edit plugin for these scripts (Mesh credit: Daniel Christev)
number_slider_40 = Slider(40, range=0..100)
number_slider_41 = Slider(100, range=0..100)
range_12 = Range(Domain=number_slider_40, Steps=number_slider_41)
sine_2 = Sine(Value=range_12)
multiplication_4 = Multiplication(A=sine_2, B=Slider(4, range=0..5))
construct_point_12 = ConstructPoint(XCoordinate=graft(range_12), YCoordinate=range_12, ZCoordinate=multiplication_4)
surface_from_points_4 = SurfaceFromPoints(Points=flatten(construct_point_12), UCount=expr("x+1", number_slider_41), Interpolate=False)
surface_6 = Surface(surface_from_points_4)
area_5 = Area(Geometry=surface_6)  # -> Area, Centroid
dimensions_2 = Dimensions(Surface=surface_6)  # -> UDimension, VDimension
number_slider_42 = Slider(8, range=0..100)
division_3 = Division(A=dimensions_2.UDimension, B=dimensions_2.VDimension)
scale_4 = Scale(Geometry=surface_6, Center=area_5.Centroid, Factor=Slider(1.679, range=0..5))  # -> Geometry, Transform
md_slider_8 = MDSlider(
    SliderMode=0,
    slider_value=Point(0.4951607309, 0.2414119069, 0.5),
    x_domain=Domain(0, 1),
    y_domain=Domain(0, 1),
    z_domain=Domain(0, 1))
multiplication_5 = Multiplication(A=division_3, B=number_slider_42)
integer_2 = Integer(multiplication_5)
md_slider_9 = MDSlider(
    SliderMode=0,
    slider_value=Point(0.7276408516, 0.09028392548, 0.5),
    x_domain=Domain(0, 1),
    y_domain=Domain(0, 1),
    z_domain=Domain(0, 1))
divide_surface_3 = DivideSurface(Surface=surface_6, UCount=integer_2, VCount=number_slider_42)  # -> flatten(Points), Normals, Parameters
md_slider_10 = MDSlider(
    SliderMode=0,
    slider_value=Point(0.1948275682, 0.7902063509, 0.5),
    x_domain=Domain(0, 1),
    y_domain=Domain(0, 1),
    z_domain=Domain(0, 1))
evaluate_surface_5 = EvaluateSurface(Surface=reparameterize(scale_4.Geometry), Point=[md_slider_10, md_slider_8, md_slider_9])  # -> Point, Normal, UDirection, VDirection, Frame
distance_4 = Distance(PointA=graft(evaluate_surface_5.Point), PointB=divide_surface_3.Points)
point_5 = Point(divide_surface_3.Points)
expression_6 = Expression(w=flatten(Slider(0.243, range=0..2)), t=distance_4, Expression="sin(2*w^2*t)")
flip_matrix_3 = FlipMatrix(Data=expression_6)
ma_2 = MassMultiplication(Input=flip_matrix_3)  # -> flatten(Result), PartialResults
multiplication_6 = Multiplication(A=Slider(7.333, range=0..10), B=ma_2.Result)
unit_z_9 = UnitZ(Factor=multiplication_6)
move_11 = Move(Geometry=divide_surface_3.Points, Motion=unit_z_9)  # -> Geometry, Transform
expression_7 = Expression(u=integer_2, Expression="u+1")
mesh_frompoints_2 = MeshFromPoints(
    Points=move_11.Geometry,
    UDirection=expr("x+1", integer_2),
    VDirection=expr("x+1", number_slider_42),
    Colour=ColourSwatch(SwatchColor=RGB(236, 45, 255)))
surface_from_points_5 = SurfaceFromPoints(Points=move_11.Geometry, UCount=expression_7, Interpolate=False)

# ----
# - CTRL-M toggles mesh edges on and off
# - bake and repain mesh in rhino
number_slider_43 = Slider(44, range=0..100)
boolean_toggle_3 = BooleanToggle(False)
mesh = Mesh(surface_from_points_5)
bounding_box_6 = BoundingBox(Content=mesh, Plane=PlaneXY(0, 0, 0))  # -> Box, Box_2
populate_2d_2 = Populate2D(Region=bounding_box_6.Box, Count=number_slider_43, Seed=1)
mesh_2 = Mesh(mesh_frompoints_2)
face_normals_2 = FaceNormals(Mesh=mesh)  # -> Centers, Normals
mesh_convertquads_2 = MeshConvertQuads(Mesh=mesh, ShortDiagonal=boolean_toggle_3)  # -> Mesh, Split
mesh_edges_2 = MeshEdges(Mesh=mesh)  # -> NakedEdges, InteriorEdges, NonManifoldEdges
mesh_triangulate_2 = MeshTriangulate(Mesh=mesh, ShortDiagonal=boolean_toggle_3)
mesh_area_2 = MeshArea(Mesh=mesh)  # -> Area, Centroid
mesh_closest_point_2 = MeshClosestPoint(Point=populate_2d_2, Mesh=mesh)  # -> Point, Index, Parameter
bounding_box_7 = BoundingBox(Content=mesh_2, Plane=PlaneXY(0, 0, 0))  # -> Box, Box_2
mesh_addattributes = MeshAddAttributes(Mesh=mesh, Clear=False)  # -> RuntimeMessage, Mesh
data_recorder = DataRecorder(mesh_closest_point_2.Parameter, DataLimit=-10, RecordData=True)
mesh_box_2 = MeshBox(Base=bounding_box_7.Box, XCount=10, YCount=10, ZCount=10)
amplitude_5 = Amplitude(Vector=face_normals_2.Normals, Amplitude=Slider(12, range=0..100))
point_6 = Point(mesh_area_2.Centroid)
sphere_8 = Sphere(Base=face_normals_2.Centers, Radius=1)
line_9 = Line(StartPoint=populate_2d_2, EndPoint=mesh_closest_point_2.Point)
mesh_3 = Mesh(mesh_convertquads_2.Mesh)
mesh_4 = Mesh(mesh_triangulate_2)
line_10 = Line(mesh_edges_2.NakedEdges)
line_11 = Line(mesh_edges_2.InteriorEdges)
line_12 = Line(mesh_edges_2.NonManifoldEdges)
mesh_eval_2 = MeshEval(Mesh=mesh, Parameter=data_recorder)  # -> Point, Normal, Colour
panel_6 = Panel(mesh_addattributes.RuntimeMessage)
panel_7 = Panel(mesh_convertquads_2.Split)
mesh_5 = Mesh(mesh_addattributes.Mesh)
galapagos = Galapagos(fitness=mesh_area_2)
mesh_split_2 = MeshSplit(Mesh=mesh_box_2, Splitters=mesh_2)
panel_8 = Panel(mesh_closest_point_2.Parameter)
vector_display_3 = VectorDisplay(Anchor=face_normals_2.Centers, Vector=amplitude_5)
mesh_nakededge_2 = MeshNakedEdge(Mesh=mesh)  # -> V, A, B
point_7 = Point(mesh_eval_2.Point)
dispatch_2 = Dispatch(List=mesh_split_2, DispatchPattern=[True, False])  # -> ListA, ListB
vector_display_4 = VectorDisplay(Anchor=mesh_eval_2.Normal)
panel_9 = Panel(mesh_nakededge_2.A)
point_8 = Point(mesh_nakededge_2.V)
panel_10 = Panel(mesh_nakededge_2.B)
mesh_6 = Mesh(dispatch_2.ListA)
mesh_7 = Mesh(mesh_2)
mesh_join_2 = MeshJoin(Meshes=flatten([mesh_6, mesh_7]))
mesh_8 = Mesh(surface_from_points_5)
construct_point_13 = ConstructPoint(XCoordinate=0, YCoordinate=0, ZCoordinate=0)
mesh_sphere_2 = MeshSphere(Base=PlaneXY(0, 0, 0), Radius=10, UCount=10, VCount=20)
deconstruct_mesh_2 = DeconstructMesh(Mesh=mesh_8)  # -> Vertices, Faces, Colours, Normals
mesh_explode_2 = MeshExplode(Mesh=mesh_8, Interpolate=Toggle(True))
mesh_inclusion_2 = MeshInclusion(Mesh=mesh_sphere_2, Point=construct_point_13, Strict=False)
deconstruct_face_2 = DeconstructFace(Face=deconstruct_mesh_2.Faces)  # -> CornerA, CornerB, CornerC, CornerD
face_boundaries_2 = FaceBoundaries(Mesh=mesh_explode_2)
panel_12 = Panel(mesh_inclusion_2)
panel_13 = Panel(deconstruct_face_2.CornerA)
curve_18 = Curve(face_boundaries_2)
panel_14 = Panel(deconstruct_face_2.CornerB)
panel_15 = Panel(deconstruct_face_2.CornerC)
panel_16 = Panel(deconstruct_face_2.CornerD)

triangulate_2 = Triangulate(Mesh=mesh_join_2)  # -> Mesh, Count
quadrangulate_2 = Quadrangulate(Mesh=mesh_join_2, Angle=0.03490658504, Ratio=0.875)  # -> Mesh, Count

# ----
# 027_mesh_primitive
mesh_plane_4 = MeshPlane(Boundary={Plane=PlaneXY(0, 0, 0), Size=Domain2(u=-10..10, v=-10..10)}, WidthCount=10, HeightCount=10)  # -> Mesh, Area
mesh_box_3 = MeshBox(Base={Plane=PlaneXY(0, 0, 0), X=Domain(-10, 10), Y=Domain(-10, 10), Z=Domain(-10, 10)}, XCount=10, YCount=10, ZCount=10)
mesh_sphere_3 = MeshSphere(Base=PlaneXY(0, 0, 0), Radius=10, UCount=10, VCount=20)
mesh_sphere_ex_2 = MeshSphereEx(Base=PlaneXY(0, 0, 0), Radius=10, Count=5)
deconstruct_mesh_3 = DeconstructMesh(Mesh=mesh_box_3)  # -> Vertices, Faces, Colours, Normals
construct_mesh_2 = ConstructMesh(
    Vertices=deconstruct_mesh_3.Vertices,
    Faces=deconstruct_mesh_3.Faces,
    Colours=ColourSwatch(SwatchColor=RGB(231, 255, 255)))
deconstruct_face_3 = DeconstructFace(Face=deconstruct_mesh_3.Faces)  # -> CornerA, CornerB, CornerC, CornerD
mesh_triangle_2 = MeshTriangle(CornerA=deconstruct_face_3.CornerA, CornerB=deconstruct_face_3.CornerB, CornerC=deconstruct_face_3.CornerC)
mesh_quad_2 = MeshQuad(
    CornerA=deconstruct_face_3.CornerA,
    CornerB=deconstruct_face_3.CornerB,
    CornerC=deconstruct_face_3.CornerC,
    CornerD=deconstruct_face_3.CornerD)
construct_mesh_3 = ConstructMesh(Vertices=deconstruct_mesh_3.Vertices, Faces=mesh_triangle_2, Colours=ColourSwatch(SwatchColor=RGB(223, 122, 255)))
point_9 = Point([<point referenced from the Rhino model> x4])
colours = Colours([RGB(127, 255, 0), RGB(0, 100, 0), RGB(34, 139, 34), RGB(124, 252, 0), RGB(154, 205, 50), RGB(173, 255, 47), RGB(50, 205, 50), RGB(152, 251, 152)])
mesh_spray_2 = MeshSpray(
    Mesh=construct_mesh_3,
    Points=point_9,
    Colours=[ColourSwatch(SwatchColor=RGB(0, 255, 255)), ColourSwatch(SwatchColor=RGB(223, 122, 255)), ColourSwatch(SwatchColor=RGB(255, 255, 0)), ColourSwatch(SwatchColor=RGB(255, 0, 0))],
    SprayMode=11)
mesh_colours_2 = MeshColours(Mesh=construct_mesh_3, Colours=colours)
panel_17 = Panel(colours)

# ----
# 028_mesh_triangulation
# - mesh from points
# - intro to voronoi, metaball, octree, etc...
# - see section 3 for plugin details like
# weaverbird and coccoon
number_slider_44 = Slider(26, range=0..100)
number_slider_45 = Slider(12, range=0..100)
number_slider_46 = Slider(26, range=0..100)
number_slider_47 = Slider(26, range=0..100)
number_slider_48 = Slider(26, range=0..100)
number_slider_49 = Slider(26, range=0..100)
number_slider_50 = Slider(26, range=0..100)
center_box_3 = CenterBox(Base=PlaneXY(0, 0, 0), X=number_slider_44, Y=number_slider_44, Z=number_slider_44)
center_box_4 = CenterBox(Base=PlaneXY(0, 0, 0), X=number_slider_48, Y=number_slider_48, Z=number_slider_48)
center_box_5 = CenterBox(Base=PlaneXY(0, 0, 0), X=number_slider_49, Y=number_slider_49, Z=number_slider_49)
center_box_6 = CenterBox(Base=PlaneXY(0, 0, 0), X=number_slider_46, Y=number_slider_46, Z=number_slider_46)
center_box_7 = CenterBox(Base=PlaneXY(0, 0, 0), X=number_slider_47, Y=number_slider_47, Z=number_slider_47)
center_box_8 = CenterBox(Base=PlaneXY(0, 0, 0), X=number_slider_50, Y=number_slider_50, Z=number_slider_50)
populate_3d_2 = Populate3D(Region=center_box_3, Count=Slider(71, range=0..100), Seed=number_slider_45)
populate_3d_3 = Populate3D(Region=center_box_4, Count=Slider(71, range=0..100), Seed=number_slider_45)
populate_3d_4 = Populate3D(Region=center_box_5, Count=Slider(71, range=0..100), Seed=number_slider_45)
populate_3d_5 = Populate3D(Region=center_box_6, Count=Slider(71, range=0..100), Seed=number_slider_45)
populate_3d_6 = Populate3D(Region=center_box_7, Count=Slider(71, range=0..100), Seed=number_slider_45)
populate_3d_7 = Populate3D(Region=center_box_8, Count=Slider(71, range=0..100), Seed=number_slider_45)
deconstruct = Deconstruct(Point=populate_3d_5)  # -> XComponent, YComponent, ZComponent
absolute = Absolute(Value=deconstruct.XComponent)
multiplication_7 = Multiplication(A=Slider(0.344, range=0..1), B=absolute)
construct_point_14 = ConstructPoint(XCoordinate=0, YCoordinate=0, ZCoordinate=0)
xy_plane_3 = XYPlane(Origin=Point(0, 0, 0))
delaunay_edges_2 = DelaunayEdges(Points=populate_3d_2, Plane=PlaneXY(0, 0, 0))  # -> Connectivity, Edges
delaunay_edges_3 = DelaunayEdges(Points=populate_3d_3, Plane=PlaneXY(0, 0, 0))  # -> Connectivity, Edges
metaball_t_2 = MetaBallT(Points=populate_3d_5, Plane=PlaneXY(0, 0, 0), Threshold=Slider(0.11, range=0..1))
voronoi_3d_2 = Voronoi3D(Points=populate_3d_4)  # -> Cells, Boundary
voronoi_2 = Voronoi(Points=populate_3d_4, Plane=xy_plane_3, BruteForceOverride=False)
metaball_t_custom_2 = MetaBallTCustom(Points=populate_3d_5, Charge=multiplication_7, Plane=PlaneXY(0, 0, 0), Threshold=0.5)
octree_2 = OcTree(Points=populate_3d_6, Square=Toggle(False), Group=Slider(7, range=0..10))  # -> Boxes, Points
convex_hull_2 = ConvexHull(Points=populate_3d_7, Plane=PlaneXY(0, 0, 0))  # -> Hull, HullZ, Indices
metaball_2 = MetaBall(Points=populate_3d_5, Plane=PlaneXY(0, 0, 0), Point=construct_point_14)
delaunay_mesh_2 = DelaunayMesh(Points=populate_3d_2, Plane=PlaneXY(0, 0, 0))
delaunay_mesh_3 = DelaunayMesh(Points=populate_3d_3, Plane=PlaneXY(0, 0, 0))
curve_19 = Curve(convex_hull_2.Hull)
curve_20 = Curve(convex_hull_2.HullZ)

# ----
# 029_mesh_utilities
number_slider_51 = Slider(40, range=0..100)
number_slider_52 = Slider(100, range=0..100)
range_13 = Range(Domain=number_slider_51, Steps=number_slider_52)
sine_3 = Sine(Value=range_13)
multiplication_8 = Multiplication(A=sine_3, B=Slider(4, range=0..5))
construct_point_15 = ConstructPoint(XCoordinate=graft(range_13), YCoordinate=range_13, ZCoordinate=multiplication_8)
surface_from_points_6 = SurfaceFromPoints(Points=flatten(construct_point_15), UCount=expr("x+1", number_slider_52), Interpolate=False)
surface_7 = Surface(surface_from_points_6)
area_6 = Area(Geometry=surface_7)  # -> Area, Centroid
dimensions_3 = Dimensions(Surface=surface_7)  # -> UDimension, VDimension
number_slider_53 = Slider(8, range=0..100)
division_4 = Division(A=dimensions_3.UDimension, B=dimensions_3.VDimension)
scale_5 = Scale(Geometry=surface_7, Center=area_6.Centroid, Factor=Slider(1.679, range=0..5))  # -> Geometry, Transform
md_slider_11 = MDSlider(
    SliderMode=0,
    slider_value=Point(0.4951607309, 0.2414119069, 0.5),
    x_domain=Domain(0, 1),
    y_domain=Domain(0, 1),
    z_domain=Domain(0, 1))
multiplication_9 = Multiplication(A=division_4, B=number_slider_53)
integer_3 = Integer(multiplication_9)
md_slider_12 = MDSlider(
    SliderMode=0,
    slider_value=Point(0.7276408516, 0.09028392548, 0.5),
    x_domain=Domain(0, 1),
    y_domain=Domain(0, 1),
    z_domain=Domain(0, 1))
divide_surface_4 = DivideSurface(Surface=surface_7, UCount=integer_3, VCount=number_slider_53)  # -> flatten(Points), Normals, Parameters
md_slider_13 = MDSlider(
    SliderMode=0,
    slider_value=Point(0.1948275682, 0.7902063509, 0.5),
    x_domain=Domain(0, 1),
    y_domain=Domain(0, 1),
    z_domain=Domain(0, 1))
evaluate_surface_6 = EvaluateSurface(Surface=reparameterize(scale_5.Geometry), Point=[md_slider_13, md_slider_11, md_slider_12])  # -> Point, Normal, UDirection, VDirection, Frame
distance_5 = Distance(PointA=graft(evaluate_surface_6.Point), PointB=divide_surface_4.Points)
point_10 = Point(divide_surface_4.Points)
expression_8 = Expression(w=flatten(Slider(0.243, range=0..2)), t=distance_5, Expression="sin(2*w^2*t)")
flip_matrix_4 = FlipMatrix(Data=expression_8)
ma_3 = MassMultiplication(Input=flip_matrix_4)  # -> flatten(Result), PartialResults
multiplication_10 = Multiplication(A=Slider(7.333, range=0..10), B=ma_3.Result)
unit_z_10 = UnitZ(Factor=multiplication_10)
move_12 = Move(Geometry=divide_surface_4.Points, Motion=unit_z_10)  # -> Geometry, Transform
expression_9 = Expression(u=integer_3, Expression="u+1")
mesh_frompoints_3 = MeshFromPoints(
    Points=move_12.Geometry,
    UDirection=expr("x+1", integer_3),
    VDirection=expr("x+1", number_slider_53),
    Colour=ColourSwatch(SwatchColor=RGB(236, 45, 255)))
surface_from_points_7 = SurfaceFromPoints(Points=move_12.Geometry, UCount=expression_9, Interpolate=False)

# ----
# - brep to mesh
brep = Brep(surface_from_points_7)
brep_2 = Brep(surface_from_points_7)
number_slider_54 = Slider(4, range=0..100)
mesh_brep_2 = MeshBrep(
    Brep=brep,
    Settings={GridMaxCount=0, GridMinCount=16, JaggedSeams=False, MaxEdgeLength=0, MinEdgeLength=0.0001, MinTolerance=0, Refine=True, RefineAngle=0, RelativeTolerance=0.65, SimplePlanes=True, Tolerance=0})
simple_mesh_2 = SimpleMesh(Brep=brep)
surface_8 = Surface(brep_2)
flip_mesh_2 = FlipMesh(Mesh=simple_mesh_2, VertexNormals=Toggle(True), FaceNormals=Toggle(True), FaceOrientation=Toggle(True))
mesh_unifynormals_2 = MeshUnifyNormals(Mesh=mesh_brep_2)
mesh_surface_2 = MeshSurface(Surface=surface_8, UCount=number_slider_54, VCount=number_slider_54, Overhang=True, Equalize=False)
mesh_brep_3 = MeshBrep(
    Brep=brep_2,
    Settings={GridMaxCount=0, GridMinCount=16, JaggedSeams=False, MaxEdgeLength=0, MinEdgeLength=0.0001, MinTolerance=0, Refine=True, RefineAngle=0, RelativeTolerance=0.65, SimplePlanes=True, Tolerance=0})
number_slider_55 = Slider(7, range=0..10)
triangulate_3 = Triangulate(Mesh=mesh_unifynormals_2)  # -> Mesh, Count
quadrangulate_3 = Quadrangulate(Mesh=mesh_unifynormals_2, Angle=0.03490658504, Ratio=0.875)  # -> Mesh, Count
deconstruct_mesh_4 = DeconstructMesh(Mesh=mesh_brep_3)  # -> Vertices, Faces, Colours, Normals
mesh_flip_2 = MeshFlip(Mesh=flip_mesh_2)
mesh_weldvertices_2 = MeshWeldVertices(Mesh=[mesh_unifynormals_2, mesh_flip_2], Tolerance=0.01)  # -> RuntimeMessage, Mesh
list_length_3 = ListLength(List=deconstruct_mesh_4.Vertices)
list_length_4 = ListLength(List=deconstruct_mesh_4.Faces)
division_5 = Division(A=list_length_3, B=number_slider_55)
panel_18 = Panel(mesh_weldvertices_2.RuntimeMessage)
range_14 = Range(Domain=list_length_4, Steps=Slider(513, range=0..1000))
series_2 = Series(Start=0, Step=number_slider_55, Count=division_5)
panel_19 = Panel("""0
11
0""")
cull_vertices_2 = CullVertices(Mesh=mesh_brep_3, Pattern=panel_19, Shrink=True)
cull_faces_2 = CullFaces(Mesh=mesh_brep_3, Pattern=panel_19)
delete_faces_2 = DeleteFaces(Mesh=mesh_brep_3, Indices=range_14)
delete_vertices_2 = DeleteVertices(Mesh=mesh_brep_3, Indices=series_2, Shrink=True)
mesh_join_3 = MeshJoin(Meshes=[delete_faces_2, delete_vertices_2])
panel_20 = Panel(mesh_join_3)
weld_mesh_2 = WeldMesh(Mesh=mesh_join_3, Angle=3.141592654)
panel_21 = Panel(weld_mesh_2)
unweld_mesh_2 = UnweldMesh(Mesh=weld_mesh_2, Angle=1.570796327)
panel_22 = Panel(unweld_mesh_2)

# ----
# - I have seen this used once in generative design series:
# great video series (5 videos)
# Intermediate to advanced levels
occlusion_3 = Occlusion()  # -> Hits, Occlusion

# ----
# - parametric mesh shadow
number_slider_56 = Slider(0.09, range=0..1)
bounding_box_8 = BoundingBox(Content=delete_vertices_2, Plane=PlaneXY(0, 0, 0))  # -> Box, Box_2
negative_2 = Negative(Value=Slider(1, range=0..1))
deconstruct_brep_7 = DeconstructBrep(Brep=bounding_box_8.Box)  # -> Faces, Edges, Vertices
vector_xyz_2 = VectorXYZ(XComponent=Slider(0.49, range=0..1), YComponent=number_slider_56, ZComponent=negative_2)  # -> Vector, Length
list_item_8 = ListItem(List=deconstruct_brep_7.Faces, Index=Slider(4, range=0..10), Wrap=True)
mesh_shadow_2 = MeshShadow(Mesh=weld_mesh_2, Light=vector_xyz_2.Vector, Plane=list_item_8)
cull_index_4 = CullIndex(List=mesh_shadow_2, Indices="0", Wrap=True)
list_item_9 = ListItem(List=mesh_shadow_2, Index=Slider(0, range=0..100), Wrap=True)
boundary_surfaces_5 = BoundarySurfaces(Edges=cull_index_4)
split_brep_multiple_4 = SplitBrepMultiple(Brep=list_item_9, Cutters=boundary_surfaces_5)
list_item_10 = ListItem(List=split_brep_multiple_4, Index=0, Wrap=True)  # -> Item1, Item

# ----
# 017_curves_analysis
# - create curve(s) in grasshopper
# - use some of your pervious learned skills
# to manipulate and create new geometries
panel_23 = Panel("{(1,3,...)}[(1to4)]")  # disabled
square_2 = Square(Plane=PlaneXY(0, 0, 0), Size=1, ExtentX=5, ExtentY=5)  # -> Cells, simplify(Points); disabled
split_tree_5 = SplitTree(Data=square_2.Points, Masks=flatten(panel_23))  # -> Positive, Negative; disabled
panel_24 = Panel("3")  # disabled
unit_z_11 = UnitZ(Factor=panel_24)  # disabled
point_11 = Point(split_tree_5.Negative)  # disabled
negative_3 = Negative(Value=unit_z_11)  # disabled
move_13 = Move(Geometry=split_tree_5.Positive, Motion=[unit_z_11, negative_3])  # -> Geometry, Transform; disabled
interpolate_9 = Interpolate(Vertices=[split_tree_5.Negative, move_13.Geometry], Degree=3, Periodic=False, KnotStyle=1)  # -> Curve, Length, Domain; disabled
panel_25 = Panel("{(0,2,4)}[]")  # disabled
split_tree_6 = SplitTree(Data=interpolate_9.Curve, Masks=flatten(panel_25))  # -> Positive, Negative; disabled
curve_21 = Curve(split_tree_6.Negative)  # disabled
curve_22 = Curve(split_tree_6.Positive)  # disabled
curve_middle_4 = CurveMiddle(Curve=curve_22)  # disabled
point_on_curve_4 = PointOnCurve(curve_22, parameter=1)  # disabled
end_points_4 = EndPoints(Curve=curve_21)  # -> Start, End; disabled
end_points_5 = EndPoints(Curve=curve_22)  # -> Start, End; disabled
match_tree = MatchTree(Tree=end_points_5.End, Guide=end_points_4.Start)  # disabled
number_slider_57 = Slider(1, range=0..1)  # disabled
number_slider_58 = Slider(0, range=0..1)  # disabled
number_slider_59 = Slider(1, range=0..1)  # disabled
number_slider_60 = Slider(0.3, range=0..1)  # disabled

merge_4 = Merge(Data1=end_points_4.End, Data2=end_points_5.End, Data3=end_points_4.Start)  # disabled

interpolate_10 = Interpolate(Vertices=flatten(merge_4), Degree=3, Periodic=False, KnotStyle=1)  # -> Curve, Length, Domain; disabled
perp_frame_2 = PerpFrame(Curve=reparameterize(interpolate_10.Curve), Parameter=number_slider_58)  # disabled
perp_frame_3 = PerpFrame(Curve=reparameterize(interpolate_10.Curve), Parameter=number_slider_57)  # disabled
horizontal_frame_2 = HorizontalFrame(Curve=reparameterize(interpolate_10.Curve), Parameter=number_slider_57)  # disabled
ellipse_2 = Ellipse(Plane=perp_frame_2, Radius1=1, Radius2=number_slider_59)  # -> Ellipse, Focus1, Focus2; disabled
ellipse_3 = Ellipse(Plane=perp_frame_3, Radius1=1, Radius2=number_slider_60)  # -> Ellipse, Focus1, Focus2; disabled
sweep1_3 = Sweep1(Rail=interpolate_10.Curve, Sections=[ellipse_3.Ellipse, ellipse_2.Ellipse], Miter=1)  # disabled
cap_holes_2 = CapHoles(Brep=sweep1_3)  # disabled
