# Grasshopper definition EX_009_sets_sequence.gh (Grasshopper 1.0.7)

# ----
# EXERCISES_SETS
# 009_sets_sequence
# - the sequence node is good but nothing beats
# the power of the series and range components
# in grasshopper for generating data
number_slider = Slider(0, range=0..10)
number_slider_2 = Slider(10, range=0..10)
construct_domain = ConstructDomain(DomainStart=number_slider, DomainEnd=number_slider_2)
range = Range(Domain=Slider(4, range=0..10), Steps=10)
range_2 = Range(Domain=Slider(10, range=0..10), Steps=10)
pi = Pi(Factor=range)
golden_ratio = GoldenRatio(Factor=range_2)
fibonacci = Fibonacci(SeedA=0, SeedB=1, Number=Slider(10, range=0..10))
range_3 = Range(Domain=construct_domain, Steps=number_slider_2)
series = Series(Start=number_slider, Step=Slider(1, range=0..10), Count=number_slider_2)
panel = Panel(fibonacci)
panel_2 = Panel(pi)
panel_3 = Panel(golden_ratio)
panel_4 = Panel(series)
panel_5 = Panel(range_3)
number_slider_3 = Slider(4, range=0..10)
seed = Slider(18, range=0..100)
jitter = Jitter(List=panel_4, Jitter=Slider(1, range=0..1), Seed=seed)  # -> Values, Indices
random = Random(Range=panel_5, Number=number_slider_3, Seed=seed)
panel_6 = Panel(random)
panel_7 = Panel(jitter.Values)
random_reduce = RandomReduce(List=jitter.Values, Reduction=number_slider_3, Seed=seed)
sequence = Sequence(Notation="[N-1] + [N-2]", Length=20, Initial=[1, 1])
number_slider_4 = Slider(2, range=0..10)
panel_8 = Panel(random_reduce)
duplicate_data = DuplicateData(Data=random_reduce, Number=number_slider_4, Order=Toggle(True))
duplicate_data_2 = DuplicateData(Data=random_reduce, Number=number_slider_4, Order=Toggle(False))
panel_9 = Panel(duplicate_data)
panel_10 = Panel(duplicate_data_2)
gene_pool = GenePool(
    Decimals=0,
    Maximum=10,
    Minimum=0,
    Value=[8.136726282, 2.01199249, 7.015561451, 9.924756973, 3.545053412, 7.000488749, 2.425638424, 3.935621015, 6.005280212, 8.860206925])
gene_pool_2 = GenePool(
    Decimals=0,
    Maximum=1,
    Minimum=0,
    Value=[0.5563034162, 0.1101821131, 0.4184624788, 0.3575948995, 0.7002510963, 0.3821827748, 0.821337548, 0.03640053749, 0.8685297598, 0.6536799626])
cull_nth = CullNth(List=duplicate_data, CullFrequency=Slider(2, range=0..10))
cull_pattern = CullPattern(List=duplicate_data, CullPattern=gene_pool_2)
cull_index = CullIndex(List=duplicate_data, Indices=gene_pool, Wrap=True)
panel_11 = Panel(cull_index)
panel_12 = Panel(cull_pattern)
panel_13 = Panel(cull_nth)
repeat_data = RepeatData(Data=panel_11, Length=Slider(12, range=0..100))
panel_14 = Panel(repeat_data)
