# Grasshopper definition EX_010_sets_text(annotations in rhino).gh (Grasshopper 1.0.7)
# plug-ins: Bifocals

# ----
# 010_sets_text(annotation_in_rhino)
# - concatenate can be a very useful tool
# for labeling 2D graphs in Rhino
# the graph of y = x^2
number_slider = Slider(1.35, range=0..10)
negative = Negative(Value=number_slider)
number_slider_2 = Slider(6, range=0..10)
number_slider_3 = Slider(73, range=0..100)
# EXERCISES_SETS
panel = Panel(number_slider)
construct_domain = ConstructDomain(DomainStart=negative, DomainEnd=number_slider)
panel_2 = Panel(number_slider)
panel_3 = Panel(negative)
range = Range(Domain=construct_domain, Steps=number_slider_2)
panel_4 = Panel(construct_domain)
expression = Expression(x=range, y=range, Expression="x^2")  # -> flatten(Result)
construct_point = ConstructPoint(XCoordinate=0, YCoordinate=0, ZCoordinate=0)
panel_5 = Panel(range)
construct_point_2 = ConstructPoint(XCoordinate=range, YCoordinate=expression, ZCoordinate=0)
deconstruct = Deconstruct(Point=construct_point_2)  # -> XComponent, YComponent, ZComponent
construct_point_3 = ConstructPoint(XCoordinate=0, YCoordinate=deconstruct.YComponent, ZCoordinate=0)
construct_point_4 = ConstructPoint(XCoordinate=deconstruct.XComponent, YCoordinate=0, ZCoordinate=0)
interpolate = Interpolate(Vertices=construct_point_2, Degree=3, Periodic=False, KnotStyle=1)  # -> Curve, Length, Domain
line = Line(StartPoint=construct_point, EndPoint=construct_point_4)
line_2 = Line(StartPoint=construct_point, EndPoint=construct_point_3)
point_on_curve = PointOnCurve(interpolate.Curve, parameter=0.073)
point_on_curve_2 = PointOnCurve(interpolate.Curve, parameter=1)
curve_middle = CurveMiddle(Curve=reparameterize(interpolate.Curve))
panel_6 = Panel(interpolate.Length)
evaluate_curve = EvaluateCurve(Curve=reparameterize(interpolate.Curve), Parameter="0")  # -> Point, Tangent, Angle
evaluate_curve_2 = EvaluateCurve(Curve=reparameterize(interpolate.Curve), Parameter="1")  # -> Point, Tangent, Angle
panel_7 = Panel("""  
      Length of curve = """)
negative_2 = Negative(Value=evaluate_curve.Tangent)
list_item = ListItem(List=construct_point_4, Index=0, Wrap=True)  # -> Item1, Item
list_item_2 = ListItem(List=construct_point_3, Index=0, Wrap=True)
concatenate = Concatenate(FragmentA=panel_7, FragmentB=panel_6)
polyline = PolyLine(Vertices=construct_point_2, Closed=False)
text_tag_3d = TextTag3D(Location=curve_middle, Text="Calculus Magic", Size=".12", Justification=1)
text_tag_3d_2 = TextTag3D(Location=point_on_curve_2, Text=concatenate, Size=".12", Justification=7)
text_tag_3d_3 = TextTag3D(Location=list_item_2, Text="y    ", Size=".12", Justification=9)
text_tag_3d_4 = TextTag3D(Location=list_item.Item1, Text="x", Size=".12", Justification=7)
text_tag_3d_5 = TextTag3D(Location=point_on_curve, Text="    P = (x,y)", Size=".12", Justification=7)
text_tag_3d_6 = TextTag3D(Location=construct_point, Text="O    ", Size=".12", Justification=3)
vector_display = VectorDisplay(Anchor=evaluate_curve.Point, Vector=negative_2)
vector_display_2 = VectorDisplay(Anchor=evaluate_curve_2.Point, Vector=evaluate_curve_2.Tangent)
curve = Curve(interpolate.Curve)
pipe = Pipe(Curve=polyline, Radius=Slider(0.04, range=0..0.1), Caps=0)

random = Random(Range=number_slider_2, Number=1, Seed=Slider(29, range=0..100))
panel_8 = Panel(expression)
list_item_3 = ListItem(List=construct_point_2, Index=random, Wrap=True)
deconstruct_2 = Deconstruct(Point=list_item_3)  # -> XComponent, YComponent, ZComponent
concatenate_2 = Concatenate(FragmentA="____ƒ(x) = ", FragmentB=deconstruct_2.YComponent)
text_tag_3d_7 = TextTag3D(Location=list_item_3, Text=concatenate_2, Size=".12", Justification=7)
