# Grasshopper definition EX_013_vector_grid.gh (Grasshopper 1.0.7)
# plug-ins: Bifocals

# ----
# - consider what you could do with populate geometry
# on the surface and inside the form
number_slider = Slider(12, range=0..100)
cylinder = Cylinder(Base=PlaneXY(0, 0, 0), Radius=number_slider, Length=number_slider)
cap_holes = CapHoles(Brep=cylinder)
populate_geometry = PopulateGeometry(Geometry=cap_holes, Count=100, Seed=1)
populate_geometry_2 = PopulateGeometry(Geometry=cylinder, Count=100, Seed=1)

# ----
# EXERCISES_VECTOR
# 013_vector_grid
# - check out Dr. Vector at ParametricCamp
number_slider_2 = Slider(10, range=0..10)
number_slider_3 = Slider(5, range=0..5)
number_slider_4 = Slider(5, range=0..10)
yz_plane = YZPlane(Origin=Point(0, 0, 0))
rectangular = Rectangular(Plane=yz_plane, SizeX=number_slider_2, SizeY=number_slider_2, ExtentX=number_slider_3, ExtentY=number_slider_3)  # -> Cells, Points
hexagonal = Hexagonal(Plane=yz_plane, Size=number_slider_2, ExtentX=number_slider_3, ExtentY=number_slider_3)  # -> Cells, Points
square = Square(Plane=yz_plane, Size=number_slider_3, ExtentX=number_slider_3, ExtentY=number_slider_3)  # -> Cells, Points
radial = Radial(Plane=yz_plane, Size=number_slider_3, ExtentR=number_slider_3, ExtentP=number_slider_3)  # -> Cells, Points
triangular = Triangular(Plane=yz_plane, Size=number_slider_3, ExtentX=number_slider_3, ExtentY=number_slider_3)  # -> Cells, Points
multiplication = Multiplication(A=number_slider_3, B=number_slider_3)
bounding_box = BoundingBox(Content=flatten(hexagonal.Cells), Plane=PlaneXY(0, 0, 0), UnionBox=True)  # -> Box, Box_2
unit_x = UnitX(Factor=multiplication)
number_slider_5 = Slider(17, range=0..100)
number_slider_6 = Slider(3, range=0..10)
extrude = Extrude(Base=hexagonal.Cells, Direction=unit_x)
populate_2d = Populate2D(Region=hexagonal.Cells, Count=number_slider_6, Seed=number_slider_5)
populate_3d = Populate3D(Region=extrude, Count=number_slider_6, Seed=number_slider_5)
bounding_box_2 = BoundingBox(Content=flatten(extrude), Plane=PlaneXY(0, 0, 0), UnionBox=True)  # -> Box, Box_2
dispatch = Dispatch(List=populate_2d, DispatchPattern=[True, False])  # -> ListA, ListB
dispatch_2 = Dispatch(List=populate_3d, DispatchPattern=[True, False])  # -> ListA, ListB
boolean_toggle = BooleanToggle(True)
interpolate = Interpolate(Vertices=dispatch.ListA, Degree=3, Periodic=boolean_toggle, KnotStyle=1)  # -> simplify(flatten(Curve)), Length, Domain
interpolate_2 = Interpolate(Vertices=[dispatch_2.ListA, dispatch_2.ListB], Degree=3, Periodic=boolean_toggle, KnotStyle=1)  # -> Curve, Length, Domain
surface_split = SurfaceSplit(Surface=bounding_box.Box, Curves=interpolate.Curve)
pipe = Pipe(Curve=interpolate_2.Curve, Radius=Slider(5, range=0..10), Caps=1)  # -> simplify(flatten(Pipe))
list_item = ListItem(List=surface_split, Index=0, Wrap=True)
solid_difference = SolidDifference(BrepsA=bounding_box_2.Box, BrepsB=pipe)
