# Grasshopper definition EX_014_vector_plane.gh (Grasshopper 1.0.7)
# plug-ins: Bifocals

number_slider = Slider(4, range=0..10)

number_slider_2 = Slider(7, range=0..100)
range = Range(Domain=number_slider_2, Steps="100")
sine = Sine(Value=range)
cosine = Cosine(Value=range)
multiplication = Multiplication(A=sine, B=number_slider_2)
multiplication_2 = Multiplication(A=cosine, B=number_slider_2)
construct_point = ConstructPoint(XCoordinate=multiplication, YCoordinate=multiplication_2, ZCoordinate=range)

# ----
# EXERCISES_VECTOR
# 014_vector_plane
# - figure out how to control your grasshopper
# construction planes similar to how you can utilize
# construction planes in Rhino3D environment
number_slider_3 = Slider(12, range=0..100)
range_2 = Range(Domain=number_slider_3, Steps="100")
sine_2 = Sine(Value=range_2)
cosine_2 = Cosine(Value=range_2)
multiplication_3 = Multiplication(A=cosine_2, B=number_slider_3)
multiplication_4 = Multiplication(A=sine_2, B=number_slider_3)
construct_point_2 = ConstructPoint(XCoordinate=number_slider_3, YCoordinate=multiplication_4, ZCoordinate=multiplication_3)
interpolate = Interpolate(Vertices=construct_point_2, Degree=3, Periodic=False, KnotStyle=1)  # -> Curve, Length, Domain
divide_curve = DivideCurve(Curve=interpolate.Curve, Count=Slider(2, range=0..10), Kinks=False)  # -> Points, Tangents, Parameters
xy_plane = XYPlane(Origin=Point(0, 0, 0))
xz_plane = XZPlane(Origin=Point(0, 0, 0))
yz_plane = YZPlane(Origin=Point(0, 0, 0))
list_item = ListItem(List=divide_curve.Points, Index=0, Wrap=True)
plane_normal = PlaneNormal(Origin=list_item, ZAxis=xy_plane)
construct_plane = ConstructPlane(Origin=list_item, XAxis=xy_plane, YAxis=xz_plane)
curve = Curve(interpolate.Curve)
deconstruct_plane = DeconstructPlane(Plane=construct_plane)  # -> Origin, XAxis, YAxis, ZAxis
xy_plane_2 = XYPlane(Origin=deconstruct_plane.XAxis)
xz_plane_2 = XZPlane(Origin=deconstruct_plane.YAxis)
yz_plane_2 = YZPlane(Origin=deconstruct_plane.ZAxis)
plane_origin = PlaneOrigin(Base=yz_plane_2, Origin=deconstruct_plane.Origin)
flip_plane = FlipPlane(Plane=plane_origin, ReverseX=Toggle(True), ReverseY=Toggle(True), SwapAxes=Toggle(True))
pi = Pi(Factor=Slider(0, range=0..2))
rotate_plane = RotatePlane(Plane=flip_plane, Angle=pi)
rotate = Rotate(Angle=1.570796327, Plane=PlaneXY(0, 0, 0))  # -> Geometry, Transform
rotate_3d = Rotate3D(Angle=1.570796327, Center=Point(0, 0, 0), Axis=Vector(0, 0, 1))  # -> Geometry, Transform
rotate_axis = RotateAxis(Angle=1.570796327, Axis=Line((0, 0, 0), (10, 0, 0)))  # -> Geometry, Transform
plane_closest_point = PlaneClosestPoint(Point=construct_point, Plane=rotate_plane)  # -> Point, UVPoint, Distance
rotate_direction = RotateDirection(Center=Point(0, 0, 0), From=Vector(1, 0, 0), To=Vector(0, 1, 0))  # -> Geometry, Transform
line = Line(StartPoint=construct_point, EndPoint=plane_closest_point.Point)
loft = Loft(Curves=line, Options={Adjust=False, Closed=False, LoftEnds=0, LoftSimp=0, LoftType=0, Rebuild=10, Refit=0.01})

# ----
# -understanding plane manipulation is essential
# for understanding robotic tool paths and
# organizing axis origins and planes
# 
# - try creating diffenent planes in on the gh canvas
number_slider_4 = Slider(8, range=0..100)
quad_sphere = QuadSphere(Base=PlaneXY(0, 0, 0), Radius=1)
populate_geometry = PopulateGeometry(Geometry=quad_sphere, Count="2", Seed=1)
populate_geometry_2 = PopulateGeometry(Geometry=quad_sphere, Count="2", Seed=number_slider_4)
dispatch = Dispatch(List=populate_geometry_2, DispatchPattern=[True, False])  # -> ListA, ListB
dispatch_2 = Dispatch(List=populate_geometry, DispatchPattern=[True, False])  # -> ListA, ListB
line_2 = Line(StartPoint=dispatch.ListA, EndPoint=dispatch.ListB)
line_3 = Line(StartPoint=dispatch_2.ListA, EndPoint=dispatch_2.ListB)
plane_fit = PlaneFit(Points=[populate_geometry, populate_geometry_2])  # -> Plane, Deviation
line_pt = LinePt(Line=line_3, Point=populate_geometry_2)
line_line = LineLine(LineA=line_3, LineB=line_2)
plane_3pt = Plane3Pt(PointA=dispatch_2.ListA, PointB=dispatch_2.ListB, PointC=dispatch.ListA)
plane_normal_2 = PlaneNormal(Origin=line_pt, ZAxis=Vector(0, 0, 1))
deconstruct = Deconstruct(Point=dispatch.ListA)  # -> XComponent, YComponent, ZComponent
plane_offset = PlaneOffset(BasePlane=line_line, Offset=Slider(4.55, range=0..10))
adjust_plane = AdjustPlane(Plane=line_line, Normal=plane_normal_2)
vector_xyz = VectorXYZ(XComponent=deconstruct.XComponent, YComponent=deconstruct.YComponent, ZComponent=deconstruct.ZComponent)  # -> Vector, Length
align_plane = AlignPlane(Plane=plane_offset, Direction=vector_xyz.Vector)  # -> Plane, Angle
vector_display = VectorDisplay(Anchor=dispatch.ListA, Vector=vector_xyz.Vector)
number_slider_5 = Slider(10, range=0..10)
plane_coordinates = PlaneCoordinates(Point=align_plane.Plane, System=PlaneXY(0, 0, 0))  # -> XCoordinate, YCoordinate, ZCoordinate
multiplication_5 = Multiplication(A=number_slider_5, B="2")
panel = Panel([plane_coordinates.XCoordinate, plane_coordinates.YCoordinate, plane_coordinates.ZCoordinate])
construct_domain = ConstructDomain(DomainStart=Slider(0.1, range=0.1..1.1), DomainEnd=multiplication_5)
construct_domain_2 = ConstructDomain(DomainStart=Slider(0.1, range=0.1..1.1), DomainEnd=number_slider_5)
integer = Integer(number_slider_5)
range_3 = Range(Domain=construct_domain_2, Steps=10)
range_4 = Range(Domain=construct_domain, Steps=integer)

ellipse = Ellipse(Plane=PlaneXY(0, 0, 0), Radius1=Slider(24, range=0..100), Radius2=Slider(39, range=0..100))  # -> Ellipse, Focus1, Focus2
perp_frames = PerpFrames(Curve=ellipse.Ellipse, Count=10, Align=True)  # -> Frames, Parameters
xy_plane_3 = XYPlane(Origin=Point(0, 0, 0))
xz_plane_3 = XZPlane(Origin=Point(0, 0, 0))
yz_plane_3 = YZPlane(Origin=Point(0, 0, 0))
align_planes = AlignPlanes(Planes=perp_frames.Frames, Master=graft([adjust_plane, xy_plane_3, xz_plane_3, yz_plane_3]))  # -> flatten(Planes)

polygon = Polygon(Plane=graft(align_planes), Radius=range_3, Segments=6, FilletRadius=0)  # -> Polygon, Length
area = Area(Geometry=polygon.Polygon)  # -> Area, Centroid
rotate_3d_2 = Rotate3D(Geometry=polygon.Polygon, Angle=range_4, Center=area.Centroid, Axis=Vector(0, 0, 1))  # -> Geometry, Transform
