# Grasshopper definition EX_015_vector_point.gh (Grasshopper 1.0.7)
# plug-ins: Bifocals, Kangaroo2 Components

# ----
# EXERCISES_VECTOR
# 015_vector_point
# - construct point is one of the most
# important nodes for creating your
# own algorithmic and computational
# geometries
gene_pool = GenePool(Decimals=2, Maximum=10, Minimum=0, Value=[0, 4.67, 10])
construct_point = ConstructPoint(XCoordinate=graft(gene_pool), YCoordinate=gene_pool, ZCoordinate=0)
unit_z = UnitZ(Factor=gene_pool)
move = Move(Geometry=graft(construct_point), Motion=unit_z)  # -> Geometry, Transform
interpolate = Interpolate(Vertices=move.Geometry, Degree=3, Periodic=False, KnotStyle=1)  # -> Curve, Length, Domain
split_tree = SplitTree(Data=move.Geometry, Masks=flatten("{0;*;*}[1]"))  # -> Positive, Negative
deconstruct = Deconstruct(Point=move.Geometry)  # -> XComponent, YComponent, ZComponent
point = Point(split_tree.Positive)
param_viewer = ParamViewer(point)
point_2 = Point(split_tree.Negative)
panel = Panel(deconstruct.XComponent)
panel_2 = Panel(point)
clean_tree = CleanTree(RemoveNulls=True, RemoveInvalid=True, RemoveEmpty=False, Tree=point)
clean_tree_2 = CleanTree(RemoveNulls=True, RemoveInvalid=True, RemoveEmpty=False, Tree=point_2)
panel_3 = Panel(deconstruct.YComponent)
panel_4 = Panel(deconstruct.ZComponent)
list_item = ListItem(List=flatten(clean_tree), Index="4", Wrap=True)
pi = Pi(Factor=Slider(0.61, range=0..2))
plane_origin = PlaneOrigin(Base=list_item, Origin=list_item)
rotate = Rotate(Geometry=clean_tree, Angle=pi, Plane=plane_origin)  # -> Geometry, Transform
dispatch = Dispatch(List=rotate.Geometry, DispatchPattern=[True, False])  # -> ListA, ListB
line = Line(StartPoint=flatten(clean_tree_2), EndPoint=rotate.Geometry)
distance = Distance(PointA=dispatch.ListA, PointB=dispatch.ListB)
multipipe = MultiPipe(Curves=line, NodeSize=Slider(0.13, range=0..1), EndOffset=1, StrutSize=1, Segment=0, KinkAngle=0.6, CubeFit=0, Caps=0)
panel_5 = Panel(distance)

# ----
# - creating your own geometries with projecting points
# and sorting points
number_slider = Slider(6, range=0..10)
rectangular = Rectangular(Plane=PlaneXY(0, 0, 0), SizeX=1, SizeY=2, ExtentX=number_slider, ExtentY=number_slider)  # -> Cells, Points
square = Square(Plane=PlaneXY(0, 0, 0), Size=1, ExtentX=number_slider, ExtentY=number_slider)  # -> Cells, Points
hexagonal = Hexagonal(Plane=PlaneXY(0, 0, 0), Size=1, ExtentX=number_slider, ExtentY=number_slider)  # -> Cells, Points
triangular = Triangular(Plane=PlaneXY(0, 0, 0), Size=1, ExtentX=number_slider, ExtentY=number_slider)  # -> Cells, Points
merge = Merge(Data1=rectangular.Points, Data2=square.Points, Data3=hexagonal.Points, Data4=triangular.Points)  # -> flatten(Result)
param_viewer_2 = ParamViewer(merge)
quad_sphere = QuadSphere(Base=PlaneXY(0, 0, 0), Radius=number_slider)
cull_duplicates = CullDuplicates(Points=merge, Tolerance=0.1, CullMode=3)  # -> Points, Indices, Valence
list_item_2 = ListItem(List=flatten(hexagonal.Cells), Index=Slider(84, range=0..100), Wrap=True)
deconstruct_brep = DeconstructBrep(Brep=quad_sphere)  # -> Faces, Edges, Vertices
param_viewer_3 = ParamViewer(cull_duplicates.Points)
interpolate_2 = Interpolate(Vertices=cull_duplicates.Points, Degree=3, Periodic=False, KnotStyle=1)  # -> Curve, Length, Domain
sort_points = SortPoints(Points=cull_duplicates.Points)  # -> Points, Indices
list_item_3 = ListItem(List=deconstruct_brep.Faces, Index=0, Wrap=True)
interpolate_3 = Interpolate(Vertices=sort_points.Points, Degree=3, Periodic=False, KnotStyle=1)  # -> Curve, Length, Domain
sort_along_curve = SortAlongCurve(Points=sort_points.Points, Curve=list_item_2)  # -> Points, Indices
interpolate_4 = Interpolate(Vertices=sort_along_curve.Points, Degree=3, Periodic=False, KnotStyle=1)  # -> Curve, Length, Domain
unit_z_2 = UnitZ(Factor=1)
project_point = ProjectPoint(Point=flatten(sort_along_curve.Points), Direction=unit_z_2, Geometry=list_item_3)  # -> Point, Index
gene_pool_2 = GenePool(Decimals=3, Maximum=1, Minimum=0, Value=[0.164, 0.267, 0.379, 0.5, 0.56, 0.626, 0.699, 0.812, 0.935, 1])
clean_tree_3 = CleanTree(RemoveNulls=True, RemoveInvalid=True, RemoveEmpty=False, Tree=project_point.Point)
range = Range(Domain=Domain(0, 1), Steps=Slider(9, range=0..10))
sort_points_2 = SortPoints(Points=clean_tree_3)  # -> Points, Indices
interpolate_5 = Interpolate(Vertices=clean_tree_3, Degree=3, Periodic=False, KnotStyle=1)  # -> Curve, Length, Domain
graph_mapper = GraphMapper(
    range,
    x0=0,
    x1=1,
    y0=0,
    y1=1,
    container_name="Sine",
    Equation_px=[0, 0.3144938052],
    Equation_py=[0.03192579746, 0.3028988838])
pipe_variable = PipeVariable(Curve=reparameterize(interpolate_5.Curve), Parameters=gene_pool_2, Radii=graph_mapper, Caps=0)

number_slider_2 = Slider(5, range=3..5)

# ----
# - closest point and points
number_slider_3 = Slider(50, range=50..70)
panel_6 = Panel("4")
range_2 = Range(Domain=number_slider_3, Steps=number_slider_2)
rectangular_2 = Rectangular(Plane=PlaneXY(0, 0, 0), SizeX=number_slider_2, SizeY=number_slider_2, ExtentX=number_slider_2, ExtentY=number_slider_2)  # -> Cells, Points
md_slider = MDSlider(
    SliderMode=0,
    slider_value=Point(0.7218892167, 0.476214153, 0.5),
    x_domain=Domain(0, 1),
    y_domain=Domain(0, 1),
    z_domain=Domain(0, 1))
unit_z_3 = UnitZ(Factor=range_2)
surface = Surface(reparameterize(rectangular_2.Cells))
point_3 = Point(rectangular_2.Points)
evaluate_surface = EvaluateSurface(Surface=reparameterize(surface), Point=md_slider)  # -> Point, Normal, UDirection, VDirection, Frame
move_2 = Move(Geometry=graft(rectangular_2.Points), Motion=unit_z_3)  # -> Geometry, Transform
expression = Expression(x=number_slider_2, Expression="x+1")
bounding_box = BoundingBox(Content=flatten(move_2.Geometry), Plane=PlaneXY(0, 0, 0), UnionBox=True)  # -> Box, Box_2
move_3 = Move(Geometry=graft(evaluate_surface.Point), Motion=unit_z_3)  # -> Geometry, Transform
bounding_box_2 = BoundingBox(Content=flatten(move_3.Geometry), Plane=PlaneXY(0, 0, 0), UnionBox=True)  # -> Box, Box_2
populate_geometry = PopulateGeometry(Geometry=bounding_box.Box, Count=expression, Seed=Slider(33, range=0..100))
populate_geometry_2 = PopulateGeometry(Geometry=bounding_box_2.Box, Count=expression, Seed=Slider(36, range=0..100))
closest_points = ClosestPoints(Point=evaluate_surface.Point, Cloud=populate_geometry, Count=expression)  # -> ClosestPoint, CPIndex, Distance
closest_point = ClosestPoint(Point=move_3.Geometry, Cloud=populate_geometry_2)  # -> ClosestPoint, CPIndex, Distance
panel_7 = Panel("{0;*}[(0,2,...)]")
line_2 = Line(StartPoint=move_2.Geometry, EndPoint=closest_points.ClosestPoint)  # -> simplify(Line)
line_3 = Line(StartPoint=move_3.Geometry, EndPoint=closest_point.ClosestPoint)  # -> simplify(Line)
point_4 = Point(closest_points.ClosestPoint)
point_5 = Point(closest_point.ClosestPoint)
param_viewer_4 = ParamViewer(line_2)
split_tree_2 = SplitTree(Data=line_2, Masks=flatten("{(0,2,...);(1,3,...)}[(*)]"))  # -> Positive, Negative
clean_tree_4 = CleanTree(RemoveNulls=True, RemoveInvalid=True, RemoveEmpty=False, Tree=split_tree_2.Positive)
loft = Loft(Curves=clean_tree_4, Options={Adjust=False, Closed=False, LoftEnds=0, LoftSimp=0, LoftType=0, Rebuild=10, Refit=0.01})
bounding_box_3 = BoundingBox(Content=loft, Plane=PlaneXY(0, 0, 0))  # -> Box, Box_2
volume = Volume(Geometry=bounding_box_3.Box)  # -> Volume, Centroid
galapagos = Galapagos(fitness=volume, gene=number_slider_2)
