# Grasshopper definition EX_016_vector_vector.gh (Grasshopper 1.0.7)
# plug-ins: Bifocals

# ----
# - cross product and
# dot product
number_slider = Slider(3, range=0..10)
unit_x = UnitX(Factor=1)
unit_y = UnitY(Factor=1)
unit_z = UnitZ(Factor=1)
construct_point = ConstructPoint(XCoordinate=0, YCoordinate=0, ZCoordinate=0)
amplitude = Amplitude(Vector=[unit_x, unit_y, unit_z], Amplitude=number_slider)
explode_tree = ExplodeTree(Data=graft(amplitude))  # -> Branch0, Branch1, Branch2
pi = Pi(Factor=Slider(0, range=0..2))
explode_tree_2 = ExplodeTree(Data=graft(amplitude))  # -> Branch0, Branch1, Branch2
vector_display = VectorDisplay(Anchor=construct_point, Vector=amplitude)
rotate = Rotate(Vector=explode_tree.Branch0, Axis=explode_tree.Branch1, Angle=pi)
rotate_2 = Rotate(Vector=explode_tree.Branch1, Axis=explode_tree.Branch2, Angle=pi)
rotate_3 = Rotate(Vector=explode_tree.Branch2, Axis=explode_tree.Branch0, Angle=pi)
cross_product = CrossProduct(VectorA=explode_tree_2.Branch1, VectorB=explode_tree_2.Branch2, Unitize=False)  # -> Vector, Length
cross_product_2 = CrossProduct(VectorA=explode_tree_2.Branch0, VectorB=explode_tree_2.Branch1, Unitize=False)  # -> Vector, Length
cross_product_3 = CrossProduct(VectorA=explode_tree_2.Branch0, VectorB=explode_tree_2.Branch2, Unitize=False)  # -> Vector, Length
reverse = Reverse(Vector=rotate)
reverse_2 = Reverse(Vector=rotate_2)
reverse_3 = Reverse(Vector=rotate_3)
vector_display_2 = VectorDisplay(Anchor=construct_point, Vector=cross_product_3.Vector)
vector_display_3 = VectorDisplay(Anchor=construct_point, Vector=cross_product.Vector)
vector_display_4 = VectorDisplay(Anchor=construct_point, Vector=[explode_tree_2.Branch1, explode_tree_2.Branch2])
vector_length = VectorLength(Vector=cross_product.Vector)
dot_product = DotProduct(VectorA=explode_tree.Branch0, VectorB=rotate, Unitize=False)
dot_product_2 = DotProduct(VectorA=explode_tree.Branch1, VectorB=rotate_2, Unitize=False)
dot_product_3 = DotProduct(VectorA=explode_tree.Branch2, VectorB=rotate_3, Unitize=False)
angle = Angle(VectorA=explode_tree.Branch2, VectorB=rotate_3)  # -> Angle, Reflex
panel = Panel(vector_length)
panel_2 = Panel(cross_product.Length)
panel_3 = Panel(angle.Angle)
panel_4 = Panel(dot_product_2)
panel_5 = Panel(dot_product)
panel_6 = Panel(dot_product_3)
vector_display_5 = VectorDisplay(Anchor=construct_point, Vector=[rotate, rotate_2, rotate_3])

# ----
# - try creating vectors like points but be sure to
# visualize them
number_slider_2 = Slider(4, range=0..10)
# 016_vector_vector
number_slider_3 = Slider(2, range=0..10)
number_slider_4 = Slider(6, range=0..10)
vector_xyz = VectorXYZ(XComponent=number_slider_3, YComponent=number_slider_2, ZComponent=number_slider_4)  # -> Vector, Length
construct_point_2 = ConstructPoint(XCoordinate=number_slider_3, YCoordinate=number_slider_2, ZCoordinate=number_slider_4)
# EXERCISES_VECTOR
construct_point_3 = ConstructPoint(XCoordinate=0, YCoordinate=0, ZCoordinate=0)
deconstruct_vector = DeconstructVector(Vector=vector_xyz.Vector)  # -> XComponent, YComponent, ZComponent
deconstruct = Deconstruct(Point=vector_xyz.Vector)  # -> XComponent, YComponent, ZComponent
vector_2pt = Vector2Pt(PointA=construct_point_3, PointB=construct_point_2, Unitize=False)  # -> Vector, Length
unit_x_2 = UnitX(Factor=1)
unit_y_2 = UnitY(Factor=1)
unit_z_2 = UnitZ(Factor=1)
vector_2pt_2 = Vector2Pt(PointA=construct_point_3, PointB=construct_point_2, Unitize=Toggle(True))  # -> Vector, Length
unit_vector = UnitVector(Vector=vector_2pt.Vector)
amplitude_2 = Amplitude(Vector=unit_z_2, Amplitude=Slider(3, range=0..10))
vector_display_6 = VectorDisplay(Anchor=vector_2pt.Vector, Vector=vector_2pt.Vector)
vector_display_7 = VectorDisplay(Anchor=unit_vector, Vector=unit_vector)
vector_display_8 = VectorDisplay(Anchor=vector_2pt_2.Vector, Vector=vector_2pt_2.Vector)
vector_display_9 = VectorDisplay(Anchor=unit_z_2, Vector=amplitude_2)
vector_display_10 = VectorDisplay(Anchor=unit_x_2, Vector=unit_x_2)
vector_display_11 = VectorDisplay(Anchor=unit_y_2, Vector=unit_y_2)
