# Grasshopper definition EX_017_curve_analysis.gh (Grasshopper 1.0.7)

# ----
# - create a custom plate
number_slider = Slider(2, range=0..3)
range = Range(Domain=number_slider, Steps=Slider(100, range=0..100))
circle = Circle(Plane=PlaneXY(0, 0, 0), Radius=number_slider)
graph_mapper = GraphMapper(
    range,
    x0=0,
    x1=1,
    y0=0,
    y1=1,
    container_name="Bezier",
    cpx=[0, 0.2423520237, 0.2304347008, 1],
    cpy=[0, 0.5722799897, 0.8117648959, 1])
graph_mapper_2 = GraphMapper(range, x0=0, x1=1, y0=0, y1=1, container_name="Sine", Equation_px=[0, 0.2000002712], Equation_py=[0, 0.9347826242])
addition = Addition(A=number_slider, B=range)
construct_point = ConstructPoint(XCoordinate=addition, YCoordinate=graph_mapper_2, ZCoordinate=graph_mapper)
unit_z = UnitZ(Factor=1)
range_2 = Range(Domain="2.00", Steps=10)
interpolate = Interpolate(Vertices=construct_point, Degree=3, Periodic=False, KnotStyle=1)  # -> Curve, Length, Domain
line_sdl = LineSDL(Start=unit_z, Direction=unit_z, Length=1)
pi = Pi(Factor=range_2)
length = Length(Curve=interpolate.Curve)
rotate_axis = RotateAxis(Geometry=interpolate.Curve, Angle=pi, Axis=line_sdl)  # -> Geometry, Transform
construct_point_2 = ConstructPoint(XCoordinate=0, YCoordinate=0, ZCoordinate=Slider(6, range=0..100))
cull_index = CullIndex(List=rotate_axis.Geometry, Indices="-1", Wrap=True)
evaluate_curve = EvaluateCurve(Curve=reparameterize(cull_index), Parameter=Slider(0.44, range=0..1))  # -> Point, Tangent, Angle
curve_closest_point = CurveClosestPoint(Point=construct_point_2, Curve=cull_index)  # -> Point, Parameter, Distance
revolution = Revolution(Curve=interpolate.Curve, Axis=line_sdl, Domain=Domain(0, 6.283185307))
boundary_surfaces = BoundarySurfaces(Edges=circle)
rail_revolution = RailRevolution(Curve=interpolate.Curve, Rail=circle, Axis=line_sdl, Scale=False)
loft = Loft(
    Curves=flatten(cull_index),
    Options={Adjust=False, Closed=True, LoftEnds=0, LoftSimp=0, LoftType=0, Rebuild=10, Refit=0.01})
distance = Distance(PointA=curve_closest_point.Point, PointB=evaluate_curve.Point)
sphere = Sphere(Base=curve_closest_point.Point, Radius=distance)  # -> flatten(Sphere)
split_brep_multiple = SplitBrepMultiple(Brep=loft, Cutters=sphere)
list_item = ListItem(List=split_brep_multiple, Index=0, Wrap=True)
geometry = Geometry(list_item)
merge = Merge(Data1=boundary_surfaces, Data2=geometry)
deconstruct_brep = DeconstructBrep(Brep=geometry)  # -> Faces, Edges, Vertices
dispatch = Dispatch(List=deconstruct_brep.Faces, DispatchPattern=[True, False])  # -> ListA, ListB
surface = Surface(dispatch.ListB)
curve = Curve(deconstruct_brep.Edges)

# ----
# - the curve analysis nodes are very interesting
# - consider using the derivatives of a curve
# to explore new variations of geometries
polygon = Polygon(Plane=PlaneXY(0, 0, 0), Radius=3, Segments=6, FilletRadius=0)  # -> Polygon, Length
populate_2d = Populate2D(Region={Plane=PlaneXY(0, 0, 0), Size=Domain2(u=0..20, v=0..10)}, Count=100, Seed=1)
point_in_curves = PointInCurves(Point=populate_2d, Curves=polygon.Polygon)  # -> Relationship, Index, Point
polygon_center = PolygonCenter(Polyline=polygon.Polygon)  # -> CenterV, CenterE, CenterA
planar = Planar(Curve=polygon.Polygon)  # -> Planar, Plane, Deviation
cull_pattern = CullPattern(List=populate_2d, CullPattern=point_in_curves.Relationship)
range_3 = Range(Domain="6", Steps=Slider(3, range=0..10))
unit_z_2 = UnitZ(Factor=range_3)
move = Move(Geometry=cull_pattern, Motion=unit_z_2)  # -> Geometry, Transform
sort_points = SortPoints(Points=move.Geometry)  # -> Points, Indices
unit_x = UnitX(Factor=Slider(4, range=0..10))
nurbs_curve = NurbsCurve(Vertices=move.Geometry, Degree=3, Periodic=False)  # -> Curve, Length, Domain
move_2 = Move(Geometry=nurbs_curve.Curve, Motion=unit_x)  # -> Geometry, Transform
derivatives = Derivatives(Curve=reparameterize(move_2.Geometry), Parameter=Slider(0.81, range=0..1))  # -> Point, FirstDerivative, SecondDerivative
extremes = Extremes(Curve=nurbs_curve.Curve, Plane=planar.Plane)  # -> Highest, Lowest
control_points = ControlPoints(Curve=move_2.Geometry)  # -> Points, Weights, Knots
geometry_2 = Geometry(derivatives.FirstDerivative)
geometry_3 = Geometry(derivatives.SecondDerivative)
line = Line(StartPoint=extremes.Lowest, EndPoint=geometry_2)
line_2 = Line(StartPoint=extremes.Highest, EndPoint=geometry_3)
line_3 = Line(StartPoint=extremes.Highest, EndPoint=geometry_3)
line_4 = Line(StartPoint=extremes.Highest, EndPoint=geometry_2)
revolution_2 = Revolution(Curve=move_2.Geometry, Axis=line_2, Domain=Domain(0, 6.283185307))
revolution_3 = Revolution(Curve=move_2.Geometry, Axis=line_4, Domain=Domain(0, 6.283185307))
revolution_4 = Revolution(Curve=move_2.Geometry, Axis=line, Domain=Domain(0, 6.283185307))
revolution_5 = Revolution(Curve=move_2.Geometry, Axis=line_3, Domain=Domain(0, 6.283185307))

# ----
# 017_curves_analysis
# - create curve(s) in grasshopper
# - use some of your pervious learned skills
# to manipulate and create new geometries
extent_x = ExtentX(5)
# EXERCISES_CURVES
square = Square(Plane=PlaneXY(0, 0, 0), Size=1, ExtentX=extent_x, ExtentY=extent_x)  # -> Cells, simplify(Points)
param_viewer = ParamViewer(square.Points)
panel = Panel("{(1,3,...)}[(1to4)]")
split_tree = SplitTree(Data=square.Points, Masks=flatten("{(1,3,...)}[(1to4)]"))  # -> Positive, Negative
unit_z_3 = UnitZ(Factor="3")
point = Point(split_tree.Negative)
negative = Negative(Value=unit_z_3)
move_3 = Move(Geometry=split_tree.Positive, Motion=[unit_z_3, negative])  # -> Geometry, Transform
interpolate_2 = Interpolate(Vertices=[split_tree.Negative, move_3.Geometry], Degree=3, Periodic=False, KnotStyle=1)  # -> Curve, Length, Domain
split_tree_2 = SplitTree(Data=interpolate_2.Curve, Masks=flatten("{(0,2,4)}[]"))  # -> Positive, Negative
curve_2 = Curve(split_tree_2.Negative)
curve_3 = Curve(split_tree_2.Positive)
curve_middle = CurveMiddle(Curve=curve_3)
point_on_curve = PointOnCurve(curve_3, parameter=1)
end_points = EndPoints(Curve=curve_2)  # -> Start, End
end_points_2 = EndPoints(Curve=curve_3)  # -> Start, End
match_tree = MatchTree(Tree=end_points_2.End, Guide=end_points.Start)
merge_2 = Merge(Data1=end_points.End, Data2=end_points_2.End, Data3=end_points.Start)
number_slider_2 = Slider(0.38, range=0..1)
interpolate_3 = Interpolate(Vertices=flatten(merge_2), Degree=3, Periodic=False, KnotStyle=1)  # -> Curve, Length, Domain
perp_frame = PerpFrame(Curve=reparameterize(interpolate_3.Curve), Parameter=Slider(0.48, range=0..1))
perp_frame_2 = PerpFrame(Curve=reparameterize(interpolate_3.Curve), Parameter=number_slider_2)
horizontal_frame = HorizontalFrame(Curve=reparameterize(interpolate_3.Curve), Parameter=number_slider_2)
ellipse = Ellipse(Plane=perp_frame, Radius1=1, Radius2=Slider(0.92, range=0..1))  # -> Ellipse, Focus1, Focus2
ellipse_2 = Ellipse(Plane=perp_frame_2, Radius1=1, Radius2=Slider(0.3, range=0..1))  # -> Ellipse, Focus1, Focus2
sweep1 = Sweep1(Rail=interpolate_3.Curve, Sections=[ellipse_2.Ellipse, ellipse.Ellipse], Miter=1)
cap_holes = CapHoles(Brep=sweep1)
