# Grasshopper definition EX_018_curve_division.gh (Grasshopper 1.0.7)
# plug-ins: Kangaroo2 Components

# ----
# EXERCISES_CURVES
# 018_curve_division
# - create curve(s) in grasshopper
# - use some of your pervious learned skills
# to manipulate and create new geometries
number_slider = Slider(2, range=0..10)
range = Range(Domain=number_slider, Steps=Slider(62, range=0..100))
graph_mapper = GraphMapper(range, x0=0, x1=1, y0=0, y1=1, Ox=0.524131, Oy=0.4776169062, Px=0.7828506231, Py=0.4029797316, container_name="Parabola")
graph_mapper_2 = GraphMapper(
    range,
    x0=0,
    x1=1,
    y0=0,
    y1=1,
    container_name="Bezier",
    cpx=[0, 0.07102899998, 0.9158281088, 1],
    cpy=[0, 0.7121497989, 0, 0.4519710541])
addition = Addition(A=number_slider, B=graph_mapper)
construct_point = ConstructPoint(XCoordinate=addition, YCoordinate=graph_mapper_2, ZCoordinate=range)
interpolate = Interpolate(Vertices=construct_point, Degree=3, Periodic=False, KnotStyle=1)  # -> Curve, Length, Domain
domain = Domain(interpolate.Domain)
divide_domain = DivideDomain(Domain=domain, Count=Slider(4, range=0..10))  # -> flatten(Segments)
division = Division(A=interpolate.Length, B=Slider(4, range=0..10))
construct_point_2 = ConstructPoint(XCoordinate=0, YCoordinate=0, ZCoordinate=0)
end_points = EndPoints(Curve=interpolate.Curve)  # -> Start, End
panel = Panel(divide_domain)
distance = Distance(PointA=construct_point_2, PointB=end_points.Start)
divide_distance = DivideDistance(Curve=interpolate.Curve, Distance=division)  # -> Points, Tangents, Parameters
divide_length = DivideLength(Curve=interpolate.Curve, Length=division)  # -> Points, Tangents, Parameters
shatter = Shatter(Curve=interpolate.Curve, Parameters=divide_domain)
divide_curve = DivideCurve(Curve=interpolate.Curve, Count=10, Kinks=False)  # -> Points, Tangents, Parameters
circle = Circle(Plane=PlaneXY(0, 0, 0), Radius=distance)
list_item = ListItem(List=shatter, Index=0, Wrap=True)  # -> Item, Item1
unit_z = UnitZ(Factor=1)
curve = Curve(list_item.Item)
curve_2 = Curve(list_item.Item1)
line_sdl = LineSDL(Start=unit_z, Direction=unit_z, Length=1)
revolution = Revolution(Curve=curve, Axis=line_sdl, Domain=Domain(0, 6.283185307))
revolution_2 = Revolution(Curve=curve_2, Axis=line_sdl, Domain=Domain(0, 6.283185307))
surface = Surface(circle)
merge = Merge(Data1=revolution_2, Data2=revolution, Data3=surface)

# ----
# - curve frames are great for orienting geometry and robotic tool path control
number_slider_2 = Slider(6, range=0..10)
range_2 = Range(Domain=number_slider_2, Steps=Slider(5, range=0..10))
expression = Expression(x=range_2, Expression="cos(x^2)")
expression_2 = Expression(x=range_2, Expression="sin(x^2)")
construct_point_3 = ConstructPoint(XCoordinate=expression_2, YCoordinate=expression, ZCoordinate=range_2)
number_slider_3 = Slider(3, range=0..10)
interpolate_2 = Interpolate(Vertices=construct_point_3, Degree=3, Periodic=False, KnotStyle=1)  # -> Curve, Length, Domain
point_on_curve = PointOnCurve(interpolate_2.Curve, parameter=0.267)
perp_frames = PerpFrames(Curve=interpolate_2.Curve, Count=number_slider_3, Align=Toggle(True))  # -> Frames, Parameters
curve_frames = CurveFrames(Curve=interpolate_2.Curve, Count=number_slider_3)  # -> Frames, Parameters
horizontal_frames = HorizontalFrames(Curve=interpolate_2.Curve, Count=number_slider_3)  # -> Frames, Parameters
boolean_toggle = BooleanToggle(True)
orient = Orient(Geometry=interpolate_2.Curve, Source=point_on_curve, Target=horizontal_frames.Frames)  # -> Geometry, Transform
orient_2 = Orient(Geometry=interpolate_2.Curve, Source=point_on_curve, Target=curve_frames.Frames)  # -> Geometry, Transform
orient_3 = Orient(Geometry=interpolate_2.Curve, Source=point_on_curve, Target=perp_frames.Frames)  # -> Geometry, Transform
multipipe = MultiPipe(
    Curves=orient_2.Geometry,
    NodeSize=0.5,
    EndOffset=1,
    StrutSize=Slider(0.68, range=0..1),
    Segment=0,
    KinkAngle=0.6,
    CubeFit=0,
    Caps=boolean_toggle)
multipipe_2 = MultiPipe(
    Curves=orient_3.Geometry,
    NodeSize=0.5,
    EndOffset=1,
    StrutSize=Slider(0.57, range=0..1),
    Segment=0,
    KinkAngle=0.6,
    CubeFit=0,
    Caps=boolean_toggle)
multipipe_3 = MultiPipe(
    Curves=orient.Geometry,
    NodeSize=0.5,
    EndOffset=1,
    StrutSize=Slider(0.97, range=0..1),
    Segment=0,
    KinkAngle=0.6,
    CubeFit=0,
    Caps=boolean_toggle)

interpolate_3 = Interpolate(Vertices=divide_length.Points, Degree=3, Periodic=False, KnotStyle=1)  # -> Curve, Length, Domain
