# Grasshopper definition EX_020_curve_spline.gh (Grasshopper 1.0.7)
# plug-ins: Kangaroo2 Components, Bifocals

quad_sphere = QuadSphere(Base=PlaneXY(0, 0, 0), Radius=Slider(12, range=0..100))
md_slider = MDSlider(
    SliderMode=0,
    slider_value=Point(0.7588099038, 0.725054485, 0.5),
    x_domain=Domain(0, 1),
    y_domain=Domain(0, 1),
    z_domain=Domain(0, 1))
md_slider_2 = MDSlider(
    SliderMode=0,
    slider_value=Point(0.319955221, 0.7363072837, 0.5),
    x_domain=Domain(0, 1),
    y_domain=Domain(0, 1),
    z_domain=Domain(0, 1))
deconstruct_brep = DeconstructBrep(Brep=quad_sphere)  # -> Faces, Edges, Vertices
md_slider_3 = MDSlider(
    SliderMode=0,
    slider_value=Point(0.7925757431, 0.7981969322, 0.5),
    x_domain=Domain(0, 1),
    y_domain=Domain(0, 1),
    z_domain=Domain(0, 1))
curve_on_surface = CurveOnSurface(Surface=reparameterize(deconstruct_brep.Faces), UVCoordinates=[md_slider_2, md_slider, md_slider_3], Closed=Toggle(True))  # -> Curve, Length, Domain
surface_split = SurfaceSplit(Surface=deconstruct_brep.Faces, Curves=curve_on_surface.Curve)
dispatch = Dispatch(List=flatten(surface_split), DispatchPattern=[True, False])  # -> ListA, ListB
geometry = Geometry(dispatch.ListB)
geometry_2 = Geometry(dispatch.ListA)

# ----
# 020_curve_spline
# - create spline(s) in grasshopper
# - use some of your pervious learned skills
# to manipulate and create new geometries
number_slider = Slider(3, range=0..10)
# EXERCISES_CURVES
quad_sphere_2 = QuadSphere(Base=PlaneXY(0, 0, 0), Radius=1)
deconstruct_brep_2 = DeconstructBrep(Brep=quad_sphere_2)  # -> Faces, Edges, Vertices
panel = Panel("""4
5
6""")
number_slider_2 = Slider(4, range=0..10)
range = Range(Domain=Domain(0, 1), Steps=number_slider)
cull_index = CullIndex(List=deconstruct_brep_2.Faces, Indices=panel, Wrap=True)
construct_point = ConstructPoint(XCoordinate=range, YCoordinate=range, ZCoordinate=0)  # -> graft(Point)
populate_geometry = PopulateGeometry(Geometry=cull_index, Count=number_slider_2, Seed=number_slider_2)
interpolate = Interpolate(Vertices=populate_geometry, Degree=3, Periodic=False, KnotStyle=1)  # -> Curve, Length, Domain
iso_curve = IsoCurve(Surface=reparameterize(cull_index), UVPoint=construct_point)  # -> UIsocurve, VIsocurve
polyline = PolyLine(Vertices=populate_geometry, Closed=False)
nurbs_curve = NurbsCurve(Vertices=populate_geometry, Degree=3, Periodic=False)  # -> Curve, Length, Domain
explode_tree = ExplodeTree(Data=interpolate.Curve)  # -> _0000, _0001, _0002
curve = Curve(iso_curve.VIsocurve)
curve_2 = Curve(iso_curve.UIsocurve)
end_points = EndPoints(Curve=curve)  # -> Start, End
tween_curve = TweenCurve(CurveA=explode_tree._0001, CurveB=explode_tree._0002, Factor=0.5, BlendType=0)
tween_curve_2 = TweenCurve(CurveA=explode_tree._0000, CurveB=explode_tree._0002, Factor=0.5, BlendType=0)
tween_curve_3 = TweenCurve(CurveA=explode_tree._0000, CurveB=explode_tree._0001, Factor=0.5, BlendType=0)
vector_xyz = VectorXYZ(XComponent=0, YComponent=0, ZComponent=[Slider(-1, range=-1..1), Slider(1, range=-1..1)])  # -> Vector, Length
blend_curve = BlendCurve(CurveA=tween_curve_3, CurveB=tween_curve_2, BulgeA=1, BulgeB=1, Continuity=2)
blend_curve_2 = BlendCurve(CurveA=tween_curve_2, CurveB=tween_curve, BulgeA=1, BulgeB=1, Continuity=2)
blend_curve_3 = BlendCurve(CurveA=tween_curve_3, CurveB=tween_curve, BulgeA=1, BulgeB=1, Continuity=2)
number_slider_3 = Slider(0.09, range=0..1)
catenary = Catenary(PointA=end_points.Start, PointB=end_points.End, Length=Slider(3, range=0..10), Gravity=vector_xyz.Vector)
multipipe = MultiPipe(Curves=catenary, NodeSize=number_slider_3, EndOffset=1, StrutSize=1, Segment=0, KinkAngle=0.6, CubeFit=0, Caps=0)
multipipe_2 = MultiPipe(
    Curves=[blend_curve, blend_curve_3, blend_curve_2],
    NodeSize=number_slider_3,
    EndOffset=1,
    StrutSize=1,
    Segment=0,
    KinkAngle=0.6,
    CubeFit=0,
    Caps=0)
