# Grasshopper definition EX_021_curve_utility.gh (Grasshopper 1.0.7)

# ----
# 021_curve_utility
# - curve utility manipulates curves in many ways
number_slider = Slider(25, range=0..100)
quad_sphere = QuadSphere(Base=PlaneXY(0, 0, 0), Radius=number_slider)
quad_sphere_2 = QuadSphere(Base=PlaneXY(0, 0, 0), Radius=number_slider)
unit_z = UnitZ(Factor=1)
# EXERCISES_CURVES
polygon = Polygon(Plane=PlaneXY(0, 0, 0), Radius=number_slider, Segments=6, FilletRadius=0)  # -> Polygon, Length
deconstruct_brep = DeconstructBrep(Brep=quad_sphere)  # -> Faces, Edges, Vertices
fillet = Fillet(Curve=polygon.Polygon, Radius=Slider(5, range=0.1..10))
explode = Explode(Curve=polygon.Polygon, Recursive=True)  # -> Segments, Vertices
project = Project(Curve=graft(fillet), Brep=quad_sphere_2, Direction=unit_z)
point = Point(explode.Vertices)
curve = Curve(explode.Segments)
rebuild_curve = RebuildCurve(Curve=project, Count=10, Tangents=False)
param_viewer = ParamViewer(curve)
seam = Seam(Curve=reparameterize(rebuild_curve), Seam=Slider(1, range=0..1))  # -> flatten(Curve)
split_tree = SplitTree(Data=curve, Masks=flatten("{0;0}[(0,2,...)]"))  # -> Positive, Negative
number_slider_2 = Slider(5.63, range=0..10)
loft = Loft(Curves=seam, Options={Adjust=True, Closed=False, LoftEnds=0, LoftSimp=0, LoftType=0, Rebuild=10, Refit=0.01})
flip_curve = FlipCurve(Curve=split_tree.Positive)  # -> Curve, Flag
curve_2 = Curve(deconstruct_brep.Edges)
curve_3 = Curve(split_tree.Negative)
pull_curve = PullCurve(Curve=deconstruct_brep.Edges, Surface=loft)
clean_tree = CleanTree(RemoveNulls=True, RemoveInvalid=True, RemoveEmpty=False, Tree=flip_curve.Curve)
point_on_curve = PointOnCurve([flip_curve.Curve, split_tree.Negative], parameter=0.173)
unit_z_2 = UnitZ(Factor=number_slider_2)
clean_tree_2 = CleanTree(RemoveNulls=True, RemoveInvalid=True, RemoveEmpty=False, Tree=pull_curve)
offset_curve = OffsetCurve(Curve=clean_tree, Distance=number_slider_2, Corners=1)  # -> flatten(Curve)
curve_middle = CurveMiddle(Curve=clean_tree_2)
sphere = Sphere(Base=curve_middle, Radius=Slider(6.36, range=0..10))
move = Move(Geometry=offset_curve, Motion=unit_z_2)  # -> Geometry, Transform
split_brep_multiple = SplitBrepMultiple(Brep=loft, Cutters=sphere)
number_slider_3 = Slider(5, range=0..5)
list_item = ListItem(List=split_brep_multiple, Index=0, Wrap=True)
join_curves = JoinCurves(Curves=[split_tree.Negative, flip_curve.Curve], Preserve=False)
pipe = Pipe(Curve=join_curves, Radius=expr("x/3", number_slider_3), Caps=0)
sphere_2 = Sphere(Base=point_on_curve, Radius=number_slider_3)
loft_2 = Loft(
    Curves=[offset_curve, move.Geometry],
    Options={Adjust=True, Closed=True, LoftEnds=0, LoftSimp=0, LoftType=0, Rebuild=10, Refit=0.01})
