# Grasshopper definition EX_022_surface_analysis.gh (Grasshopper 1.0.7)
# plug-ins: Kangaroo2 Components

sphere = Sphere(Base=PlaneXY(0, 0, 0), Radius=Slider(10, range=0..100))
bounding_box = BoundingBox(Content=sphere, Plane=PlaneXY(0, 0, 0), UnionBox=True)  # -> Box, Box_2
populate_3d = Populate3D(Region=bounding_box.Box, Count=Slider(40, range=0..100), Seed=Slider(431, range=0..1000))
point_in_breps = PointInBreps(Brep=sphere, Point=populate_3d, Strict=False)  # -> Inside, Index
cull_pattern = CullPattern(List=populate_3d, CullPattern=point_in_breps.Inside)
cull_pattern_2 = CullPattern(List=populate_3d, CullPattern=point_in_breps.Index)
shortest_list = ShortestList(ListListA=cull_pattern, ListListB=cull_pattern_2, TrimMode=2)  # -> ListListA, ListListB
sort_points = SortPoints(Points=shortest_list.ListListA)  # -> Points, Indices
sort_points_2 = SortPoints(Points=shortest_list.ListListB)  # -> Points, Indices
line = Line(StartPoint=sort_points.Points, EndPoint=sort_points_2.Points)
multipipe = MultiPipe(
    Curves=line,
    NodeSize=Slider(2.15, range=0..10),
    EndOffset=1,
    StrutSize=1,
    Segment=0,
    KinkAngle=0.6,
    CubeFit=0,
    Caps=Slider(2, range=0..2))

# ----
# EXERCISES_SURFACE
# 022_surface_analysis
# - MVP debrep node
number_slider = Slider(14, range=0..100)
quad_sphere = QuadSphere(Base=PlaneXY(0, 0, 0), Radius=number_slider)
deconstruct_brep = DeconstructBrep(Brep=quad_sphere)  # -> Faces, Edges, Vertices
surface = Surface(reparameterize(deconstruct_brep.Faces))
point = Point(deconstruct_brep.Vertices)
curve = Curve(deconstruct_brep.Edges)
area = Area(Geometry=surface)  # -> Area, Centroid
volume = Volume(Geometry=quad_sphere)  # -> Volume, Centroid
list_length = ListLength(List=surface)
point_2 = Point(area.Centroid)
point_3 = Point(volume.Centroid)
expression = Expression(x=list_length, Expression="x-1")
construct_domain = ConstructDomain(DomainStart=Slider(0.2, range=0..1), DomainEnd=Slider(0.8, range=0..1))
range = Range(Domain=construct_domain, Steps=expression)
construct_point = ConstructPoint(XCoordinate=graft(range), YCoordinate=Slider(0.461, range=0..1), ZCoordinate=0)
evaluate_surface = EvaluateSurface(Surface=reparameterize(flatten(surface)), Point=construct_point)  # -> Point, Normal, UDirection, VDirection, Frame

deconstruct_brep_2 = DeconstructBrep(Brep=quad_sphere)  # -> Faces, Edges, Vertices
param_viewer = ParamViewer(deconstruct_brep_2.Faces)
populate_geometry = PopulateGeometry(Geometry=quad_sphere, Count=Slider(4, range=0..10), Seed=Slider(89, range=0..100))
split_tree = SplitTree(Data=deconstruct_brep_2.Faces, Masks=flatten("{0;*}[(1,3,...)]"))  # -> Positive, Negative
surface_2 = Surface(split_tree.Positive)
surface_3 = Surface(split_tree.Negative)
brep_closest_point = BrepClosestPoint(Point=populate_geometry, Brep=quad_sphere)  # -> Point, Normal, Distance
clean_tree = CleanTree(RemoveNulls=True, RemoveInvalid=True, RemoveEmpty=False, Tree=surface_3)
clean_tree_2 = CleanTree(RemoveNulls=True, RemoveInvalid=True, RemoveEmpty=False, Tree=surface_2)
surface_closest_point = SurfaceClosestPoint(Point=populate_geometry, Surface=clean_tree_2)  # -> Point, UVPoint, Distance
surface_closest_point_2 = SurfaceClosestPoint(Point=populate_geometry, Surface=clean_tree)  # -> Point, UVPoint, Distance
cull_duplicates = CullDuplicates(Points=brep_closest_point.Point, Tolerance=0.1, CullMode=3)  # -> Points, Indices, Valence
cull_duplicates_2 = CullDuplicates(Points=surface_closest_point_2.Point, Tolerance=0.1, CullMode=3)  # -> Points, Indices, Valence
cull_duplicates_3 = CullDuplicates(Points=surface_closest_point.Point, Tolerance=0.1, CullMode=3)  # -> Points, Indices, Valence
sort_points_3 = SortPoints(Points=cull_duplicates.Points)  # -> Points, Indices
sort_points_4 = SortPoints(Points=cull_duplicates_3.Points)  # -> Points, Indices
sort_points_5 = SortPoints(Points=cull_duplicates_2.Points)  # -> Points, Indices
interpolate = Interpolate(Vertices=sort_points_5.Points, Degree=3, Periodic=False, KnotStyle=1)  # -> Curve, Length, Domain
interpolate_2 = Interpolate(Vertices=sort_points_3.Points, Degree=3, Periodic=False, KnotStyle=1)  # -> Curve, Length, Domain
interpolate_3 = Interpolate(Vertices=sort_points_4.Points, Degree=3, Periodic=False, KnotStyle=1)  # -> Curve, Length, Domain
number_slider_2 = Slider(6, range=0..10)
loft = Loft(
    Curves=[interpolate_3.Curve, interpolate.Curve],
    Options={Adjust=False, Closed=False, LoftEnds=0, LoftSimp=0, LoftType=0, Rebuild=10, Refit=0.01})
divide_domain² = DivideDomain²(Domain=loft, UCount=number_slider_2, VCount=number_slider_2)
md_slider = MDSlider(
    SliderMode=0,
    slider_value=Point(0.5677296708, 0.5262592595, 0.5),
    x_domain=Domain(0, 1),
    y_domain=Domain(0, 1),
    z_domain=Domain(0, 1))
isotrim = Isotrim(Surface=loft, Domain=divide_domain²)
evaluate_surface_2 = EvaluateSurface(Surface=reparameterize(isotrim), Point=md_slider)  # -> Point, Normal, UDirection, VDirection, Frame
plane = Plane(evaluate_surface_2.Frame)

# ----
# - consider naked edges on breps and surfaces
brep_edges = BrepEdges(Brep=quad_sphere)  # -> Naked, Interior, NonManifold
curve_2 = Curve(brep_edges.Naked)
curve_3 = Curve(brep_edges.Interior)
brep_edges_2 = BrepEdges(Brep=surface)  # -> Naked, Interior, NonManifold
curve_4 = Curve(brep_edges_2.Naked)
