# Grasshopper definition EX_025_surface_subD.gh (Grasshopper 1.0.7)
# plug-ins: Kangaroo2 Components, Bifocals

# ----
# EXERCISES_SURFACE
# 025_surface_subD
# - new to Rhino7, very interesting substitution
# for pipe and variable pipe nodes
number_slider = Slider(10, range=0..10)
extent_x = ExtentX(5)
square = Square(Plane=PlaneXY(0, 0, 0), Size=number_slider, ExtentX=extent_x, ExtentY=extent_x)  # -> simplify(Cells), Points
curve = Curve(square.Cells)
split_tree = SplitTree(Data=curve, Masks=flatten("{(1to3)}[(1to3)]"))  # -> Positive, Negative
clean_tree = CleanTree(RemoveNulls=True, RemoveInvalid=True, RemoveEmpty=False, Tree=split_tree.Positive)
curve_2 = Curve(clean_tree)
split_tree_2 = SplitTree(Data=curve_2, Masks=flatten("{(2)}[(1)]"))  # -> Positive, Negative
range = Range(Domain=Slider(24, range=0..100), Steps="2")
clean_tree_2 = CleanTree(RemoveNulls=True, RemoveInvalid=True, RemoveEmpty=False, Tree=split_tree_2.Positive)
unit_z = UnitZ(Factor=range)  # -> graft(UnitVector)
curve_3 = Curve(clean_tree_2)
entwine = Entwine(Branch00=split_tree.Negative, Branch01=split_tree_2.Negative, Branch02=curve_3, FlattenInputs=True)
move = Move(Geometry=entwine, Motion=unit_z)  # -> simplify(Geometry), Transform
brep_edges = BrepEdges(Brep=move.Geometry)  # -> Naked, Interior, NonManifold
boundary_surfaces = BoundarySurfaces(Edges=move.Geometry)
curve_4 = Curve(brep_edges.Naked)
curve_5 = Curve(curve_4)

mp = MultiPipe(
    Curves=curve_5,
    NodeSize=Slider(2.08, range=0..10),
    EndOffset=Slider(1, range=0..1),
    StrutSize=Slider(1.52, range=0..10),
    Segment=0,
    KinkAngle=Slider(1, range=0..1),
    CubeFit=Slider(1, range=0..2))

mesh_from_subd = MeshFromSubD(SubD=mp, Density=2)
subd_control_polygon = SubDControlPolygon(SubD=mp)
subd_edges = SubDEdges(SubD=mp, NewFormatting=False)  # -> Line, Edge, Tag, Id
area = Area(Geometry=mp)  # -> Area, Centroid
subd_from_mesh = SubDFromMesh(Mesh=mesh_from_subd, Creases=Slider(1, range=0..10), Corners=1, Interpolate=Toggle(False))
curve_6 = Curve(subd_edges.Edge)
curve_7 = Curve(subd_edges.Line)
text_tag_3d = TextTag3D(Location=curve_7, Text=subd_edges.Id, Size=1, Justification=7)
scale = Scale(Geometry=mp, Center=area.Centroid, Factor=Slider(0.92, range=0..1))  # -> Geometry, Transform
subd_fuse = SubDFuse(SubDA=mp, SubDB=scale.Geometry, BooleanOption=Slider(3, range=0..3), Smoothing=10)
