# Grasshopper definition EX_026_mesh_analysis.gh (Grasshopper 1.0.7)
# plug-ins: MeshEdit Components, Bifocals

# ----
# EXERCISES_MESH
# 026_mesh_analysis
# - download mesh edit plugin for these scripts (Mesh credit: Daniel Christev)
number_slider = Slider(40, range=0..100)
number_slider_2 = Slider(100, range=0..100)
range = Range(Domain=number_slider, Steps=number_slider_2)
sine = Sine(Value=range)
multiplication = Multiplication(A=sine, B=Slider(4, range=0..5))
construct_point = ConstructPoint(XCoordinate=graft(range), YCoordinate=range, ZCoordinate=multiplication)
surface_from_points = SurfaceFromPoints(Points=flatten(construct_point), UCount=expr("x+1", number_slider_2), Interpolate=False)
surface = Surface(surface_from_points)
area = Area(Geometry=surface)  # -> Area, Centroid
dimensions = Dimensions(Surface=surface)  # -> UDimension, VDimension
number_slider_3 = Slider(8, range=0..100)
division = Division(A=dimensions.UDimension, B=dimensions.VDimension)
scale = Scale(Geometry=surface, Center=area.Centroid, Factor=Slider(1.679, range=0..5))  # -> Geometry, Transform
md_slider = MDSlider(
    SliderMode=0,
    slider_value=Point(0.3293066257, 0.1750704137, 0.5),
    x_domain=Domain(0, 1),
    y_domain=Domain(0, 1),
    z_domain=Domain(0, 1))
multiplication_2 = Multiplication(A=division, B=number_slider_3)
integer = Integer(multiplication_2)
md_slider_2 = MDSlider(
    SliderMode=0,
    slider_value=Point(0.8409744175, 0.1271513659, 0.5),
    x_domain=Domain(0, 1),
    y_domain=Domain(0, 1),
    z_domain=Domain(0, 1))
divide_surface = DivideSurface(Surface=surface, UCount=integer, VCount=number_slider_3)  # -> flatten(Points), Normals, Parameters
md_slider_3 = MDSlider(
    SliderMode=0,
    slider_value=Point(0.1948275682, 0.7902063509, 0.5),
    x_domain=Domain(0, 1),
    y_domain=Domain(0, 1),
    z_domain=Domain(0, 1))
evaluate_surface = EvaluateSurface(Surface=reparameterize(scale.Geometry), Point=[md_slider_3, md_slider, md_slider_2])  # -> Point, Normal, UDirection, VDirection, Frame
distance = Distance(PointA=graft(evaluate_surface.Point), PointB=divide_surface.Points)
point = Point(divide_surface.Points)
expression = Expression(w=flatten(Slider(0.243, range=0..2)), t=distance, Expression="sin(2*w^2*t)")
flip_matrix = FlipMatrix(Data=expression)
ma = MassMultiplication(Input=flip_matrix)  # -> flatten(Result), PartialResults
multiplication_3 = Multiplication(A=Slider(7.333, range=0..10), B=ma.Result)
unit_z = UnitZ(Factor=multiplication_3)
move = Move(Geometry=divide_surface.Points, Motion=unit_z)  # -> Geometry, Transform
expression_2 = Expression(u=integer, Expression="u+1")
mesh_frompoints = MeshFromPoints(
    Points=move.Geometry,
    UDirection=expr("x+1", integer),
    VDirection=expr("x+1", number_slider_3),
    Colour=ColourSwatch(SwatchColor=RGB(236, 45, 255)))
surface_from_points_2 = SurfaceFromPoints(Points=move.Geometry, UCount=expression_2, Interpolate=False)
surface_2 = Surface(surface_from_points_2)
mesh = Mesh(mesh_frompoints)

# ----
# - CTRL-M toggles mesh edges on and off
# - bake and repair mesh in rhino
number_slider_4 = Slider(44, range=0..100)
boolean_toggle = BooleanToggle(False)
mesh_2 = Mesh(surface_2)
bounding_box = BoundingBox(Content=mesh_2, Plane=PlaneXY(0, 0, 0))  # -> Box, Box_2
populate_2d = Populate2D(Region=bounding_box.Box, Count=number_slider_4, Seed=Slider(30, range=0..100))
mesh_3 = Mesh(mesh)
face_normals = FaceNormals(Mesh=mesh_2)  # -> Centers, Normals
mesh_convertquads = MeshConvertQuads(Mesh=mesh_2, ShortDiagonal=boolean_toggle)  # -> Mesh, Split
mesh_edges = MeshEdges(Mesh=mesh_2)  # -> NakedEdges, InteriorEdges, NonManifoldEdges
mesh_triangulate = MeshTriangulate(Mesh=mesh_2, ShortDiagonal=boolean_toggle)
mesh_area = MeshArea(Mesh=mesh_2)  # -> Area, Centroid
mesh_closest_point = MeshClosestPoint(Point=populate_2d, Mesh=mesh_2)  # -> Point, Index, Parameter
bounding_box_2 = BoundingBox(Content=mesh_3, Plane=PlaneXY(0, 0, 0))  # -> Box, Box_2
mesh_addattributes = MeshAddAttributes(Mesh=mesh_2, Clear=False)  # -> RuntimeMessage, Mesh
data_recorder = DataRecorder(mesh_closest_point.Parameter, DataLimit=-10, RecordData=True)
mesh_box = MeshBox(Base=bounding_box_2.Box, XCount=10, YCount=10, ZCount=10)
amplitude = Amplitude(Vector=face_normals.Normals, Amplitude=Slider(12, range=0..100))
point_2 = Point(mesh_area.Centroid)
sphere = Sphere(Base=face_normals.Centers, Radius=1)
line = Line(StartPoint=populate_2d, EndPoint=mesh_closest_point.Point)
mesh_4 = Mesh(mesh_convertquads.Mesh)
mesh_5 = Mesh(mesh_triangulate)
line_2 = Line(mesh_edges.NakedEdges)
line_3 = Line(mesh_edges.NonManifoldEdges)
line_4 = Line(mesh_edges.InteriorEdges)
mesh_eval = MeshEval(Mesh=mesh_2, Parameter=data_recorder)  # -> Point, Normal, Colour
panel = Panel(mesh_addattributes.RuntimeMessage)
panel_2 = Panel(mesh_convertquads.Split)
mesh_6 = Mesh(mesh_addattributes.Mesh)
galapagos = Galapagos()
mesh_split = MeshSplit(Mesh=mesh_box, Splitters=mesh_3)
panel_3 = Panel(mesh_closest_point.Parameter)
vector_display = VectorDisplay(Anchor=face_normals.Centers, Vector=amplitude)
mesh_nakededge = MeshNakedEdge(Mesh=mesh_2)  # -> V, A, B
point_3 = Point(mesh_eval.Point)
dispatch = Dispatch(List=mesh_split, DispatchPattern=[True, False])  # -> ListA, ListB
vector_display_2 = VectorDisplay(Anchor=point_3, Vector=mesh_eval.Normal)
panel_4 = Panel(mesh_nakededge.A)
point_4 = Point(mesh_nakededge.V)
panel_5 = Panel(mesh_nakededge.B)
mesh_7 = Mesh(mesh_3)
mesh_8 = Mesh(dispatch.ListB)
mesh_9 = Mesh(surface_2)
construct_point_2 = ConstructPoint(XCoordinate=0, YCoordinate=0, ZCoordinate=0)
mesh_sphere = MeshSphere(Base=PlaneXY(0, 0, 0), Radius=10, UCount=10, VCount=20)
deconstruct_mesh = DeconstructMesh(Mesh=mesh_9)  # -> Vertices, Faces, Colours, Normals
mesh_explode = MeshExplode(Mesh=mesh_9, Interpolate=Toggle(True))
mesh_inclusion = MeshInclusion(Mesh=mesh_sphere, Point=construct_point_2, Strict=False)
deconstruct_face = DeconstructFace(Face=deconstruct_mesh.Faces)  # -> CornerA, CornerB, CornerC, CornerD
face_boundaries = FaceBoundaries(Mesh=mesh_explode)
panel_7 = Panel(mesh_inclusion)
boundary_surfaces = BoundarySurfaces(Edges=face_boundaries)
panel_8 = Panel(deconstruct_face.CornerA)
curve = Curve(face_boundaries)
panel_9 = Panel(deconstruct_face.CornerB)
panel_10 = Panel(deconstruct_face.CornerC)
panel_11 = Panel(deconstruct_face.CornerD)

mesh_10 = Mesh(dispatch.ListA)

mesh_join = MeshJoin(Meshes=flatten(mesh_10))

triangulate = Triangulate(Mesh=mesh_join)  # -> Mesh, Count
quadrangulate = Quadrangulate(Mesh=mesh_join, Angle=0.03490658504, Ratio=0.875)  # -> Mesh, Count
