# Grasshopper definition EX_027_mesh_primitive.gh (Grasshopper 1.0.7)

# ----
# 027_mesh_primitive
mesh_plane = MeshPlane(Boundary={Plane=PlaneXY(0, 0, 0), Size=Domain2(u=-10..10, v=-10..10)}, WidthCount=10, HeightCount=10)  # -> Mesh, Area
# EXERCISES_MESH
mesh_box = MeshBox(Base={Plane=PlaneXY(0, 0, 0), X=Domain(-10, 10), Y=Domain(-10, 10), Z=Domain(-10, 10)}, XCount=10, YCount=10, ZCount=10)
mesh_sphere = MeshSphere(Base=PlaneXY(0, 0, 0), Radius=10, UCount=10, VCount=20)
mesh_sphere_ex = MeshSphereEx(Base=PlaneXY(0, 0, 0), Radius=10, Count=5)
deconstruct_mesh = DeconstructMesh(Mesh=mesh_sphere_ex)  # -> Vertices, Faces, Colours, Normals
construct_mesh = ConstructMesh(Vertices=deconstruct_mesh.Vertices, Faces=deconstruct_mesh.Faces, Colours=ColourSwatch(SwatchColor=RGB(24, 247, 255)))
deconstruct_face = DeconstructFace(Face=deconstruct_mesh.Faces)  # -> CornerA, CornerB, CornerC, CornerD
mesh_triangle = MeshTriangle(CornerA=deconstruct_face.CornerA, CornerB=deconstruct_face.CornerB, CornerC=deconstruct_face.CornerC)
mesh_quad = MeshQuad(
    CornerA=deconstruct_face.CornerA,
    CornerB=deconstruct_face.CornerB,
    CornerC=deconstruct_face.CornerC,
    CornerD=deconstruct_face.CornerD)
construct_mesh_2 = ConstructMesh(Vertices=deconstruct_mesh.Vertices, Faces=mesh_triangle, Colours=ColourSwatch(SwatchColor=RGB(223, 122, 255)))
point = Point([<point referenced from the Rhino model> x4])
colours = Colours([RGB(127, 255, 0), RGB(0, 100, 0), RGB(34, 139, 34), RGB(124, 252, 0), RGB(154, 205, 50), RGB(173, 255, 47), RGB(50, 205, 50), RGB(152, 251, 152)])
mesh_spray = MeshSpray(
    Mesh=construct_mesh_2,
    Points=point,
    Colours=[ColourSwatch(SwatchColor=RGB(0, 255, 255)), ColourSwatch(SwatchColor=RGB(223, 122, 255)), ColourSwatch(SwatchColor=RGB(255, 255, 0)), ColourSwatch(SwatchColor=RGB(255, 0, 0))],
    SprayMode=11)
mesh_colours = MeshColours(Mesh=construct_mesh_2, Colours=colours)
panel = Panel(colours)
