# Grasshopper definition EX_028_mesh_triangulation.gh (Grasshopper 1.0.7)

# ----
# EXERCISES_MESH
# 028_mesh_triangulation
# - mesh from points
# - intro to voronoi, metaball, octree, etc...
# - see section 3 for plugin details like
# weaverbird and coccoon
number_slider = Slider(26, range=0..100)
number_slider_2 = Slider(12, range=0..100)
number_slider_3 = Slider(26, range=0..100)
number_slider_4 = Slider(26, range=0..100)
number_slider_5 = Slider(26, range=0..100)
number_slider_6 = Slider(26, range=0..100)
number_slider_7 = Slider(26, range=0..100)
center_box = CenterBox(Base=PlaneXY(0, 0, 0), X=number_slider, Y=number_slider, Z=number_slider)
center_box_2 = CenterBox(Base=PlaneXY(0, 0, 0), X=number_slider_5, Y=number_slider_5, Z=number_slider_5)
center_box_3 = CenterBox(Base=PlaneXY(0, 0, 0), X=number_slider_6, Y=number_slider_6, Z=number_slider_6)
center_box_4 = CenterBox(Base=PlaneXY(0, 0, 0), X=number_slider_3, Y=number_slider_3, Z=number_slider_3)
center_box_5 = CenterBox(Base=PlaneXY(0, 0, 0), X=number_slider_4, Y=number_slider_4, Z=number_slider_4)
center_box_6 = CenterBox(Base=PlaneXY(0, 0, 0), X=number_slider_7, Y=number_slider_7, Z=number_slider_7)
populate_3d = Populate3D(Region=center_box, Count=Slider(10, range=0..100), Seed=number_slider_2)
populate_3d_2 = Populate3D(Region=center_box_2, Count=Slider(10, range=0..100), Seed=number_slider_2)
populate_3d_3 = Populate3D(Region=center_box_3, Count=Slider(8, range=0..100), Seed=number_slider_2)
populate_3d_4 = Populate3D(Region=center_box_5, Count=Slider(71, range=0..100), Seed=number_slider_2)
populate_3d_5 = Populate3D(Region=center_box_6, Count=Slider(56, range=0..100), Seed=number_slider_2)
populate_3d_6 = Populate3D(Region=center_box_4, Count=Slider(71, range=0..100), Seed=number_slider_2)
deconstruct = Deconstruct(Point=populate_3d_6)  # -> XComponent, YComponent, ZComponent
absolute = Absolute(Value=deconstruct.XComponent)
polygon = Polygon(Plane=PlaneXY(0, 0, 0), Radius=Slider(37, range=0..100), Segments="4", FilletRadius=0)  # -> Polygon, Length
multiplication = Multiplication(A=Slider(0.344, range=0..1), B=absolute)
construct_point = ConstructPoint(XCoordinate=0, YCoordinate=0, ZCoordinate=0)
xy_plane = XYPlane(Origin=Point(0, 0, 0))
delaunay_edges = DelaunayEdges(Points=populate_3d, Plane=PlaneXY(0, 0, 0))  # -> Connectivity, Edges
delaunay_edges_2 = DelaunayEdges(Points=populate_3d_2, Plane=PlaneXY(0, 0, 0))  # -> Connectivity, Edges
metaball_t = MetaBallT(Points=populate_3d_6, Plane=PlaneXY(0, 0, 0), Threshold=Slider(0.12, range=0..1))
metaball_t_custom = MetaBallTCustom(Points=populate_3d_6, Charge=multiplication, Plane=PlaneXY(0, 0, 0), Threshold=0.5)
voronoi_3d = Voronoi3D(Points=populate_3d_3)  # -> Cells, Boundary
octree = OcTree(Points=populate_3d_4, Square=Toggle(False), Group=Slider(7, range=0..10))  # -> Boxes, Points
voronoi = Voronoi(Points=populate_3d_3, Boundary=polygon.Polygon, Plane=xy_plane, BruteForceOverride=False)
convex_hull = ConvexHull(Points=populate_3d_5, Plane=PlaneXY(0, 0, 0))  # -> Hull, HullZ, Indices
metaball = MetaBall(Points=populate_3d_6, Plane=PlaneXY(0, 0, 0), Point=construct_point)
delaunay_mesh = DelaunayMesh(Points=populate_3d, Plane=PlaneXY(0, 0, 0))
delaunay_mesh_2 = DelaunayMesh(Points=populate_3d_2, Plane=PlaneXY(0, 0, 0))
curve = Curve(convex_hull.Hull)
curve_2 = Curve(convex_hull.HullZ)
