# Grasshopper definition EX_029_mesh_utilities.gh (Grasshopper 1.0.7)
# plug-ins: MeshEdit Components

# ----
# EXERCISES_MESH
# 029_mesh_utilities
number_slider = Slider(40, range=0..100)
number_slider_2 = Slider(100, range=0..100)
range = Range(Domain=number_slider, Steps=number_slider_2)
sine = Sine(Value=range)
multiplication = Multiplication(A=sine, B=Slider(4, range=0..5))
construct_point = ConstructPoint(XCoordinate=graft(range), YCoordinate=range, ZCoordinate=multiplication)
surface_from_points = SurfaceFromPoints(Points=flatten(construct_point), UCount=expr("x+1", number_slider_2), Interpolate=False)
surface = Surface(surface_from_points)
area = Area(Geometry=surface)  # -> Area, Centroid
dimensions = Dimensions(Surface=surface)  # -> UDimension, VDimension
number_slider_3 = Slider(8, range=0..100)
division = Division(A=dimensions.UDimension, B=dimensions.VDimension)
scale = Scale(Geometry=surface, Center=area.Centroid, Factor=Slider(1.679, range=0..5))  # -> Geometry, Transform
md_slider = MDSlider(
    SliderMode=0,
    slider_value=Point(0.4951607309, 0.2414119069, 0.5),
    x_domain=Domain(0, 1),
    y_domain=Domain(0, 1),
    z_domain=Domain(0, 1))
multiplication_2 = Multiplication(A=division, B=number_slider_3)
integer = Integer(multiplication_2)
divide_surface = DivideSurface(Surface=surface, UCount=integer, VCount=number_slider_3)  # -> flatten(Points), Normals, Parameters
md_slider_2 = MDSlider(
    SliderMode=0,
    slider_value=Point(0.2752598992, 0.4902840726, 0.5),
    x_domain=Domain(0, 1),
    y_domain=Domain(0, 1),
    z_domain=Domain(0, 1))
point = Point(divide_surface.Points)
md_slider_3 = MDSlider(
    SliderMode=0,
    slider_value=Point(0.5662145847, 0.3168701544, 0.5),
    x_domain=Domain(0, 1),
    y_domain=Domain(0, 1),
    z_domain=Domain(0, 1))
evaluate_surface = EvaluateSurface(Surface=reparameterize(scale.Geometry), Point=[md_slider_3, md_slider, md_slider_2])  # -> Point, Normal, UDirection, VDirection, Frame
distance = Distance(PointA=graft(evaluate_surface.Point), PointB=divide_surface.Points)
expression = Expression(w=flatten(Slider(0.243, range=0..2)), t=distance, Expression="sin(2*w^2*t)")
flip_matrix = FlipMatrix(Data=expression)
ma = MassMultiplication(Input=flip_matrix)  # -> flatten(Result), PartialResults
multiplication_3 = Multiplication(A=Slider(7.333, range=0..10), B=ma.Result)
unit_z = UnitZ(Factor=multiplication_3)
move = Move(Geometry=divide_surface.Points, Motion=unit_z)  # -> Geometry, Transform
expression_2 = Expression(u=integer, Expression="u+1")
mesh_frompoints = MeshFromPoints(
    Points=move.Geometry,
    UDirection=expr("x+1", integer),
    VDirection=expr("x+1", number_slider_3),
    Colour=ColourSwatch(SwatchColor=RGB(236, 45, 255)))
surface_from_points_2 = SurfaceFromPoints(Points=move.Geometry, UCount=expression_2, Interpolate=False)

# ----
# - brep to mesh
brep = Brep(surface_from_points_2)
brep_2 = Brep(surface_from_points_2)
number_slider_4 = Slider(7, range=0..100)
mesh_brep = MeshBrep(
    Brep=brep,
    Settings={GridMaxCount=0, GridMinCount=16, JaggedSeams=False, MaxEdgeLength=0, MinEdgeLength=0.0001, MinTolerance=0, Refine=True, RefineAngle=0, RelativeTolerance=0.65, SimplePlanes=True, Tolerance=0})
simple_mesh = SimpleMesh(Brep=brep)
surface_2 = Surface(brep_2)
flip_mesh = FlipMesh(Mesh=simple_mesh, VertexNormals=Toggle(True), FaceNormals=Toggle(True), FaceOrientation=Toggle(True))
mesh_unifynormals = MeshUnifyNormals(Mesh=mesh_brep)
mesh_surface = MeshSurface(Surface=surface_2, UCount=number_slider_4, VCount=number_slider_4, Overhang=True, Equalize=False)
mesh_brep_2 = MeshBrep(
    Brep=brep_2,
    Settings={GridMaxCount=0, GridMinCount=16, JaggedSeams=False, MaxEdgeLength=0, MinEdgeLength=0.0001, MinTolerance=0, Refine=True, RefineAngle=0, RelativeTolerance=0.65, SimplePlanes=True, Tolerance=0})
number_slider_5 = Slider(7, range=0..10)
triangulate = Triangulate(Mesh=mesh_unifynormals)  # -> Mesh, Count
quadrangulate = Quadrangulate(Mesh=mesh_unifynormals, Angle=0.03490658504, Ratio=0.875)  # -> Mesh, Count
deconstruct_mesh = DeconstructMesh(Mesh=mesh_brep_2)  # -> Vertices, Faces, Colours, Normals
mesh_flip = MeshFlip(Mesh=flip_mesh)
mesh_weldvertices = MeshWeldVertices(Mesh=[mesh_unifynormals, mesh_flip], Tolerance=0.01)  # -> RuntimeMessage, Mesh
list_length = ListLength(List=deconstruct_mesh.Vertices)
list_length_2 = ListLength(List=deconstruct_mesh.Faces)
division_2 = Division(A=list_length, B=number_slider_5)
panel = Panel(mesh_weldvertices.RuntimeMessage)
range_2 = Range(Domain=list_length_2, Steps=Slider(713, range=0..1000))
series = Series(Start=0, Step=number_slider_5, Count=division_2)
panel_2 = Panel("""0
11
0""")
cull_faces = CullFaces(Mesh=mesh_brep_2, Pattern=panel_2)
cull_vertices = CullVertices(Mesh=mesh_brep_2, Pattern=panel_2, Shrink=True)
delete_faces = DeleteFaces(Mesh=mesh_brep_2, Indices=range_2)
delete_vertices = DeleteVertices(Mesh=mesh_brep_2, Indices=series, Shrink=True)
mesh_join = MeshJoin(Meshes=[delete_faces, delete_vertices])
panel_3 = Panel(mesh_join)
weld_mesh = WeldMesh(Mesh=mesh_join, Angle=3.141592654)
panel_4 = Panel(weld_mesh)
unweld_mesh = UnweldMesh(Mesh=weld_mesh, Angle=1.570796327)
panel_5 = Panel(unweld_mesh)

# ----
# - I have seen this used once in generative design series:
# great video series (5 videos)
# Intermediate to advanced levels
occlusion = Occlusion()  # -> Hits, Occlusion

# ----
# - parametric mesh shadow
number_slider_6 = Slider(1, range=0..1)
bounding_box = BoundingBox(Content=delete_vertices, Plane=PlaneXY(0, 0, 0))  # -> Box, Box_2
negative = Negative(Value=number_slider_6)
deconstruct_brep = DeconstructBrep(Brep=bounding_box.Box)  # -> Faces, Edges, Vertices
vector_xyz = VectorXYZ(XComponent=Slider(0.49, range=0..1), YComponent=Slider(0.09, range=0..1), ZComponent=negative)  # -> Vector, Length
list_item = ListItem(List=deconstruct_brep.Faces, Index=Slider(4, range=0..10), Wrap=True)
mesh_shadow = MeshShadow(Mesh=weld_mesh, Light=vector_xyz.Vector, Plane=list_item)
cull_index = CullIndex(List=mesh_shadow, Indices="0", Wrap=True)
list_item_2 = ListItem(List=mesh_shadow, Index=Slider(0, range=0..100), Wrap=True)
boundary_surfaces = BoundarySurfaces(Edges=cull_index)
split_brep_multiple = SplitBrepMultiple(Brep=list_item_2, Cutters=boundary_surfaces)
list_item_3 = ListItem(List=split_brep_multiple, Index=0, Wrap=True)  # -> Item1, Item
