# Grasshopper definition EX_034_transformations_affine.gh (Grasshopper 1.0.7)
# plug-ins: Kangaroo2 Components

# ----
# EXERCISES_TRANSFORM
# 034_transformations_affine
# - scale with ranges and series and consider
# center points
# - consider linking all of your parameters to avoid
# collisions and reduce the need for boolean
# operations
number_slider = Slider(12, range=0..100)  # disabled
number_slider_2 = Slider(100, range=0..100)  # disabled
range = Range(Domain=number_slider, Steps=number_slider_2)  # disabled
sine = Sine(Value=range)  # disabled
cosine = Cosine(Value=range)  # disabled
construct_point = ConstructPoint(XCoordinate=sine, YCoordinate=cosine, ZCoordinate=range)  # disabled
number_slider_3 = Slider(24, range=0..100)  # disabled
nurbs_curve = NurbsCurve(Vertices=construct_point, Degree=3, Periodic=False)  # -> Curve, Length, Domain; disabled
divide_curve = DivideCurve(Curve=nurbs_curve.Curve, Count=number_slider_3, Kinks=False)  # -> Points, Tangents, Parameters; disabled
number_slider_4 = Slider(4, range=0..100)  # disabled
align_plane = AlignPlane(Plane=divide_curve.Points, Direction=divide_curve.Tangents)  # -> Plane, Angle; disabled
vector_display = VectorDisplay(Anchor=divide_curve.Points, Vector=divide_curve.Tangents)  # disabled
center_box = CenterBox(Base=PlaneXY(0, 0, 0), X=number_slider_4, Y=expr("x/3", number_slider_4), Z=expr("x/6", number_slider_4))  # disabled
deconstruct_brep = DeconstructBrep(Brep=center_box)  # -> Faces, Edges, Vertices; disabled
panel = Panel("3")  # disabled
list_item = ListItem(List=deconstruct_brep.Faces, Index=panel, Wrap=True)  # disabled
area = Area(Geometry=list_item)  # -> Area, Centroid; disabled
number_slider_5 = Slider(1, range=0..1)  # disabled
number_slider_6 = Slider(0.42, range=0..1)  # disabled
number_slider_7 = Slider(1, range=0..1)  # disabled
orient = Orient(Geometry=center_box, Source=area.Centroid, Target=align_plane.Plane)  # -> Geometry, Transform; disabled
scale = Scale(Geometry=orient.Geometry, Center=divide_curve.Points, Factor=number_slider_5)  # -> Geometry, Transform; disabled
scale_nu = ScaleNU(
    Geometry=orient.Geometry,
    Plane=align_plane.Plane,
    ScaleX=number_slider_5,
    ScaleY=number_slider_7,
    ScaleZ=number_slider_6)  # -> Geometry, Transform; disabled

# ----
# - mapping is a good way to orient complex and simple
# geometry
number_slider_8 = Slider(12, range=0..100)
number_slider_9 = Slider(12, range=0..100)
construct_point_2 = ConstructPoint(XCoordinate=number_slider_8, YCoordinate=0, ZCoordinate=0)
number_slider_10 = Slider(3, range=0..10)
sphere = Sphere(Base=PlaneXY(0, 0, 0), Radius=Slider(2, range=0..10))
cone = Cone(Base=PlaneXY(0, 0, 0), Radius=number_slider_9, Length=number_slider_9)  # -> Cone, Tip
polygon = Polygon(Plane=construct_point_2, Radius=Slider(3, range=0..3), Segments=number_slider_10, FilletRadius=0)  # -> Polygon, Length
circle = Circle(Plane=construct_point_2, Radius=Slider(2, range=0..10))
bounding_box = BoundingBox(Content=sphere, Plane=PlaneXY(0, 0, 0))  # -> Box, Box_2
bounding_box_2 = BoundingBox(Content=cone.Cone, Plane=PlaneXY(0, 0, 0))  # -> Box, Box_2
polygon_2 = Polygon(Plane=PlaneXY(0, 0, 0), Radius=number_slider_9, Segments=number_slider_10, FilletRadius=0)  # -> Polygon, Length
polar_array = PolarArray(Geometry=circle, Plane=PlaneXY(0, 0, 0), Count=10, Angle=6.283185307)  # -> Geometry, Transform
polar_array_2 = PolarArray(Geometry=polygon.Polygon, Plane=PlaneXY(0, 0, 0), Count=10, Angle=6.283185307)  # -> Geometry, Transform
bounding_box_3 = BoundingBox(Content=polygon_2.Polygon, Plane=PlaneXY(0, 0, 0))  # -> Box, Box_2
bounding_box_4 = BoundingBox(Content=polar_array.Geometry, Plane=PlaneXY(0, 0, 0))  # -> Box, Box_2
box_mapping = BoxMapping(Geometry=cone.Cone, Source=bounding_box_2.Box, Target=bounding_box.Box)  # -> Geometry, Transform
deconstruct_brep_2 = DeconstructBrep(Brep=bounding_box_3.Box)  # -> Faces, Edges, Vertices
deconstruct_brep_3 = DeconstructBrep(Brep=bounding_box_4.Box)  # -> Faces, Edges, Vertices
rectangle_mapping = RectangleMapping(Geometry=polygon_2.Polygon, Source=deconstruct_brep_2.Faces, Target=deconstruct_brep_3.Faces)  # -> Geometry, Transform
triangle_mapping = TriangleMapping(Geometry=circle, Source=polygon_2.Polygon, Target=polar_array_2.Geometry)  # -> Geometry, Transform
geometry = Geometry(box_mapping.Geometry)
curve = Curve(rectangle_mapping.Geometry)
curve_2 = Curve(triangle_mapping.Geometry)

# ----
# - a bit of fun with camera obscura, orient direction and pathmapper
number_slider_11 = Slider(2, range=0..10)
negative = Negative(Value=number_slider_11)
unit_z = UnitZ(Factor=number_slider_11)
construct_domain = ConstructDomain(DomainStart=negative, DomainEnd=number_slider_11)
construct_domain_2 = ConstructDomain(DomainStart=".1", DomainEnd=Slider(1, range=0..1))
multiplication = Multiplication(A=Slider(3, range=0..10), B=unit_z)
domain_box = DomainBox(Base=PlaneXY(0, 0, 0), X=construct_domain, Y=construct_domain, Z=Domain(0, 0.25))
range_2 = Range(Domain=construct_domain_2, Steps=Slider(3, range=0..10))
move = Move(Geometry=domain_box, Motion=multiplication)  # -> Geometry, Transform
yz_plane = YZPlane(Origin=Point(0, 0, 0))
deconstruct_brep_4 = DeconstructBrep(Brep=domain_box)  # -> Faces, Edges, Vertices
volume = Volume(Geometry=move.Geometry)  # -> Volume, Centroid
camera_obscura = CameraObscura(Geometry=move.Geometry, Point=yz_plane, Factor=range_2)  # -> graft(Geometry), Transform
dispatch = Dispatch(List=deconstruct_brep_4.Vertices, DispatchPattern=[True, False])  # -> ListA, ListB
camera_obscura_2 = CameraObscura(Geometry=camera_obscura.Geometry, Point=volume.Centroid, Factor=range_2)  # -> Geometry, Transform
line_sdl = LineSDL(Start=volume.Centroid, Direction=dispatch.ListB, Length=1)
line_sdl_2 = LineSDL(Start=volume.Centroid, Direction=dispatch.ListA, Length=1)
orient_direction = OrientDirection(
    Geometry=graft(camera_obscura_2.Geometry),
    PointA=volume.Centroid,
    DirectionA=line_sdl_2,
    PointB=volume.Centroid,
    DirectionB=line_sdl)  # -> simplify(Geometry), Transform
path_mapper = PathMapper(orient_direction.Geometry, source="{A;B}(i)", target="{B}(i)")
path_mapper_2 = PathMapper(orient_direction.Geometry, source="{A;B}", target="{A;B}")
path_mapper_3 = PathMapper(orient_direction.Geometry, source="{A;B}(i)", target="{A}(i)")
geometry_2 = Geometry(path_mapper_3)
geometry_3 = Geometry(path_mapper)

# ----
# - projecting and projecting with direction
number_slider_12 = Slider(0, range=0..1)
number_slider_13 = Slider(20, range=0..100)
construct_domain_3 = ConstructDomain(DomainStart=number_slider_12, DomainEnd=Slider(0.69, range=0..1))
division = Division(A=number_slider_13, B=Slider(4, range=0..10))
sphere_2 = Sphere(Base=PlaneXY(0, 0, 0), Radius=number_slider_13)
quad_sphere = QuadSphere(Base=PlaneXY(0, 0, 0), Radius=division)
range_3 = Range(Domain=construct_domain_3, Steps=Slider(13, range=0..100))
deconstruct_brep_5 = DeconstructBrep(Brep=quad_sphere)  # -> Faces, graft(Edges), Vertices
construct_point_3 = ConstructPoint(XCoordinate=range_3, YCoordinate=range_3, ZCoordinate=0)
evaluate_surface = EvaluateSurface(Surface=reparameterize(sphere_2), Point=construct_point_3)  # -> Point, Normal, UDirection, VDirection, Frame
align_plane_2 = AlignPlane(Plane=evaluate_surface.Point, Direction=evaluate_surface.Normal)  # -> Plane, Angle
plane_normal = PlaneNormal(Origin=evaluate_surface.Point, ZAxis=evaluate_surface.Normal)
construct_point_4 = ConstructPoint(XCoordinate=Slider(7.32, range=0..10), YCoordinate=Slider(7.32, range=0..10), ZCoordinate=Slider(7.32, range=0..10))
polygon_3 = Polygon(Plane=plane_normal, Radius=Slider(100, range=0..100), Segments=6, FilletRadius=0)  # -> Polygon, Length
vector_2pt = Vector2Pt(PointA=construct_point_4, PointB=evaluate_surface.Point, Unitize=False)  # -> Vector, Length
boundary_surfaces = BoundarySurfaces(Edges=polygon_3.Polygon)
vector_display_2 = VectorDisplay(Anchor=vector_2pt.Vector, Vector=vector_2pt.Vector)
project = Project(Geometry=deconstruct_brep_5.Edges, Plane=boundary_surfaces)  # -> Geometry, Transform
project_along = ProjectAlong(Geometry=deconstruct_brep_5.Edges, Plane=boundary_surfaces, Direction=vector_2pt.Vector)  # -> Geometry, Transform
multipipe = MultiPipe(Curves=project_along.Geometry, NodeSize=0.5, EndOffset=1, StrutSize=1, Segment=0, KinkAngle=0.6, CubeFit=0, Caps=0)
multipipe_2 = MultiPipe(Curves=project.Geometry, NodeSize=0.5, EndOffset=1, StrutSize=1, Segment=0, KinkAngle=0.6, CubeFit=0, Caps=0)

number_slider_14 = Slider(1, range=0..1)  # disabled
