# Grasshopper definition EX_035_transformations_array.gh (Grasshopper 1.0.7)

# ----
# 035_transformations_array
# - great ways to get simple geometry to be more
# complex and exciting to visualize
number_slider = Slider(100, range=0..100)
division = Division(A=number_slider, B="10")
range = Range(Domain=division, Steps=number_slider)
# EXERCISES_TRANSFORM
base = Base(PlaneXY(0, 0, 0))
division_2 = Division(A=division, B="2")
pi = Pi(Factor=range)
cosine = Cosine(Value=range)
sine = Sine(Value=range)
rectangle = Rectangle(Plane=base, XSize=Domain(-1, 1), YSize=Domain(-2, 2), Radius=0)  # -> Rectangle, Length
division_3 = Division(A=division, B=division_2)
multiplication = Multiplication(A=pi, B=Slider(4, range=0..10))
multiplication_2 = Multiplication(A=pi, B=cosine)
multiplication_3 = Multiplication(A=pi, B=sine)
cylinder = Cylinder(Base=PlaneXY(0, 0, 0), Radius=division_3, Length=division_3)
number_slider_2 = Slider(3, range=0..10)
construct_point = ConstructPoint(XCoordinate=multiplication, YCoordinate=multiplication_2, ZCoordinate=multiplication_3)
range_2 = Range(Domain=Slider(0.52, range=0..2), Steps=expr("x-1", 10))
range_3 = Range(Domain=Domain(0, 1), Steps=10)
center_box = CenterBox(Base=base, X=1, Y=1, Z=1)
interpolate = Interpolate(Vertices=construct_point, Degree=3, Periodic=False, KnotStyle=1)  # -> Curve, Length, Domain
unit_z = UnitZ(Factor=1)
deconstruct_brep = DeconstructBrep(Brep=center_box)  # -> Faces, Edges, Vertices
pi_2 = Pi(Factor=range_2)
shatter = Shatter(Curve=reparameterize(interpolate.Curve), Parameters=range_3)
curve_middle = CurveMiddle(Curve=shatter)
pi_3 = Pi(Factor=Slider(2, range=0..2))
rotate_3d = Rotate3D(Geometry=shatter, Angle=pi_2, Center=curve_middle, Axis=unit_z)  # -> Geometry, Transform
polar_array = PolarArray(Geometry=interpolate.Curve, Plane=PlaneXY(0, 0, 0), Count=number_slider, Angle=pi_3)  # -> Geometry, Transform
linear_array = LinearArray(Geometry=cylinder, Direction=Vector(10, 0, 0), Count=number_slider)  # -> Geometry, Transform
box_array = BoxArray(Geometry=cylinder, Cell=center_box, XCount=number_slider_2, YCount=number_slider_2, ZCount=number_slider_2)  # -> Geometry, Transform
rectangular_array = RectangularArray(Geometry=cylinder, Cell=rectangle.Rectangle, XCount=number_slider_2, YCount=number_slider_2)  # -> Geometry, Transform
curve_array = CurveArray(Geometry=cylinder, Curve=interpolate.Curve, Count=number_slider)  # -> Geometry, Transform
polar_array_2 = PolarArray(Geometry=rotate_3d.Geometry, Plane=PlaneXY(0, 0, 0), Count=Slider(10, range=0..100), Angle=pi_2)  # -> Geometry, Transform
loft = Loft(
    Curves=polar_array.Geometry,
    Options={Adjust=False, Closed=True, LoftEnds=0, LoftSimp=0, LoftType=0, Rebuild=10, Refit=0.01})
kaleidoscope = Kaleidoscope(Geometry=polar_array_2.Geometry, Plane=PlaneXY(0, 0, 0), Segments=Slider(10, range=0..10))  # -> Geometry, Transform
geometry = Geometry(kaleidoscope.Geometry)
