# Grasshopper definition EX_037_transformations_morph.gh (Grasshopper 1.0.7)

c_script = CSharpScript()  # -> Out, A
# EXERCISES_TRANSFORM
# 037_transform_morph
number_slider = Slider(13, range=0..100)

# ----
# - bend and flow as useful but the others are a
# bit "heavy" and computational control is given up
# to these "micro plugins"
# - best to maintain a computational understanding
# of what is actually going on
# - they are fun to play with if you have interesting
# geometry that  you would like to deform
maelstrom = Maelstrom(Plane=PlaneXY(0, 0, 0), First=0.1, Second=10, Angle=1.570796327, Rigid=False)
bend_deform = BendDeform()
splop = Splop(Plane=PlaneXY(0, 0, 0), Angle=0, Rigid=False)
flow = Flow(ReverseBase=False, ReverseTarget=False, Stretch=True, Rigid=False)
sporph = Sporph(Rigid=False)
stretch = Stretch(Axis=Line((0, 0, 0), (10, 10, 0)), Length=20, Rigid=False)
surface_morph = SurfaceMorph()
twist = Twist(Angle=1.570796327, Infinite=False, Rigid=False)

# ----
# THE PITFALLS OF PLUGINS
panel = Panel("7")
range = Range(Domain=Domain(0, 1), Steps=panel)
# - these nodes can get "heavy" fast
# careful using them
cylinder = Cylinder(Base=PlaneXY(0, 0, 0), Radius=number_slider, Length=number_slider)
construct_point = ConstructPoint(XCoordinate=range, YCoordinate=range, ZCoordinate=0)
evaluate_surface = EvaluateSurface(Surface=reparameterize(cylinder), Point=construct_point)  # -> Point, Normal, UDirection, VDirection, Frame
sort_points = SortPoints(Points=evaluate_surface.Point)  # -> Points, Indices
jitter = Jitter(List=sort_points.Points, Jitter=Slider(0.61, range=0..1), Seed=2)  # -> Values, Indices
list_item = ListItem(List=jitter.Values, Index=0, Wrap=True)  # -> Item, Item1, Item2, Item3, Item4, Item5, Item6, Item7
bounding_box = BoundingBox(Content=cylinder, Plane=PlaneXY(0, 0, 0))  # -> Box, Box_2
twisted_box = TwistedBox(
    CornerA=list_item.Item,
    CornerB=list_item.Item1,
    CornerC=list_item.Item2,
    CornerD=list_item.Item3,
    CornerE=list_item.Item4,
    CornerF=list_item.Item5,
    CornerG=list_item.Item6,
    CornerH=list_item.Item7)
box_morph = BoxMorph(Geometry=cylinder, Reference=bounding_box.Box, Target=twisted_box)
