# Grasshopper definition EX_038_transformations_utility.gh (Grasshopper 1.0.7)
# plug-ins: Bifocals

panel = Panel("""1
0
0
-1
0
1
.34
4
0
0
1
.77
0
0
0
.5""")
construct_matrix = ConstructMatrix(Rows="4", Columns="4", Values=panel)
cone = Cone(Base=PlaneXY(0, 0, 0), Radius=0.5, Length=1)  # -> Cone, Tip
transform_matrix = TransformMatrix(construct_matrix, Digits=3)
transform = Transform(Geometry=cone.Cone, Transform=construct_matrix)
display_matrix = DisplayMatrix(transform_matrix)

# ----
# EXERCISES_TRANSFORM
group = Group()

compound = Compound()
range = Range(Domain=Slider(0.71, range=0..1), Steps="15")
split = Split()
construct_matrix_2 = ConstructMatrix(Rows="4", Columns="4", Values=range)
deconstruct_matrix = DeconstructMatrix(Matrix=construct_matrix_2)  # -> Rows, Columns, Values
inverse_transform = InverseTransform()
transform_matrix_2 = TransformMatrix(construct_matrix_2, Digits=3)
display_matrix_2 = DisplayMatrix(transform_matrix_2)
invert_matrix = InvertMatrix(Tolerance=0)  # -> Matrix, Success
swap_columns = SwapColumns()
swap_rows = SwapRows()
transpose_matrix = TransposeMatrix()

factor = Factor(0.5)

# ----
# - try and set to memory the transformation 4x4
# matix patterns for each transform
# and you will gain control of your own
# transformations using data (0 to 1.000)
number_slider = Slider(12, range=0..100)
scale = Scale(Center=Point(0, 0, 0), Factor=factor)  # -> Geometry, Transform
cone_2 = Cone(Base=PlaneXY(0, 0, 0), Radius=number_slider, Length=number_slider)  # -> Cone, Tip
transform_matrix_3 = TransformMatrix(scale.Transform, Digits=3)
inverse_transform_2 = InverseTransform(Transform=transform_matrix_3)
transform_2 = Transform(Geometry=cone_2.Cone, Transform=scale.Transform)
split_2 = Split(Transform=transform_matrix_3)
panel_2 = Panel(split_2)
transform_3 = Transform(Geometry=transform_2, Transform=transform_matrix_3)

# ----
# - incredibly powerful tool when combining Math_matrices with 4x4  transformation utility
number_slider_2 = Slider(0.71, range=0..1)
range_2 = Range(Domain=number_slider_2, Steps="15")
construct_matrix_3 = ConstructMatrix(Rows="4", Columns="4", Values=range_2)
deconstruct_matrix_2 = DeconstructMatrix(Matrix=construct_matrix_3)  # -> Rows, Columns, Values
display_matrix_3 = DisplayMatrix(construct_matrix_3)
transform_matrix_4 = TransformMatrix(construct_matrix_3, Digits=3)
invert_matrix_2 = InvertMatrix(Tolerance=0)  # -> Matrix, Success
swap_columns_2 = SwapColumns()
swap_rows_2 = SwapRows()
transpose_matrix_2 = TransposeMatrix()

# ----
# 038_transform_utility
# - straight forward nodes for grouping and organizing
ungroup = Ungroup()
merge_group = MergeGroup()
split_group = SplitGroup(Wrap=False)  # -> GroupA, GroupB

rectangular_array = RectangularArray(Cell={Plane=PlaneXY(0, 0, 0), Size=Domain2(u=0..10, v=0..5)}, XCount=6, YCount=3)  # -> Geometry, Transform
kaleidoscope = Kaleidoscope(Plane=PlaneXY(0, 0, 0), Segments=10)  # -> Geometry, Transform
number_slider_3 = Slider(20, range=0..100)
cone_3 = Cone(Base=PlaneXY(0, 0, 0), Radius=0.5, Length=1)  # -> Cone, Tip
cap_holes = CapHoles(Brep=cone_3.Cone)
unit_x = UnitX(Factor=1)
unit_y = UnitY(Factor=1)
unit_z = UnitZ(Factor=1)
bounding_box = BoundingBox(Content=cap_holes, Plane=PlaneXY(0, 0, 0))  # -> Box, Box_2
vector_xyz = VectorXYZ(XComponent=0, YComponent=Slider(1, range=0..1), ZComponent=0)  # -> Vector, Length
construct_point = ConstructPoint(XCoordinate=number_slider_3, YCoordinate=0, ZCoordinate=0)
construct_point_2 = ConstructPoint(XCoordinate=0, YCoordinate=0, ZCoordinate=number_slider_3)
linear_array = LinearArray(Direction=Vector(10, 0, 0), Count=10)  # -> Geometry, Transform
polar_array = PolarArray(Plane=PlaneXY(0, 0, 0), Count=10, Angle=6.283185307)  # -> Geometry, Transform
volume = Volume(Geometry=cap_holes)  # -> Volume, Centroid
construct_point_3 = ConstructPoint(XCoordinate=Slider(0.67, range=0..1), YCoordinate=Slider(1, range=0..1), ZCoordinate=Slider(0.4, range=0..1))
construct_point_4 = ConstructPoint(XCoordinate=Slider(0.84, range=0..1), YCoordinate=Slider(0.68, range=0..1), ZCoordinate=Slider(0.73, range=0..1))
rectangle = Rectangle(Plane=volume.Centroid, XSize=Domain(-1, 1), YSize=Domain(-2, 2), Radius=0)  # -> Rectangle, Length
rectangle_2 = Rectangle(Plane=PlaneXY(0, 0, 0), XSize=Domain(-1, 1), YSize=Domain(-2, 2), Radius=0)  # -> Rectangle, Length
xy_plane = XYPlane(Origin=Point(0, 0, 0))
unit_x_2 = UnitX(Factor=number_slider_3)
yz_plane = YZPlane(Origin=Point(0, 0, 0))
xz_plane = XZPlane(Origin=Point(0, 0, 0))
xy_plane_2 = XYPlane(Origin=Point(0, 0, 0))
center_box = CenterBox(Base=PlaneXY(0, 0, 0), X=1, Y=1, Z=1)
construct_plane = ConstructPlane(Origin=Point(0, 0, 0), XAxis=vector_xyz.Vector, YAxis=Vector(0, 1, 0))
xy_plane_3 = XYPlane(Origin=construct_point_2)
curve = Curve(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)
camera_obscura = CameraObscura(Geometry=cone_3.Cone, Point=Point(0, 0, 0), Factor=1)  # -> Geometry, Transform
scale_2 = Scale(Geometry=cone_3.Cone, Center=Point(0, 0, 0), Factor=0.5)  # -> Geometry, Transform
shear = Shear(Geometry=cone_3.Cone, Base=PlaneXY(0, 0, 0), Grip=construct_point_3, Target=construct_point_4)  # -> Geometry, Transform
scale_nu = ScaleNU(
    Geometry=cone_3.Cone,
    Plane=PlaneXY(0, 0, 0),
    ScaleX=Slider(0.89, range=0..1),
    ScaleY=Slider(0.52, range=0..1),
    ScaleZ=Slider(0.62, range=0..1))  # -> Geometry, Transform
shear_angle = ShearAngle(Geometry=cone_3.Cone, Base=PlaneXY(0, 0, 0), AngleX=Slider(0.391, range=0..2), AngleY=Slider(0, range=0..2))  # -> Geometry, Transform
box_mapping = BoxMapping(Geometry=cone_3.Cone, Source=bounding_box.Box, Target=center_box)  # -> Geometry, Transform
orient_direction = OrientDirection(Geometry=cone_3.Cone, PointA=volume.Centroid, DirectionA=unit_x, PointB=volume.Centroid, DirectionB=unit_z)  # -> Geometry, Transform
project_along = ProjectAlong(Geometry=cone_3.Cone, Plane=PlaneXY(0, 0, 0), Direction=Vector(0, 0, -1))  # -> Geometry, Transform
project = Project(Geometry=cone_3.Cone, Plane=construct_plane)  # -> Geometry, Transform
triangle_mapping = TriangleMapping()  # -> Geometry, Transform
rectangle_mapping = RectangleMapping(Geometry=cone_3.Cone, Source=rectangle.Rectangle, Target=rectangle_2.Rectangle)  # -> Geometry, Transform
orient = Orient(Geometry=cone_3.Cone, Source=PlaneXY(0, 0, 0), Target=PlaneXY(0, 0, 0))  # -> Geometry, Transform
rotate = Rotate(Geometry=cone_3.Cone, Angle=1.570796327, Plane=[xy_plane_2, xz_plane, yz_plane])  # -> Geometry, Transform
rotate_3d = Rotate3D(Geometry=cone_3.Cone, Angle=1.570796327, Center=Point(0, 0, 0), Axis=Vector(0, 0, 1))  # -> Geometry, Transform
rotate_axis = RotateAxis(Geometry=cone_3.Cone, Angle=1.570796327, Axis=Line((0, 0, 0), (10, 0, 0)))  # -> Geometry, Transform
rotate_direction = RotateDirection(Geometry=cone_3.Cone, Center=Point(0, 0, 0), From=Vector(1, 0, 0), To=Vector(0, 1, 0))  # -> Geometry, Transform
move = Move(Geometry=cone_3.Cone, Motion=unit_x_2)  # -> Geometry, Transform
box_array = BoxArray(
    Geometry=cone_3.Cone,
    Cell={Plane=PlaneXY(0, 0, 0), X=Domain(0, 10), Y=Domain(0, 5), Z=Domain(0, 2)},
    XCount=4,
    YCount=3,
    ZCount=2)  # -> Geometry, Transform
mirror = Mirror(Geometry=cone_3.Cone, Plane=xy_plane)  # -> Geometry, Transform
move_to_plane = MoveToPlane(Geometry=cone_3.Cone, Plane=xy_plane_3, Above=True, Below=True)  # -> Geometry, Transform
move_away_from = MoveAwayFrom(Geometry=cone_3.Cone, Emitter=construct_point, Distance=number_slider_3)  # -> Geometry, Transform
curve_array = CurveArray(Geometry=cone_3.Cone, Curve=curve, Count=10)  # -> Geometry, Transform
rotate_plane = RotatePlane()
transform_matrix_5 = TransformMatrix(camera_obscura.Transform, Digits=3)
transform_matrix_6 = TransformMatrix(orient_direction.Transform, Digits=3)
transform_matrix_7 = TransformMatrix(scale_2.Transform, Digits=3)
transform_matrix_8 = TransformMatrix(scale_nu.Transform, Digits=3)
transform_matrix_9 = TransformMatrix(project.Transform, Digits=3)
transform_matrix_10 = TransformMatrix(shear_angle.Transform, Digits=3)
transform_matrix_11 = TransformMatrix(box_mapping.Transform, Digits=3)
transform_matrix_12 = TransformMatrix(project_along.Transform, Digits=3)
transform_matrix_13 = TransformMatrix(rectangle_mapping.Transform, Digits=3)
transform_matrix_14 = TransformMatrix(shear.Transform, Digits=3)
transform_matrix_15 = TransformMatrix(rotate.Transform, Digits=3)
transform_matrix_16 = TransformMatrix(rotate_3d.Transform, Digits=3)
transform_matrix_17 = TransformMatrix(rotate_axis.Transform, Digits=3)
transform_matrix_18 = TransformMatrix(rotate_direction.Transform, Digits=3)
transform_matrix_19 = TransformMatrix(box_array.Transform, Digits=3)
transform_matrix_20 = TransformMatrix(curve_array.Transform, Digits=3)
transform_matrix_21 = TransformMatrix(mirror.Transform, Digits=3)
transform_matrix_22 = TransformMatrix(move.Transform, Digits=3)
transform_matrix_23 = TransformMatrix(move_away_from.Transform, Digits=3)
transform_matrix_24 = TransformMatrix(move_to_plane.Transform, Digits=3)
transform_matrix_25 = TransformMatrix(orient.Transform, Digits=3)
transform_4 = Transform(Geometry=camera_obscura.Geometry, Transform=transform_matrix_5)
transform_5 = Transform(Geometry=scale_2.Geometry, Transform=transform_matrix_7)
transform_6 = Transform(Geometry=scale_nu.Geometry, Transform=transform_matrix_8)
transform_7 = Transform(Geometry=shear.Geometry, Transform=transform_matrix_14)
transform_8 = Transform(Geometry=shear_angle.Geometry, Transform=transform_matrix_10)
transform_9 = Transform(Geometry=box_mapping.Geometry, Transform=transform_matrix_11)
transform_10 = Transform(Geometry=orient_direction.Geometry, Transform=transform_matrix_6)
transform_11 = Transform(Geometry=project.Geometry, Transform=transform_matrix_9)
transform_12 = Transform(Geometry=project_along.Geometry, Transform=transform_matrix_12)
transform_13 = Transform(Geometry=rectangle_mapping.Geometry, Transform=transform_matrix_13)
