# Grasshopper definition EX_039_display_dimensions.gh (Grasshopper 1.0.7)

# ----
# 039_display_dimensions
# - provides some interesting parametric
# documentation in the Rhino Environment
# - colors and hatching patterns
number_slider = Slider(1, range=0..1)
# EXERCISES_DISPLAY
number_slider_2 = Slider(12, range=0..100)
vector_xyz = VectorXYZ(XComponent=number_slider, YComponent=number_slider, ZComponent=0)  # -> Vector, Length
construct_point = ConstructPoint(XCoordinate=0, YCoordinate=0, ZCoordinate=0)
line_sdl = LineSDL(Start=construct_point, Direction=vector_xyz.Vector, Length=1)
circle = Circle(Plane=PlaneXY(0, 0, 0), Radius=number_slider_2)
pi = Pi(Factor=Slider(1.02, range=0..2))
pattern_hatch = PatternHatch(Boundaries=circle, Pattern=Slider(3, range=0..8), Scale=Slider(1.84, range=0..2), Angle=pi)
gradient_hatch = GradientHatch(
    Boundaries=circle,
    Axis=line_sdl,
    Colour1=ColourSwatch(SwatchColor=RGB(95, 209, 255)),
    Colour2=ColourSwatch(SwatchColor=RGB(205, 24, 255)))

# ----
# - aligned, angled, arc, circle dimensions
number_slider_3 = Slider(58, range=0..100)
divide_length = DivideLength(Curve=reparameterize(circle), Length=number_slider_3)  # -> Points, Tangents, Parameters
number_slider_4 = Slider(2, range=0..2)
point_on_curve = PointOnCurve(circle, parameter=0.187)
point_on_curve_2 = PointOnCurve(circle, parameter=0.682)
point_on_curve_3 = PointOnCurve(circle, parameter=0.469)
shatter = Shatter(Curve=reparameterize(circle), Parameters=divide_length.Parameters)
line = Line(StartPoint=point_on_curve, EndPoint=point_on_curve_2)
line_2 = Line(StartPoint=point_on_curve, EndPoint=point_on_curve_3)
xy_plane = XYPlane(Origin=Point(0, 0, 0))
list_item = ListItem(List=flatten(shatter), Index=0, Wrap=True)
aligned_dimension = AlignedDimension(
    Plane=xy_plane,
    PointA=point_on_curve,
    PointB=point_on_curve_2,
    Offset=Slider(14, range=0..100),
    Text="{0:0.00}",
    Size=number_slider_4)
line_dimension = LineDimension(Line=line, Text="{0:0.00}", Size=number_slider_4)
angular_dimension = AngularDimension(
    Center=point_on_curve,
    PointA=point_on_curve_2,
    PointB=point_on_curve_3,
    Reflex=Toggle(False),
    Text="{0:0.0}°",
    Size=number_slider_4)
circular_dimension = CircularDimension(Circle=circle, PointA=point_on_curve_2, PointB=point_on_curve_3, Text="{0:0.0}°", Size=1)
arc_dimension = ArcDimension(Arc=list_item, Offset=2, Text="{0:0.0}°", Size=1)
end_points = EndPoints(Curve=line)  # -> Start, End
angular_dimensions_mesh = AngularDimensionsMesh(Text="{0:0.0}°", Size=1, LengthFactor=0.5)
linear_dimension = LinearDimension(Line=line, PointA=end_points.Start, PointB=end_points.End, Text="{0:0.00}", Size=number_slider_4)

# ----
# - make 2D in grasshopper instead of Rhino
# - experiment and see if it is good for your process
number_slider_5 = Slider(14, range=0..100)
number_slider_6 = Slider(24, range=0..100)
make2d = Make2D(TangentEdges=False, TangentSeams=False, AutoComputeMake2D=False)  # -> VisibleCurves, VisibleIndex, VisibleType, HiddenCurves, HiddenIndex, HiddenType
cone = Cone(Base=PlaneXY(0, 0, 0), Radius=number_slider_5, Length=number_slider_5)  # -> Cone, Tip
construct_point_2 = ConstructPoint(XCoordinate=number_slider_6, YCoordinate=number_slider_6, ZCoordinate=0)
make2d_parallel_view = Make2DParallelView()
bounding_box = BoundingBox(Content=cone.Cone, Plane=PlaneXY(0, 0, 0))  # -> Box, Box_2
make2d_perspective_view = Make2DPerspectiveView()
deconstruct_brep = DeconstructBrep(Brep=bounding_box.Box_2)  # -> Faces, Edges, Vertices
make2d_rhino_view = Make2DRhinoView(Clip=True)
list_item_2 = ListItem(List=deconstruct_brep.Faces, Index=Slider(1, range=0..5), Wrap=True)
make2d_parallel_view_2 = Make2DParallelView(Projection=bounding_box.Box)
make2d_perspective_view_2 = Make2DPerspectiveView(Camera=construct_point_2, Frame=list_item_2)
make2d_rhino_view_2 = Make2DRhinoView(Name="MyFirstView", Clip=Toggle(True))
make2d_2 = Make2D(Geometry=cone.Cone, View=make2d_perspective_view_2, TangentEdges=False, TangentSeams=False, AutoComputeMake2D=False)  # -> VisibleCurves, VisibleIndex, VisibleType, HiddenCurves, HiddenIndex, HiddenType

# ----
# - go to top view and select all 3D text tags
# using text tags for graphs (matplotlib substitution 3D)
# Creating Circles and estimating circumference:
# 
# x² + y² = Coefficient
# x² + y² = 0
# x² + y² = 1
# x² + y² = 4
# x² + y² = 9
# x² + y² = 16
# x² + y² = 25
# x² + y² = 36
# x² + y² = 49
# x² + y² = 64
# x² + y² = 81
# x² + y² = 100
text_tag_3d = TextTag3D(Size=1, Justification=7)
text_tag = TextTag()
panel = Panel("""0
1
4
9
16
25
36
49
64
81
100""")
list_item_3 = ListItem(List=panel, Index=Slider(2, range=0..5), Wrap=True)
square_root = SquareRoot(Value=list_item_3)
panel_2 = Panel(square_root)
negative = Negative(Value=panel_2)
panel_3 = Panel(panel_2)
construct_domain = ConstructDomain(DomainStart=negative, DomainEnd=panel_2)
panel_5 = Panel(negative)
range = Range(Domain=construct_domain, Steps=Slider(100, range=2..100))  # -> flatten(Range)
expression = Expression(x=range, C=list_item_3, Expression="Sqrt(C - x^2)")
panel_6 = Panel(construct_domain)
multiplication = Multiplication(A=expression, B="-1")
panel_7 = Panel(range)
construct_point_3 = ConstructPoint(XCoordinate=range, YCoordinate=expression, ZCoordinate=0)
construct_point_4 = ConstructPoint(XCoordinate=range, YCoordinate=multiplication, ZCoordinate=0)
construct_point_5 = ConstructPoint(XCoordinate=0, YCoordinate=0, ZCoordinate=0)
panel_8 = Panel(expression)
interpolate = Interpolate(Vertices=construct_point_3, Degree=3, Periodic=False, KnotStyle=1)  # -> Curve, Length, Domain
interpolate_2 = Interpolate(Vertices=construct_point_4, Degree=3, Periodic=False, KnotStyle=1)  # -> Curve, Length, Domain
deconstruct = Deconstruct(Point=construct_point_3)  # -> XComponent, YComponent, ZComponent
join_curves = JoinCurves(Curves=[interpolate_2.Curve, interpolate.Curve], Preserve=False)
construct_point_6 = ConstructPoint(XCoordinate=0, YCoordinate=deconstruct.YComponent, ZCoordinate=0)
construct_point_7 = ConstructPoint(XCoordinate=deconstruct.XComponent, YCoordinate=0, ZCoordinate=0)
curve_middle = CurveMiddle(Curve=join_curves)
point_on_curve_4 = PointOnCurve(join_curves, parameter=0.818)
length = Length(Curve=join_curves)
point_on_curve_5 = PointOnCurve(join_curves, parameter=0.646)
point_on_curve_6 = PointOnCurve(join_curves, parameter=0.397)
point_on_curve_7 = PointOnCurve(join_curves, parameter=0.516)
line_3 = Line(StartPoint=construct_point_5, EndPoint=construct_point_7)
line_4 = Line(StartPoint=construct_point_5, EndPoint=construct_point_6)
panel_9 = Panel(length)
evaluate_curve = EvaluateCurve(Curve=reparameterize(join_curves), Parameter="0")  # -> Point, Tangent, Angle
evaluate_curve_2 = EvaluateCurve(Curve=reparameterize(join_curves), Parameter="1")  # -> Point, Tangent, Angle
panel_10 = Panel("""  
      Circumference of 
      y = Sqrt(C + x^2) 
      circle""")
negative_2 = Negative(Value=evaluate_curve.Tangent)
panel_11 = Panel("y    ")
panel_12 = Panel("x")
concatenate = Concatenate(FragmentA="____", FragmentB=panel_9)
list_item_4 = ListItem(List=construct_point_7, Index=0, Wrap=True)  # -> Item1, Item
list_item_5 = ListItem(List=construct_point_6, Index=0, Wrap=True)
polyline = PolyLine(Vertices=construct_point_3, Closed=False)
boundary_surfaces = BoundarySurfaces(Edges=join_curves)
text_tag_3d_2 = TextTag3D(Location=point_on_curve_6, Text="     creating circles", Size=".12", Justification=1)
text_tag_3d_3 = TextTag3D(Location=construct_point_5, Text="O    ", Size=".12", Justification=3)
text_tag_3d_4 = TextTag3D(Location=point_on_curve_7, Text=[panel_10, concatenate], Size=".12", Justification=7)
text_tag_3d_5 = TextTag3D(Location=point_on_curve_4, Text=panel_2, Size=".12", Justification=3)
text_tag_3d_6 = TextTag3D(Location=list_item_4.Item1, Text=panel_2, Size=".12", Justification=2)
text_tag_3d_7 = TextTag3D(Location=point_on_curve_5, Text="    P = (x,y)", Size=".12", Justification=7)
vector_display = VectorDisplay(Anchor=evaluate_curve.Point, Vector=negative_2)
vector_display_2 = VectorDisplay(Anchor=evaluate_curve_2.Point, Vector=evaluate_curve_2.Tangent)
curve = Curve(join_curves)
area = Area(Geometry=boundary_surfaces)  # -> Area, Centroid
panel_13 = Panel(area.Area)
