# Grasshopper definition EX_044_plugins_kangaroo_cellularGrowth.gh (Grasshopper 1.0.7)
# plug-ins: Kangaroo2 Components, Pufferfish

curve = Curve(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)
divide_curve = DivideCurve(Curve=curve, Count=Slider(1000, range=0..1000), Kinks=False)  # -> Points, Tangents, Parameters
polyline = PolyLine(Vertices=divide_curve.Points, Closed=Toggle(True))
explode = Explode(Curve=polyline, Recursive=True)  # -> Segments, Vertices
curve_2 = Curve(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)
mesh = Mesh(curve_2)
number_slider = Slider(11.09, range=1..20)
length = Length(Curve=explode.Segments)
average = Average(Input=length)
onmesh = OnMesh(Points=divide_curve.Points, Mesh=mesh, Strength=1)
multiplication = Multiplication(A=average, B=number_slider)
length_line = LengthLine(Line=explode.Segments, Length=multiplication, Strength=10)
spherecollide = SphereCollide(Points=divide_curve.Points, Radius=number_slider, Strength=Slider(0.99, range=0..10))
solver = Solver(GoalObjects=[length_line, spherecollide, onmesh], Reset=Button(), Threshold=1e-15, Tolerance=0.0001, On=Toggle(True))  # -> I, V, O
polyline_2 = PolyLine(Vertices=solver.V, Closed=Toggle(True))
rebuild_curve = RebuildCurve(Curve=polyline_2, Count="2000", Degree="3", EndTangents=Toggle(True))

# ----
# 044_Kangaroo_cellular_growth
number_slider_2 = Slider(500, range=0..1000)
# PLUGINS CAN BE USED SIMPLY AND CAN BE DELVED INTO ON A MORE ADVANCED LEVEL
# THE KEY IS TO UNDERSTAND HOW THEY WERE CONTRUCTED FROM THE VANILLA RIBBON NODES THAT COME WITH GRASSHOPPER FOR RHINO7
# ONLY THEN WILL YOU BE ABLE TO START PROGRAMMING AND COMPILING YOUR OWN PLUGINS THAT HAVE YET TO BE CREATED FOR THE PARAMETRIC AND COMPUTATIONAL DESIGNER/ARCHITECT AND ENGINEER
curve_3 = Curve(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)
# Cellular Growth with Kangaroo
# Gediminas Kirdeikis has a great overview
# in stand alone grasshopper with the Kangaroo plugin
# - this script/video summarizes the
# 6 hour, complete, detailed C# scripting series by Long Nguyen
# https://www.youtube.com/watch?v=viEpaivq9A0&t=607s
boolean_toggle = BooleanToggle(True)
divide_curve_2 = DivideCurve(Curve=curve_3, Count=number_slider_2, Kinks=False)  # -> Points, Tangents, Parameters
polyline_3 = PolyLine(Vertices=divide_curve_2.Points, Closed=boolean_toggle)
explode_2 = Explode(Curve=polyline_3, Recursive=True)  # -> Segments, Vertices
number_slider_3 = Slider(5.64, range=1..10)
length_2 = Length(Curve=explode_2.Segments)
average_2 = Average(Input=length_2)
multiplication_2 = Multiplication(A=average_2, B=number_slider_3)
length_line_2 = LengthLine(Line=explode_2.Segments, Length=multiplication_2, Strength=10)
spherecollide_2 = SphereCollide(Points=divide_curve_2.Points, Radius=number_slider_3, Strength=Slider(3.31, range=0..10))
solver_2 = Solver(GoalObjects=[length_line_2, spherecollide_2], Reset=Button(), Threshold=1e-15, Tolerance=0.0001, On=Toggle(True))  # -> I, V, O
polyline_4 = PolyLine(Vertices=solver_2.V, Closed=Toggle(True))

solver_3 = Solver(Reset=False, Threshold=1e-15, Tolerance=0.0001, On=True)  # -> I, V, O
