# Grasshopper definition EX_046_plugins_metaball.gh (Grasshopper 1.0.7)
# plug-ins: Pufferfish, Bifocals

# ----
# PLUGINS CAN BE USED SIMPLY AND CAN BE DELVED INTO ON A MORE ADVANCED LEVEL
# THE KEY IS TO UNDERSTAND HOW THEY WERE CONTRUCTED FROM THE VANILLA RIBBON NODES THAT COME WITH GRASSHOPPER FOR RHINO7
# ONLY THEN WILL YOU BE ABLE TO START PROGRAMMING AND COMPILING YOUR OWN PLUGINS THAT HAVE YET TO BE CREATED FOR THE PARAMETRIC AND COMPUTATIONAL DESIGNER/ARCHITECT AND ENGINEER
# 046_metaball_example
# - Parametric House makes use of genepool in
# metaball(t) custom
# - control points with charge and slicing
metaball = MetaBall(Plane=PlaneXY(0, 0, 0))
rectangle = Rectangle(Plane=PlaneXY(0, 0, 0), XSize="-12 to 12", YSize="-12 to 12", Radius=0)  # -> Rectangle, Length
construct_point = ConstructPoint(XCoordinate=0, YCoordinate=0, ZCoordinate=Slider(2, range=-12..12))
metaball_t = MetaBallT(Plane=PlaneXY(0, 0, 0), Threshold=0.5)
populate_2d = Populate2D(Region=rectangle.Rectangle, Count="4", Seed=Slider(57, range=0..100))
unit_z = UnitZ(Factor=Slider(0.39, range=0..2))
gene_pool = GenePool(Decimals=2, Maximum=50, Minimum=5, Value=[14.81, 9.85, 14.7, 37.35])
xy_plane = XYPlane(Origin=construct_point)
linear_array = LinearArray(Geometry=xy_plane, Direction=unit_z, Count=10)  # -> Geometry, Transform
metaball_t_custom = MetaBallTCustom(Plane=PlaneXY(0, 0, 0), Threshold=0.5)
metaball_t_custom_2 = MetaBallTCustom(
    Points=populate_2d,
    Charge=gene_pool,
    Plane=linear_array.Geometry,
    Threshold=Slider(0.48, range=0..1),
    Accuracy=Slider(4.77, range=0..10))
smooth_polyline = SmoothPolyline(Polyline=metaball_t_custom_2, Strength=1, Times=Slider(2, range=0..100))
rebuild_curve = RebuildCurve(Curve=smooth_polyline, Count=Slider(25, range=0..100), Degree="3", EndTangents=False)
surface = Surface(rebuild_curve)
