# Grasshopper definition EX_048_plugins_voronoi.gh (Grasshopper 1.0.7)
# plug-ins: MeshEdit Components, LunchBox, Bifocals

# ----
# David Copete *
number_slider = Slider(1.4, range=0..10)
number_slider_2 = Slider(106, range=0..200)
multiplication = Multiplication(A=number_slider_2, B=number_slider)

# ----
# PLUGINS CAN BE USED SIMPLY AND CAN BE DELVED INTO ON A MORE ADVANCED LEVEL
# THE KEY IS TO UNDERSTAND HOW THEY WERE CONTRUCTED FROM THE VANILLA RIBBON NODES THAT COME WITH GRASSHOPPER FOR RHINO7
# ONLY THEN WILL YOU BE ABLE TO START PROGRAMMING AND COMPILING YOUR OWN PLUGINS THAT HAVE YET TO BE CREATED FOR THE PARAMETRIC AND COMPUTATIONAL DESIGNER/ARCHITECT AND ENGINEER
# 048_voronoi_example
# - this is probably the most used and over used
# algorithm used on the internet in grasshopper
# BEWARE!
# - here are some great samples of David Copete
# https://www.copetedavid.com/shop
# requires the Lunchbox download
voronoi = Voronoi(BruteForceOverride=False)
rectangle = Rectangle(Plane=PlaneXY(0, 0, 0), XSize="100", YSize="100", Radius=0)  # -> Rectangle, Length
voronoi_3d = Voronoi3D()  # -> Cells, Boundary
hexagon_cells = HexagonCells(Surface=rectangle.Rectangle, UDivisions=number_slider_2, VDivisions=multiplication, TParameter=0.25)  # -> HexagonCells, Centers
populate_2d = Populate2D(Region=rectangle.Rectangle, Count=Slider(62, range=0..300), Seed=1)
voronoi_groups = VoronoiGroups(Boundary={Plane=PlaneXY(0, 0, 0), Size=Domain2(u=-10..10, v=-10..10)})  # -> Diagram1, Diagram2
voronoi_cell = VoronoiCell()
point = Point(hexagon_cells.Centers)
image_sampler = ImageSampler(
    point,
    FilePath="C:\Users\Sculpture\Documents\2020_Grasshopper\ghfiles2019\January2019\GrassHooperRhino\Image Sampler\42756679_1957985090911421_5593958529514864640_n.jpg",
    Filter="Value",
    Interpolate=True,
    Umax=100,
    Umin=0,
    Vmax=100,
    Vmin=0,
    Wrap=1)
number_slider_3 = Slider(0.3542, range=0..1)
_3d_voronoi = _3DVoronoi()  # -> _3DVoronoiCells, Connectivity
construct_domain = ConstructDomain(DomainStart=Slider(0.5199, range=0..1), DomainEnd=Slider(0.053, range=0..1))
bounds = Bounds(Numbers=image_sampler)
voronoi_2 = Voronoi(Points=hexagon_cells.Centers, Boundary=rectangle.Rectangle, BruteForceOverride=False)
remap_numbers = RemapNumbers(Value=image_sampler, Source=bounds, Target=construct_domain)  # -> Mapped, Clipped
point_2 = Point(populate_2d)
smaller_than = SmallerThan(FirstNumber=remap_numbers.Mapped, SecondNumber=number_slider_3)  # -> SmallerThan, OrEqualTo
larger_than = LargerThan(FirstNumber=remap_numbers.Mapped, SecondNumber=number_slider_3)  # -> LargerThan, OrEqualTo
cull_pattern = CullPattern(List=point, CullPattern=larger_than.LargerThan)
cull_pattern_2 = CullPattern(List=point_2, CullPattern=smaller_than.SmallerThan)
point_3 = Point([cull_pattern, cull_pattern_2])
voronoi_3 = Voronoi(Points=point_3, Boundary=rectangle.Rectangle, BruteForceOverride=False)
