# Grasshopper definition EX_049_plugins_weaverbird.gh (Grasshopper 1.0.7)
# plug-ins: Weaverbird, MeshEdit Components, Bifocals

# ----
# - download mesh edit plugin for these scripts (Mesh credit: Daniel Christev)
number_slider = Slider(40, range=0..100)
number_slider_2 = Slider(100, range=0..100)
range = Range(Domain=number_slider, Steps=number_slider_2)
sine = Sine(Value=range)
multiplication = Multiplication(A=sine, B=Slider(4, range=0..5))
construct_point = ConstructPoint(XCoordinate=graft(range), YCoordinate=range, ZCoordinate=multiplication)
surface_from_points = SurfaceFromPoints(Points=flatten(construct_point), UCount=expr("x+1", number_slider_2), Interpolate=False)
surface = Surface(surface_from_points)
area = Area(Geometry=surface)  # -> Area, Centroid
dimensions = Dimensions(Surface=surface)  # -> UDimension, VDimension
number_slider_3 = Slider(10, range=0..20)
division = Division(A=dimensions.UDimension, B=dimensions.VDimension)
scale = Scale(Geometry=surface, Center=area.Centroid, Factor=Slider(1.679, range=0..5))  # -> Geometry, Transform
md_slider = MDSlider(
    SliderMode=0,
    slider_value=Point(0.5964374077, 0.3989495998, 0.5),
    x_domain=Domain(0, 1),
    y_domain=Domain(0, 1),
    z_domain=Domain(0, 1))
multiplication_2 = Multiplication(A=division, B=number_slider_3)
integer = Integer(multiplication_2)
divide_surface = DivideSurface(Surface=surface, UCount=integer, VCount=number_slider_3)  # -> flatten(Points), Normals, Parameters
md_slider_2 = MDSlider(
    SliderMode=0,
    slider_value=Point(0.5961486002, 0.485873731, 0.5),
    x_domain=Domain(0, 1),
    y_domain=Domain(0, 1),
    z_domain=Domain(0, 1))
md_slider_3 = MDSlider(
    SliderMode=0,
    slider_value=Point(0.6777540998, 0.5706941558, 0.5),
    x_domain=Domain(0, 1),
    y_domain=Domain(0, 1),
    z_domain=Domain(0, 1))
evaluate_surface = EvaluateSurface(Surface=reparameterize(scale.Geometry), Point=[md_slider_3, md_slider, md_slider_2])  # -> Point, Normal, UDirection, VDirection, Frame
distance = Distance(PointA=graft(evaluate_surface.Point), PointB=divide_surface.Points)
point = Point(divide_surface.Points)
expression = Expression(w=flatten(Slider(0.243, range=0..2)), t=distance, Expression="sin(2*w^2*t)")
flip_matrix = FlipMatrix(Data=expression)
ma = MassMultiplication(Input=flip_matrix)  # -> flatten(Result), PartialResults
multiplication_3 = Multiplication(A=Slider(7.333, range=0..10), B=ma.Result)
unit_z = UnitZ(Factor=multiplication_3)
move = Move(Geometry=divide_surface.Points, Motion=unit_z)  # -> Geometry, Transform
expression_2 = Expression(u=integer, Expression="u+1")
mesh_frompoints = MeshFromPoints(Points=move.Geometry, UDirection=expr("x+1", integer), VDirection=expr("x+1", number_slider_3))
surface_from_points_2 = SurfaceFromPoints(Points=move.Geometry, UCount=expression_2, Interpolate=False)

# ----
# 049_weaverbird_example
# - credit Daniel Christev with mesh generator
# -
# weaverbird is a powerful plugin
# - Alfonso Peluso has some great samples online
# https://www.youtube.com/watch?v=eYjFq4_miw0
# - applying multiple values
number_slider_4 = Slider(2, range=0..5)
# PLUGINS CAN BE USED SIMPLY AND CAN BE DELVED INTO ON A MORE ADVANCED LEVEL
# THE KEY IS TO UNDERSTAND HOW THEY WERE CONTRUCTED FROM THE VANILLA RIBBON NODES THAT COME WITH GRASSHOPPER FOR RHINO7
# ONLY THEN WILL YOU BE ABLE TO START PROGRAMMING AND COMPILING YOUR OWN PLUGINS THAT HAVE YET TO BE CREATED FOR THE PARAMETRIC AND COMPUTATIONAL DESIGNER/ARCHITECT AND ENGINEER
weaverbird_s_tile = WeaverbirdsTile(FillStrategy=1, OptIn=2)
mesh = Mesh(mesh_frompoints)
weaverbird_s_loop_subdivision = WeaverbirdsLoopSubdivision(MeshCurves=mesh, Level=number_slider_4, SmoothNakedEdges=1)
weaverbird_s_catmull_clark_subdivision = WeaverbirdsCatmullClarkSubdivision(MeshCurves=mesh, Level=number_slider_4, SmoothNakedEdges=1)
weaverbird_s_constant_quads_split_subdiv = WeaverbirdsConstantQuadsSplitSubdivision(MeshCurves=mesh, Level=number_slider_4, SmoothNakedEdges=1)
weaverbird_s_mesh_from_lines_weave_back = WeaverbirdsMeshFromLinesWeaveBack(MaximumValence=4)
weaverbird_s_picture_frame = WeaverbirdsPictureFrame(
    MeshPolylines=weaverbird_s_catmull_clark_subdivision,
    Distance=[Slider(21, range=0..100), Slider(38, range=0..100), Slider(20, range=0..100)],
    InsetType=0)
weaverbird_s_mesh_thicken = WeaverbirdsMeshThicken(
    MeshCurves=weaverbird_s_picture_frame,
    Distance=[Slider(1.73, range=0..10), Slider(3.2, range=0..10), Slider(1.45, range=0..10)],
    OffsetType=0)
weaverbird_s_catmull_clark_subdivision_2 = WeaverbirdsCatmullClarkSubdivision(MeshCurves=weaverbird_s_mesh_thicken, Level=Slider(2, range=1..3), SmoothNakedEdges=1)
