# Grasshopper definition EX_050_plugins_octree.gh (Grasshopper 1.0.7)
# plug-ins: Weaverbird, Bifocals

# ----
# 050_octree_example
# - OM! has some of the best music videos for
# learning grasshopper online
# https://www.youtube.com/watch?v=2ZdsI_p9Ifo
# 050*_open source .gh files by
# Junichiro Horikawa
number_slider = Slider(35, range=0..100)
# PLUGINS CAN BE USED SIMPLY AND CAN BE DELVED INTO ON A MORE ADVANCED LEVEL
# THE KEY IS TO UNDERSTAND HOW THEY WERE CONTRUCTED FROM THE VANILLA RIBBON NODES THAT COME WITH GRASSHOPPER FOR RHINO7
# ONLY THEN WILL YOU BE ABLE TO START PROGRAMMING AND COMPILING YOUR OWN PLUGINS THAT HAVE YET TO BE CREATED FOR THE PARAMETRIC AND COMPUTATIONAL DESIGNER/ARCHITECT AND ENGINEER
octree = OcTree(Square=False, Group=5)  # -> Boxes, Points
geometry = Geometry(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)
populate_geometry = PopulateGeometry(Geometry=geometry, Count=Slider(100, range=0..100), Seed=number_slider)
quadtree = QuadTree(Plane=PlaneXY(0, 0, 0), Square=False, Group=5)  # -> Quads, Points
octree_2 = OcTree(Points=populate_geometry, Square=Toggle(True), Group=Slider(-3.62, range=-100..100.01))  # -> Boxes, Points
quad_remesh = QuadRemesh(Settings={aqc=True, as=50, dhe=True, gci=0, null=False, pme=0, sa=0, tqc=2000})
geometry_2 = Geometry(octree_2.Boxes)
area = Area(Geometry=geometry_2)  # -> Area, Centroid
quad_remesh_settings = QuadRemeshSettings(TargetCount=1000, AdaptiveSize=0, AdaptiveCount=False, HardEdges=False, SeamEdges=0, Symmetry=0, GuideCurves=0)
scale = Scale(Geometry=geometry_2, Center=area.Centroid, Factor=Slider(2.607, range=0..10))  # -> Geometry, Transform
solid_union = SolidUnion(Breps=scale.Geometry)
mesh = Mesh(solid_union)
weaverbird_s_join_meshes_and_weld = WeaverbirdsJoinMeshesAndWeld(Mesh=mesh, Weld=Toggle(False))
weaverbird_s_loop_subdivision = WeaverbirdsLoopSubdivision(MeshCurves=weaverbird_s_join_meshes_and_weld, Level=Slider(2, range=1..3), SmoothNakedEdges=1)
weaverbird_s_picture_frame = WeaverbirdsPictureFrame(MeshPolylines=weaverbird_s_loop_subdivision, Distance=Slider(23, range=0..100), InsetType=0)
weaverbird_s_mesh_thicken = WeaverbirdsMeshThicken(MeshCurves=weaverbird_s_picture_frame, Distance=Slider(2, range=0..10), OffsetType=0)
custom_preview = CustomPreview(Geometry=scale.Geometry, Material=ColourSwatch(SwatchColor=RGB(9, 188, 255)))
custom_preview_2 = CustomPreview(Geometry=weaverbird_s_mesh_thicken, Material=ColourSwatch(SwatchColor=RGB(255, 145, 0)))
