# Grasshopper definition EX_051_plugins_subD.gh (Grasshopper 1.0.7)
# plug-ins: Kangaroo2 Components, MeshEdit Components, Weaverbird, Bifocals

number_slider = Slider(81, range=0..100)
construct_point = ConstructPoint(XCoordinate=Slider(47, range=0..100), YCoordinate=Slider(52, range=0..100), ZCoordinate=Slider(86, range=0..100))
construct_point_2 = ConstructPoint(XCoordinate=number_slider, YCoordinate=number_slider, ZCoordinate=number_slider)
xy_plane = XYPlane(Origin=construct_point)
xy_plane_2 = XYPlane(Origin=construct_point_2)
center_box = CenterBox(Base=xy_plane, X=Slider(26, range=0..100), Y=Slider(28, range=0..100), Z=Slider(76, range=0..100))
center_box_2 = CenterBox(Base=xy_plane_2, X=Slider(12, range=0..100), Y=Slider(49, range=0..100), Z=Slider(35, range=0..100))
mesh_box = MeshBox(Base=center_box, XCount="4", YCount="4", ZCount="4")
mesh_box_2 = MeshBox(Base=center_box_2, XCount="4", YCount="4", ZCount="4")
subd_fuse = SubDFuse(SubDA=mesh_box, SubDB=mesh_box_2, BooleanOption=Slider(0, range=0..3), Smoothing=Slider(0.1, range=0..1))
custom_preview = CustomPreview(
    Geometry=subd_fuse,
    Material={diffuse=RGB(221, 160, 221), emission=RGB(66, 48, 66), shine=0.5, specular=RGB(255, 255, 255), transparency=0})
null_item = NullItem(Item=subd_fuse)  # -> NullFlags, InvalidFlags, Description
panel = Panel(null_item.NullFlags)
subd_from_mesh = SubDFromMesh(Mesh=mesh_box, Creases=1, Corners=1, Interpolate=False)
subd_from_mesh_2 = SubDFromMesh(Mesh=mesh_box_2, Creases=1, Corners=1, Interpolate=False)
merge = Merge(Data1=subd_from_mesh, Data2=subd_from_mesh_2)
stream_filter = StreamFilter(Gate=panel, Stream0=subd_fuse, Stream1=merge)
custom_preview_2 = CustomPreview(
    Geometry=stream_filter,
    Material={diffuse=RGB(221, 160, 221), emission=RGB(66, 48, 66), shine=0.5, specular=RGB(255, 255, 255), transparency=0})

# ----
# PLUGINS CAN BE USED SIMPLY AND CAN BE DELVED INTO ON A MORE ADVANCED LEVEL
# THE KEY IS TO UNDERSTAND HOW THEY WERE CONTRUCTED FROM THE VANILLA RIBBON NODES THAT COME WITH GRASSHOPPER FOR RHINO7
# ONLY THEN WILL YOU BE ABLE TO START PROGRAMMING AND COMPILING YOUR OWN PLUGINS THAT HAVE YET TO BE CREATED FOR THE PARAMETRIC AND COMPUTATIONAL DESIGNER/ARCHITECT AND ENGINEER
# 051_subD_example
mesh_from_subd = MeshFromSubD(Density=2)
subd_from_mesh_3 = SubDFromMesh(Creases=1, Corners=1, Interpolate=False)
multipipe = MultiPipe(NodeSize=0.5, EndOffset=1, StrutSize=1, Segment=0, KinkAngle=0.6, CubeFit=0, Caps=0)
subd_control_polygon = SubDControlPolygon()
subd_edges = SubDEdges(NewFormatting=False)  # -> Line, Edge, Tag, Id
subd_fuse_2 = SubDFuse(BooleanOption=0, Smoothing=10)

# ----
# - download mesh edit plugin for these scripts (Mesh credit: Daniel Christev)
number_slider_2 = Slider(53, range=0..100)
number_slider_3 = Slider(100, range=0..100)
range = Range(Domain=number_slider_2, Steps=number_slider_3)
sine = Sine(Value=range)
multiplication = Multiplication(A=sine, B=Slider(4, range=0..5))
construct_point_3 = ConstructPoint(XCoordinate=graft(range), YCoordinate=range, ZCoordinate=multiplication)
surface_from_points = SurfaceFromPoints(Points=flatten(construct_point_3), UCount=expr("x+1", number_slider_3), Interpolate=False)
surface = Surface(surface_from_points)
area = Area(Geometry=surface)  # -> Area, Centroid
dimensions = Dimensions(Surface=surface)  # -> UDimension, VDimension
number_slider_4 = Slider(5, range=0..20)
division = Division(A=dimensions.UDimension, B=dimensions.VDimension)
scale = Scale(Geometry=surface, Center=area.Centroid, Factor=Slider(2.526, range=0..5))  # -> Geometry, Transform
md_slider = MDSlider(
    SliderMode=0,
    slider_value=Point(0.5342425835, 0.4777299834, 0.5),
    x_domain=Domain(0, 1),
    y_domain=Domain(0, 1),
    z_domain=Domain(0, 1))
multiplication_2 = Multiplication(A=division, B=number_slider_4)
integer = Integer(multiplication_2)
divide_surface = DivideSurface(Surface=surface, UCount=integer, VCount=number_slider_4)  # -> flatten(Points), Normals, Parameters
md_slider_2 = MDSlider(
    SliderMode=0,
    slider_value=Point(0.3902784713, 0.4567147366, 0.5),
    x_domain=Domain(0, 1),
    y_domain=Domain(0, 1),
    z_domain=Domain(0, 1))
point = Point(divide_surface.Points)
md_slider_3 = MDSlider(
    SliderMode=0,
    slider_value=Point(0.7839135891, 0.532834495, 0.5),
    x_domain=Domain(0, 1),
    y_domain=Domain(0, 1),
    z_domain=Domain(0, 1))
evaluate_surface = EvaluateSurface(Surface=reparameterize(scale.Geometry), Point=[md_slider_3, md_slider, md_slider_2])  # -> Point, Normal, UDirection, VDirection, Frame
distance = Distance(PointA=graft(evaluate_surface.Point), PointB=divide_surface.Points)
expression = Expression(w=flatten(Slider(0.396, range=0..2)), t=distance, Expression="sin(2*w^2*t)")
flip_matrix = FlipMatrix(Data=expression)
ma = MassMultiplication(Input=flip_matrix)  # -> flatten(Result), PartialResults
multiplication_3 = Multiplication(A=Slider(5.567, range=0..10), B=ma.Result)
unit_z = UnitZ(Factor=multiplication_3)
move = Move(Geometry=divide_surface.Points, Motion=unit_z)  # -> Geometry, Transform
expression_2 = Expression(u=integer, Expression="u+1")
mesh_frompoints = MeshFromPoints(Points=move.Geometry, UDirection=expr("x+1", integer), VDirection=expr("x+1", number_slider_4))
surface_from_points_2 = SurfaceFromPoints(Points=move.Geometry, UCount=expression_2, Interpolate=False)

mesh = Mesh(mesh_frompoints)

# ----
# Great Tutorial: How to Rhino
# 
# https://www.youtube.com/watch?v=G1axZyqURwI
mesh_2 = Mesh(mesh)
weld_mesh = WeldMesh(Mesh=mesh_2, Angle=3.141592654)
subd_from_mesh_4 = SubDFromMesh(Mesh=mesh_2, Creases=Slider(1, range=1..2), Corners=Slider(1, range=1..2), Interpolate=Toggle(False))
nakedvertices = NakedVertices(Mesh=weld_mesh)  # -> ClothedIndex, NakedIndex, ClothedPts, NakedPts
subd_edges_2 = SubDEdges(SubD=subd_from_mesh_4, NewFormatting=False)  # -> Line, Edge, Tag, Id
point_2 = Point(nakedvertices.NakedPts)
panel_2 = Panel(subd_edges_2.Tag)
curve = Curve(subd_edges_2.Line)
curve_2 = Curve(subd_edges_2.Edge)
panel_3 = Panel("*smooth*")
panel_4 = Panel("*naked*")
panel_5 = Panel("*interior*")
match_text = MatchText(Text=panel_2, Pattern="*crease*", Case=True)
panel_6 = Panel(match_text)
cull_pattern = CullPattern(List=curve_2, CullPattern=match_text)
join_curves = JoinCurves(Curves=cull_pattern, Preserve=False)
panel_7 = Panel(cull_pattern)
pipe = Pipe(Curve=join_curves, Radius=1, Caps=0)
custom_preview_3 = CustomPreview(
    Geometry=pipe,
    Material={diffuse=RGB(221, 160, 221), emission=RGB(66, 48, 66), shine=0.5, specular=RGB(255, 255, 255), transparency=0})

subd = SubD(subd_from_mesh_4)
mesh_from_subd_2 = MeshFromSubD(SubD=subd, Density=Slider(3, range=0..4))
mesh_from_subd_3 = ValueList({"One": 0, "Two": 1}, selected="One")
mesh_edges = MeshEdges(Mesh=mesh_from_subd_2)  # -> NakedEdges, InteriorEdges, NonManifoldEdges
face_boundaries = FaceBoundaries(Mesh=mesh_from_subd_2)
subd_control_polygon_2 = SubDControlPolygon(SubD=mesh_from_subd_2)
discontinuity = Discontinuity(Curve=face_boundaries, Level=1)  # -> Points, Parameters
stream_filter_2 = StreamFilter(Gate=mesh_from_subd_3, Stream0=mesh_from_subd_2, Stream1=subd_control_polygon_2)
custom_preview_4 = CustomPreview(
    Geometry=stream_filter_2,
    Material={diffuse=RGB(221, 160, 221), emission=RGB(66, 48, 66), shine=0.5, specular=RGB(255, 255, 255), transparency=0})
list_item = ListItem(List=discontinuity.Points, Index=0, Wrap=True)  # -> Item, Item1, Item2, Item3
number_slider_5 = Slider(4, range=0..10)
line = Line(StartPoint=list_item.Item, EndPoint=list_item.Item2)
line_2 = Line(StartPoint=list_item.Item1, EndPoint=list_item.Item3)
divide_curve = DivideCurve(Curve=line_2, Count=number_slider_5, Kinks=False)  # -> Points, Tangents, Parameters
divide_curve_2 = DivideCurve(Curve=line, Count=number_slider_5, Kinks=False)  # -> Points, Tangents, Parameters
interpolate = Interpolate(Vertices=divide_curve.Points, Degree=3, Periodic=False, KnotStyle=1)  # -> Curve, Length, Domain
interpolate_2 = Interpolate(Vertices=divide_curve_2.Points, Degree=3, Periodic=False, KnotStyle=1)  # -> Curve, Length, Domain
curve_curve = CurveCurve(CurveA=interpolate_2.Curve, CurveB=interpolate.Curve)  # -> Points, ParamsA, ParamsB
curve_3 = Curve(mesh_edges.NakedEdges)
shatter = Shatter(Curve=interpolate_2.Curve, Parameters=curve_curve.ParamsA)
shatter_2 = Shatter(Curve=interpolate.Curve, Parameters=curve_curve.ParamsB)
merge_2 = Merge(Data1=shatter, Data2=shatter_2)  # -> flatten(Result)
end_points = EndPoints(Curve=merge_2)  # -> Start, End
line_3 = Line(StartPoint=end_points.Start, EndPoint=end_points.End)
merge_3 = Merge(Data1=curve_3, Data2=line_3)  # -> flatten(Result)
weaverbird_s_mesh_from_lines_weave_back = WeaverbirdsMeshFromLinesWeaveBack(Lines=merge_3, MaximumValence=4)
weaverbird_s_stellate_cumulation = WeaverbirdsStellateCumulation(MeshPolylines=weaverbird_s_mesh_from_lines_weave_back, Distance=Slider(0.333, range=0..1))
unit_z_2 = UnitZ(Factor=Slider(0.167, range=0..1))
weaverbird_s_picture_frame = WeaverbirdsPictureFrame(MeshPolylines=weaverbird_s_stellate_cumulation, Distance=Slider(10, range=0..10), InsetType=0)
negative = Negative(Value=unit_z_2)
weaverbird_s_mesh_thicken = WeaverbirdsMeshThicken(MeshCurves=weaverbird_s_picture_frame, Distance=negative, OffsetType=0)
weaverbird_s_catmull_clark_subdivision = WeaverbirdsCatmullClarkSubdivision(MeshCurves=weaverbird_s_mesh_thicken, Level=Slider(2, range=1..3), SmoothNakedEdges=1)

multipipe_2 = MultiPipe(Curves=curve, NodeSize=Slider(1, range=0..1), EndOffset=1, StrutSize=1, Segment=0, KinkAngle=0.6, CubeFit=0, Caps=0)
