# Grasshopper definition MGSM_exercises_Section_003_Plugins.gh (Grasshopper 1.0.7)
# plug-ins: MeshEdit Components, MarchingCubes, Weaverbird, Kangaroo2 Components

# ----
# Vanilla Grasshopper
# Data Trees
# Ladybug
# Weaverbird
# FireFly
# Lunchbox
# Pufferfish
# Hal/Kuka/Robotics/tocoABB
# Paneling tools
# Kangaroo
# fologram
# Galapogos
# ghpython
# ghpython remote
# C#
# Lunchbox (panelization and structure creation)
# LunchBox is a plug-in for Grasshopper for
#  exploring mathematical shapes, paneling,
#  structures, and workflow.  We have also
#  introduced new components for general
#  machine learning implementations such as
#  regression analysis, clustering, and
#  networks.
# Cellular Growth (Metaball - Cocoon - Voronoi - Weaverbird - Octree)
# 
# https://www.cs.cmu.edu/afs/cs.cmu.edu/academic/class/15394u-s20/lectures/weaverbird/weaverbird.html
# Data
# Generate
# Machine Learning (proving ground)
# Math
# Panels
# Structure
# Utilities
# Workflow
# Metaball - Cocoon - Voronoi - Weaverbird - Octree - SubD
# Weaverbird
# Weaverbird is a topological mesh editor
#  where it allows both Rhino and
# Grasshopper used to do mesh editing,
# subdivisions, and mesh transformations. In
#  other words, Weaverbird can make some
# nice looking mesh 'skins' of your model with
# fewer and less complicated scripts. This
# plug-in is able to reconstruct the shape of
# the model and subdivisions of any mesh
# (including ones made with polylines).
# 041_Lunchbox_basic
# 009_Mesh
# - lunchox can be used for simple
# paneling and creating archtectures
# Create
# Define
# Extract
# Smoothen
# SubD
# Transform
# The Pufferfish is one of few animals which
#  is capable of changing its shape.
# This plugin is a set of 330 components
# which focuses on Tweens, Blends, Morphs,
#  Averages, Transformations, & Interpolations
#  - essentially Shape Changing. Pufferfish mainly
#  uses parameters and factors for inputs for more
#  custom control over operations like tweens and
#  grids as opposed to grasshoppers usual division
#  count inputs. These components are
#  accompanied by support components which
#  are useful methods for tween / blend /
#  morph / lattice operations such as making
# curves compatible, a custom curve graph
#  mapper, and a multi-threaded morph to
# twisted box.
# Ladybug allows you to import and analyze
#  standard weather data in Grasshopper;
# draw diagrams like Sun-path, wind-rose,
#  radiation-rose, etc; customize the diagrams
#  in several ways; run radiation analysis,
# shadow studies, and view analysis.
# Kangaroo is a Live Physics engine for
# interactive simulation, form-finding,
#  optimization and constraint solving.
# ghPython
# This is the Rhino 5 for Windows version.
#  Rhino for Mac and Rhino WIP+6 all come
#  with their own GhPython interpreter, that is
#  specific and needs no tweaking.
# Meshedit is a set of components which
#  extend Grasshopper's ability to work with
#  meshes.
# Hal/Kuka/Robotics/tocoABB
# KUKA|prc enables you to program
#  industrial
#  robots directly out of the parametric
#  modelling environment, including a full
#  kinematic simulation of the robot. The
#  generated files can be executed at the
#  KUKA robot, without requiring any additional
#  software.
# fologram
# Use Fologram to view and share Rhino and
# Grasshopper instantly in mixed reality on
# HoloLens 1, HoloLens 2, Oculus Quest, iOS
#  and Android. Geometry, layers and
# grasshopper parameters can be edited in
# real time in Fologram to create powerful
# tools for design, communication,
# collaboration and fabrication.
# ghpython remote
# GH Python Remote is a special component
#  that lets you use regular Python code
#  directly in the GHPython component, like
#  importing Numpy, Scipy, matlplotib et al.
# 
# C#
# Elk is a set of tools to generate map and
#  topographical surfaces using open source
#  data from OpenStreetMap.org and USGS.
# Firefly offers a set of software tools
#  dedicated to bridging the gap between
#  Grasshopper (a free plug-in for Rhino) and
#  micro-controllers like the Arduino. It allows
#  near real-time data flow between the digital
#  and physical worlds – enabling the possibility
#  to explore virtual and physical prototypes
#  with unprecedented fluidity.
mesh_area = MeshArea()  # -> Area, Centroid; disabled
mesh_edges = MeshEdges()  # -> NakedEdges, InteriorEdges, NonManifoldEdges; disabled
mesh_convertquads = MeshConvertQuads(ShortDiagonal=True)  # -> Mesh, Split; disabled
mesh_triangulate = MeshTriangulate(ShortDiagonal=True)  # disabled
mesh_eval = MeshEval()  # -> Point, Normal, Colour; disabled
mesh_closest_point = MeshClosestPoint()  # -> Point, Index, Parameter; disabled
# MGSM
# Grasshopper for Rhino3D
# 002_ribbon_vanilla_grasshopper
# 001_Introduction
# Grasshopper Canvas for Rhino3D:
# 
# Ribbon:
# 
# File
# - new/open
# - save document/saveas
# - export image
# - document properties
# - user objects/ clusters
# - special folders (components/user objects)
# - preferences
# Ribbon Vanilla Grasshopper
# 
# Params
# Maths
# Sets - data trees
# Vectors
# Curves
# Surfaces
# IntersectionTransformations
# Display
# Display
# 
# - icons, wires, names
# - (consider Bifocals plugin)
# - selected only preview
# - plane size
# - mesh edges
# - gumball
# - canvas widgets
# (Markov, profiler, message balloons)
# Edit
# 
# - cut/copy/paste/delete
# - arrange groups
# - group/ungroup
# - cluster
# - find
# - create component popup
# Solution
# 
# - disable solver
# - scroll button/spacebar
# (cluster/group/preview/enable/solver/
# bake/zoom/find/preferences)
# Help
# 
# - tutorials
# - online forums
# - node references
# View
# 
# - obscure components
# - zoom options on canvas
# http://grasshopperdocs.com/
# https://www.food4rhino.com/en
# PLUGINS CAN BE USED SIMPLY AND CAN BE DELVED INTO ON A MORE ADVANCED LEVEL
# THE KEY IS TO UNDERSTAND HOW THEY WERE CONTRUCTED FROM THE VANILLA RIBBON NODES THAT COME WITH GRASSHOPPER FOR RHINO7
# ONLY THEN WILL YOU BE ABLE TO START PROGRAMMING AND COMPILING YOUR OWN PLUGINS THAT HAVE YET TO BE CREATED FOR THE PARAMETRIC AND COMPUTATIONAL DESIGNER/ARCHITECT AND ENGINEER
# PanelingTools for Rhino and Grasshopper
#  by Robert McNeel & Associates is widely
#  used by designers, architects, and building
#  professionals. It supports intuitive design of
#  paneling concepts as well as help
#  rationalize complex geometry into a format
#  that is suitable for analysis and fabrication.
# Panelling Tools
# Curve
# Grid
# Grid Attractors
# Grid Utility
# Panel 2D
# Panel 3D
# Panel Utility
# Param
# Analysis
face_normals = FaceNormals()  # -> Centers, Normals; disabled
mesh_nakededge = MeshNakedEdge()  # -> V, A, B; disabled
mesh_volume = MeshVolume()  # -> Volume, Centroid; disabled
face_boundaries = FaceBoundaries()  # disabled
mesh_explode = MeshExplode(Interpolate=False)  # disabled
deconstruct_mesh = DeconstructMesh()  # -> Vertices, Faces, Colours, Normals; disabled
deconstruct_face = DeconstructFace()  # -> CornerA, CornerB, CornerC, CornerD; disabled
mesh_inclusion = MeshInclusion(Strict=False)  # disabled
mesh_quad = MeshQuad(CornerA=0, CornerB=1, CornerC=2, CornerD=3)  # disabled
mesh_plane = MeshPlane(Boundary={Plane=PlaneXY(0, 0, 0), Size=Domain2(u=-10..10, v=-10..10)}, WidthCount=10, HeightCount=10)  # -> Mesh, Area; disabled
mesh_sphere = MeshSphere(Base=PlaneXY(0, 0, 0), Radius=10, UCount=10, VCount=20)  # disabled
mesh_box = MeshBox(Base={Plane=PlaneXY(0, 0, 0), X=Domain(-10, 10), Y=Domain(-10, 10), Z=Domain(-10, 10)}, XCount=10, YCount=10, ZCount=10)  # disabled
# Primitive
construct_mesh = ConstructMesh(Vertices=[Point(0, 0, 0), Point(10, 0, 0), Point(10, 10, 0), Point(0, 10, 0)], Faces={A=0, B=1, C=2, D=3})  # disabled
mesh_sphere_ex = MeshSphereEx(Base=PlaneXY(0, 0, 0), Radius=10, Count=5)  # disabled
mesh_triangle = MeshTriangle(CornerA=0, CornerB=1, CornerC=2)  # disabled
mesh_colours = MeshColours(Colours=[RGB(127, 255, 0), RGB(0, 100, 0), RGB(34, 139, 34), RGB(124, 252, 0), RGB(154, 205, 50), RGB(173, 255, 47), RGB(50, 205, 50), RGB(152, 251, 152)])  # disabled
mesh_spray = MeshSpray(SprayMode=11)  # disabled
metaball = MetaBall(Plane=PlaneXY(0, 0, 0))  # disabled
voronoi = Voronoi(BruteForceOverride=False)  # disabled
# Tiangulation
delaunay_edges = DelaunayEdges(Plane=PlaneXY(0, 0, 0))  # -> Connectivity, Edges; disabled
delaunay_mesh = DelaunayMesh(Plane=PlaneXY(0, 0, 0))  # disabled
octree = OcTree(Square=False, Group=5)  # -> Boxes, Points; disabled
metaball_t = MetaBallT(Plane=PlaneXY(0, 0, 0), Threshold=0.5)  # disabled
voronoi_3d = Voronoi3D()  # -> Cells, Boundary; disabled
metaball_t_custom = MetaBallTCustom(Plane=PlaneXY(0, 0, 0), Threshold=0.5)  # disabled
convex_hull = ConvexHull(Plane=PlaneXY(0, 0, 0))  # -> Hull, HullZ, Indices; disabled
delete_faces = DeleteFaces()  # disabled
mesh_surface = MeshSurface(UCount=5, VCount=5, Overhang=True, Equalize=False)  # disabled
cull_faces = CullFaces()  # disabled
# Utilities
mesh_brep = MeshBrep(Settings={GridMaxCount=0, GridMinCount=16, JaggedSeams=False, MaxEdgeLength=0, MinEdgeLength=0.0001, MinTolerance=0, Refine=True, RefineAngle=0, RelativeTolerance=0.65, SimplePlanes=True, Tolerance=0})  # disabled
unweld_mesh = UnweldMesh(Angle=1.570796327)  # disabled
mesh_shadow = MeshShadow(Light=Vector(0, 0, -1), Plane=PlaneXY(0, 0, 0))  # disabled
mesh_join = MeshJoin()  # disabled
delete_vertices = DeleteVertices(Shrink=True)  # disabled
cull_vertices = CullVertices(Shrink=True)  # disabled
weld_mesh = WeldMesh(Angle=3.141592654)  # disabled
flip_mesh = FlipMesh(VertexNormals=True, FaceNormals=True, FaceOrientation=True)  # disabled
mesh_weldvertices = MeshWeldVertices(Tolerance=0.01)  # -> RuntimeMessage, Mesh; disabled
mesh_frompoints = MeshFromPoints()  # disabled
occlusion = Occlusion()  # -> Hits, Occlusion; disabled
simple_mesh = SimpleMesh()  # disabled
mesh_unifynormals = MeshUnifyNormals()  # disabled
quadrangulate = Quadrangulate(Angle=0.03490658504, Ratio=0.875)  # -> Mesh, Count; disabled
triangulate = Triangulate()  # -> Mesh, Count; disabled
mesh_flip = MeshFlip()  # disabled
metaball_t_custom_2 = MetaBallTCustom(Plane=PlaneXY(0, 0, 0), Threshold=0.5)  # disabled
metaball_t_2 = MetaBallT(Plane=PlaneXY(0, 0, 0), Threshold=0.5)  # disabled
metaball_t_3 = MetaBallT(Plane=PlaneXY(0, 0, 0), Threshold=0.5)  # disabled
curve_charge = CurveCharge()  # disabled
curve_group_charge = CurveGroupCharge()  # disabled
point_charge = PointCharge()  # disabled
brep_charge = BrepCharge()  # disabled
refine = Refine()  # disabled
cocoon = Cocoon(Simple=False)  # -> Mesh, RefinementData; disabled
_3d_voronoi = _3DVoronoi()  # -> _3DVoronoiCells, Connectivity; disabled
voronoi_groups = VoronoiGroups(Boundary={Plane=PlaneXY(0, 0, 0), Size=Domain2(u=-10..10, v=-10..10)})  # -> Diagram1, Diagram2; disabled
voronoi_3d_2 = Voronoi3D()  # -> Cells, Boundary; disabled
voronoi_cell = VoronoiCell()  # disabled
voronoi_2 = Voronoi(BruteForceOverride=False)  # disabled
weaverbird_s_tile = WeaverbirdsTile(FillStrategy=1, OptIn=2)  # disabled
weaverbird_s_mesh_from_lines_weave_back = WeaverbirdsMeshFromLinesWeaveBack(MaximumValence=4)  # disabled
quad_remesh_settings = QuadRemeshSettings(TargetCount=1000, AdaptiveSize=0, AdaptiveCount=False, HardEdges=False, SeamEdges=0, Symmetry=0, GuideCurves=0)  # disabled
quad_remesh = QuadRemesh(Settings={aqc=True, as=50, dhe=True, gci=0, null=False, pme=0, sa=0, tqc=2000})  # disabled
octree_2 = OcTree(Square=False, Group=5)  # -> Boxes, Points; disabled
quadtree = QuadTree(Plane=PlaneXY(0, 0, 0), Square=False, Group=5)  # -> Quads, Points; disabled
subd_fuse = SubDFuse(BooleanOption=0, Smoothing=10)  # disabled
subd_from_mesh = SubDFromMesh(Creases=1, Corners=1, Interpolate=False)  # disabled
multipipe = MultiPipe(NodeSize=0.5, EndOffset=1, StrutSize=1, Segment=0, KinkAngle=0.6, CubeFit=0, Caps=0)  # disabled
mesh_from_subd = MeshFromSubD(Density=2)  # disabled
subd_control_polygon = SubDControlPolygon()  # disabled
subd_edges = SubDEdges(NewFormatting=False)  # -> Line, Edge, Tag, Id; disabled

# ----
# - download mesh edit plugin for these scripts (Mesh credit: Daniel Christev)
number_slider = Slider(40, range=0..100)  # disabled
number_slider_2 = Slider(100, range=0..100)  # disabled
number_slider_3 = Slider(4, range=0..5)  # disabled
range = Range(Domain=number_slider, Steps=number_slider_2)  # disabled
sine = Sine(Value=range)  # disabled
multiplication = Multiplication(A=sine, B=number_slider_3)  # disabled
number_slider_4 = Slider(1.679, range=0..5)  # disabled
construct_point = ConstructPoint(XCoordinate=graft(range), YCoordinate=range, ZCoordinate=multiplication)  # disabled
surface_from_points = SurfaceFromPoints(Points=flatten(construct_point), UCount=expr("x+1", number_slider_2), Interpolate=False)  # disabled
surface = Surface(surface_from_points)  # disabled
area = Area(Geometry=surface)  # -> Area, Centroid; disabled
dimensions = Dimensions(Surface=surface)  # -> UDimension, VDimension; disabled
number_slider_5 = Slider(8, range=0..100)  # disabled
division = Division(A=dimensions.UDimension, B=dimensions.VDimension)  # disabled
scale = Scale(Geometry=surface, Center=area.Centroid, Factor=number_slider_4)  # -> Geometry, Transform; disabled
md_slider = MDSlider(
    SliderMode=0,
    slider_value=Point(0.5964374077, 0.3989495998, 0.5),
    x_domain=Domain(0, 1),
    y_domain=Domain(0, 1),
    z_domain=Domain(0, 1))  # disabled
multiplication_2 = Multiplication(A=division, B=number_slider_5)  # disabled
integer = Integer(multiplication_2)  # disabled
md_slider_2 = MDSlider(
    SliderMode=0,
    slider_value=Point(0.758053798, 0.3364762142, 0.5),
    x_domain=Domain(0, 1),
    y_domain=Domain(0, 1),
    z_domain=Domain(0, 1))  # disabled
divide_surface = DivideSurface(Surface=surface, UCount=integer, VCount=number_slider_5)  # -> flatten(Points), Normals, Parameters; disabled
number_slider_6 = Slider(0.243, range=0..2)  # disabled
md_slider_3 = MDSlider(
    SliderMode=0,
    slider_value=Point(0.1948275682, 0.7902063509, 0.5),
    x_domain=Domain(0, 1),
    y_domain=Domain(0, 1),
    z_domain=Domain(0, 1))  # disabled
evaluate_surface = EvaluateSurface(Surface=reparameterize(scale.Geometry), Point=[md_slider_3, md_slider, md_slider_2])  # -> Point, Normal, UDirection, VDirection, Frame; disabled
distance = Distance(PointA=graft(evaluate_surface.Point), PointB=divide_surface.Points)  # disabled
point = Point(divide_surface.Points)  # disabled
expression = Expression(w=flatten(number_slider_6), t=distance, Expression="sin(2*w^2*t)")  # disabled
flip_matrix = FlipMatrix(Data=expression)  # disabled
number_slider_7 = Slider(7.333, range=0..10)  # disabled
ma = MassMultiplication(Input=flip_matrix)  # -> flatten(Result), PartialResults; disabled
multiplication_3 = Multiplication(A=number_slider_7, B=ma.Result)  # disabled
unit_z = UnitZ(Factor=multiplication_3)  # disabled
move = Move(Geometry=divide_surface.Points, Motion=unit_z)  # -> Geometry, Transform; disabled
expression_2 = Expression(u=integer, Expression="u+1")  # disabled
mesh_frompoints_2 = MeshFromPoints(Points=move.Geometry, UDirection=expr("x+1", integer), VDirection=expr("x+1", number_slider_5))  # disabled
surface_from_points_2 = SurfaceFromPoints(Points=move.Geometry, UCount=expression_2, Interpolate=False)  # disabled

# ----
# Kangaroo - Galapagos (form finding)
# Kangaroo is a Live Physics engine for
# interactive simulation, form-finding,
#  optimization and constraint solving.
# Galapogos
# goat is an optimization add-on component
#  for Rhino's Grasshopper. It perfectly
#  complements galapagos, David Rutten's
#  evolutionary solver. Relying on gradient-free
#  optimization algorithms, the component
# pursues a mathematical rigorous approach
#  delivering fast and deterministic results. At
# every run, goat will yield the same optimal
#  result.
solver = Solver(Reset=False, Threshold=1e-15, Tolerance=0.0001, On=True)  # -> I, V, O; disabled
gene_pool = GenePool(Decimals=2, Maximum=100, Minimum=0, Value=[50, 50, 50, 50, 50, 50, 50, 50, 50, 50])  # disabled
fitness_landscape = FitnessLandscape(Count=-1, ColourMode=1, ContourMode=2, Remap=False)  # disabled
# Ladybug (environmental analysis)
# 
# https://www.food4rhino.com/en/app/ladybug-tools
# 
# all sample files depend on ghpython node
# which comes with Rhino 6/7
# Ladybug allows you to import and analyze
#  standard weather data in Grasshopper;
# draw diagrams like Sun-path, wind-rose,
#  radiation-rose, etc; customize the diagrams
#  in several ways; run radiation analysis,
# shadow studies, and view analysis.
# 
# Ladybug allows you to import and analyze
#  standard weather data in Grasshopper;
#  draw diagrams like Sun-path, wind-rose,
#  radiation-rose, etc; customize the diagrams
#  in several ways; run radiation analysis,
#  shadow studies, and view analysis.
# 
# Honeybee connects Grasshopper3D to
#  validated simulation engines such as
#  EnergyPlus/OpenStudio and Radiance for
#  building energy, comfort, daylighting and
#  lighting simulation.
# 
# Dragonfly enables the creation and
#  manipulation of large-scale EnergyPlus and
#  Radiance models by capitalizing on an
#  abstracted 2D representation of building
#  geometry, where all rooms are assumed to
#  be extrusions of floor plates.
# 
# Butterfly connects Grasshopper to the
#  OpenFOAM engine, wich can be used to
#  run advanced computational fluid dynamic
#  (CFD) simulations.
galapagos = Galapagos()
